# Grasshopper definition clean_GHFile.gh (Grasshopper 1.0.7)
# plug-ins: MindeskText, SolidsVR, MDSKGrasshopper

# CASE 0 - NO GEOMETRY
mindesk_toggle = BooleanToggle(True)
brep = Brep(<brep referenced from the Rhino model>)
join = BrepJoin(Breps=flatten(brep))  # -> Breps, Closed
debrep = DeconstructBrep(Brep=join.Breps)  # -> Faces, Edges, Vertices
item = ListItem(List=debrep.Vertices, Index=0, Wrap=True)  # -> Item, Item1, Item2, Item3, Item4, Item5, Item6, Item7
pt = Point([item.Item4, item.Item, item.Item3, item.Item7, item.Item5, item.Item1, item.Item2, item.Item6])
# PRE-PROCESSING
mdsk_geometry = MDSK(Geometry=join.Breps, Color=RGB(255, 255, 255), Start=mindesk_toggle)

division_slider = Curve([<curve referenced from the Rhino model> x3])
volume_slider = Curve(<curve referenced from the Rhino model>)
# MESHING
divslider = DivisionSlider(SliderVR=division_slider, Brep=join.Breps)  # -> UCount, VCount, WCount, Text, Size, Plane, Colors, Geometry
volumeslider = VolumePercentageSlider(SliderVR=volume_slider, Brep=join.Breps)  # -> VolumePercentage, Text, Size, Plane, Color, Geometry
mdsk_text = VRTEXT(Text=divslider.Text, Size=divslider.Size, Plane=divslider.Plane, Color=divslider.Colors, Start=mindesk_toggle)
mdsk_geometry_2 = MDSK(Geometry=divslider.Geometry, Color=divslider.Colors, Start=mindesk_toggle)
mdsk_text_2 = VRTEXT(Text=volumeslider.Text, Size=volumeslider.Size, Plane=volumeslider.Plane, Color=volumeslider.Color, Start=mindesk_toggle)
mdsk_geometry_3 = MDSK(Geometry=volumeslider.Geometry, Color=volumeslider.Color, Start=mindesk_toggle)
meshsbrep = MeshSBrep(
    Brep=join.Breps,
    Point=pt,
    UCount=divslider.UCount,
    VCount=divslider.VCount,
    WCount=divslider.WCount,
    VolumeToRemove=volumeslider.VolumePercentage)

surface_slider = Curve(<curve referenced from the Rhino model>)
load_slider = Curve(<curve referenced from the Rhino model>)
surfslider = SurfaceSlider(SliderVR=surface_slider, Brep=join.Breps)  # -> SurfaceNumber, Text, Size, Plane, Colors, Geometry
loadslider = LoadSlider(SliderVR=load_slider, Brep=join.Breps)  # -> Load, Text, Size, Plane, Colors, Geometry
mdsk_text_3 = VRTEXT(Text=loadslider.Text, Size=loadslider.Size, Plane=loadslider.Plane, Color=loadslider.Colors, Start=mindesk_toggle)
mdsk_geometry_4 = MDSK(Geometry=loadslider.Geometry, Color=loadslider.Colors, Start=mindesk_toggle)
# LOADS
mdsk_text_4 = VRTEXT(Text=surfslider.Text, Size=surfslider.Size, Plane=surfslider.Plane, Color=surfslider.Colors, Start=mindesk_toggle)
mdsk_geometry_5 = MDSK(Geometry=surfslider.Geometry, Color=surfslider.Colors, Start=mindesk_toggle)
uniloads = UniformLoadComponentForFEA(SurfaceNumber=surfslider.SurfaceNumber, LoadVector=loadslider.Load, Mesh=meshsbrep)  # -> PointLoads, LoadArrows, ArrowColoring
mdsk_geometry_6 = MDSK(Geometry=uniloads.LoadArrows, Color=uniloads.ArrowColoring, Start=mindesk_toggle)

surface_slider_2 = Curve(<curve referenced from the Rhino model>)
surface_slider_3 = Curve(<curve referenced from the Rhino model>)
surfslider_2 = SurfaceSlider(SliderVR=surface_slider_3, Brep=join.Breps)  # -> SurfaceNumber, Text, Size, Plane, Colors, Geometry
surfslider_3 = SurfaceSlider(SliderVR=surface_slider_2, Brep=join.Breps)  # -> SurfaceNumber, Text, Size, Plane, Colors, Geometry
# BC
mdsk_text_5 = VRTEXT(
    Text=surfslider_2.Text,
    Size=surfslider_2.Size,
    Plane=surfslider_2.Plane,
    Color=surfslider_2.Colors,
    Start=mindesk_toggle)
mdsk_geometry_7 = MDSK(Geometry=surfslider_2.Geometry, Color=surfslider_2.Colors, Start=mindesk_toggle)
mdsk_text_6 = VRTEXT(
    Text=surfslider_3.Text,
    Size=surfslider_3.Size,
    Plane=surfslider_3.Plane,
    Color=surfslider_3.Colors,
    Start=mindesk_toggle)
mdsk_geometry_8 = MDSK(Geometry=surfslider_3.Geometry, Color=surfslider_3.Colors, Start=mindesk_toggle)
unibc = UniformBCComponentForFEA(SurfaceNumber=surfslider_2.SurfaceNumber, Mesh=meshsbrep)  # -> BCPoints, BCCones, ColoringForBCCones
unibc_2 = UniformBCComponentForFEA(SurfaceNumber=surfslider_3.SurfaceNumber, Mesh=meshsbrep)  # -> BCPoints, BCCones, ColoringForBCCones
mdsk_geometry_9 = MDSK(Geometry=unibc.BCCones, Color=unibc.ColoringForBCCones, Start=mindesk_toggle)
mdsk_geometry_10 = MDSK(Geometry=unibc_2.BCCones, Color=unibc_2.ColoringForBCCones, Start=mindesk_toggle)

predef_slider = Curve(<curve referenced from the Rhino model>)
predispslider = PreDispSlider(SliderVR=predef_slider, Geoemtry=join.Breps)  # -> PrescribedDisplacement, Text, Size, Plane, Colors, Geometry
mdsk_text_7 = VRTEXT(
    Text=predispslider.Text,
    Size=predispslider.Size,
    Plane=predispslider.Plane,
    Color=predispslider.Colors,
    Start=mindesk_toggle)
mdsk_geometry_11 = MDSK(Geometry=predispslider.Geometry, Color=predispslider.Colors, Start=mindesk_toggle)
# PREDEF
predef_sphere = Brep(<brep referenced from the Rhino model>)
preddisp = PreDisp(Sphere=predef_sphere, PrescribedDisplacement=predispslider.PrescribedDisplacement, Mesh=meshsbrep)  # -> PrescribedDisplacement, Text, Size, Plane, Colors
mdsk_text_8 = VRTEXT(Text=preddisp.Text, Size=preddisp.Size, Plane=preddisp.Plane, Color=preddisp.Colors, Start=mindesk_toggle)

# ----
# MATERIAL
panel = Panel("210000")
material = CreateMaterial(EModulus=panel, PRatio="0.3", YieldStress="355")

# ----
# ANALYZING
# ANALYZE
femsolver = FEMSolver(
    Mesh=meshsbrep,
    BoundaryConditions=[unibc.BCPoints, unibc_2.BCPoints],
    PointLoads=uniloads.PointLoads,
    PreDeformations=preddisp.PrescribedDisplacement,
    Material=material)  # -> Displacement, Strain, Stress, Text, Size, Plane, ColorT
mdsk_text_9 = VRTEXT(Text=femsolver.Text, Size=femsolver.Size, Plane=femsolver.Plane, Color=femsolver.ColorT, Start=mindesk_toggle)

# ----
# VR CROSS-SECTION
cross_section_curves = Curve([<curve referenced from the Rhino model> x4])
crosssec = GetInformationOfCrossSec(Curves=cross_section_curves, Mesh=meshsbrep)  # -> Point, Colors, Text, Size, Plane, Colors_2
mdsk_text_10 = VRTEXT(Text=crosssec.Text, Size=crosssec.Size, Plane=crosssec.Plane, Color=crosssec.Colors_2, Start=mindesk_toggle)
mdsk_geometry_12 = MDSK(Geometry=crosssec.Point, Color=RGB(255, 255, 255), Start=mindesk_toggle)

node_info_sphere = Brep(<brep referenced from the Rhino model>)
# NODE VR INFO
node_info = GetInformationOfNode(Sphere=node_info_sphere, Mesh=meshsbrep)  # -> Text, Size, Plane, Colors, TextSphere, Size_2, PlaneSphere
mdsk_text_11 = VRTEXT(Text=node_info.Text, Size=node_info.Size, Plane=node_info.Plane, Color=node_info.Colors, Start=mindesk_toggle)
mdsk_text_12 = VRTEXT(
    Text=node_info.TextSphere,
    Size=node_info.Size_2,
    Plane=node_info.PlaneSphere,
    Color=node_info.Colors,
    Start=mindesk_toggle)

scale_slider = Curve(<curve referenced from the Rhino model>)
# POST-PROCESSING
# DEFORMATION VR PREVIEW
defslider = DeformationSlider(SliderVR=scale_slider, Brep=join.Breps)  # -> Scale, Text, Size, Plane, Colors, Geometry
mdsk_text_13 = VRTEXT(Text=defslider.Text, Size=defslider.Size, Plane=defslider.Plane, Color=defslider.Colors, Start=mindesk_toggle)
mdsk_geometry_13 = MDSK(Geometry=defslider.Geometry, Color=defslider.Colors, Start=mindesk_toggle)
viewdef = ViewDeformations(Mesh=meshsbrep, Displacement=femsolver.Displacement, Scaling=defslider.Scale)  # -> BrepSolid, ColorSolid, BrepOuterEdges, ColorEdges, Text, Size, Plane, ColorT
mdsk_geometry_14 = MDSK(Geometry=viewdef.BrepOuterEdges, Color=viewdef.ColorEdges, Start=mindesk_toggle)
mdsk_geometry_15 = MDSK(Geometry=viewdef.BrepSolid, Color=viewdef.ColorSolid, Start=mindesk_toggle)
mdsk_text_14 = VRTEXT(Text=viewdef.Text, Size=viewdef.Size, Plane=viewdef.Plane, Color=viewdef.ColorT, Start=mindesk_toggle)

stress_direction_slider = Curve(<curve referenced from the Rhino model>)
# STRESS VR PREVIEW
stressslider = StressDirectionSlider(SliderVR=stress_direction_slider, Brep=join.Breps)  # -> StressDirection, Text, Size, Plane, Color, Geometry
mdsk_text_15 = VRTEXT(Text=stressslider.Text, Size=stressslider.Size, Plane=stressslider.Plane, Color=stressslider.Color, Start=mindesk_toggle)
mdsk_geometry_16 = MDSK(Geometry=stressslider.Geometry, Color=stressslider.Color, Start=mindesk_toggle)
viewstress = ViewStresses(Mesh=meshsbrep, Stress=femsolver.Stress, StressDirection=stressslider.StressDirection, Scaling=defslider.Scale)  # -> Solid, Color_solid, Legend, Color_legend, Text, Size, Plane, Color_T
mdsk_text_16 = VRTEXT(Text=viewstress.Text, Size=viewstress.Size, Plane=viewstress.Plane, Color=viewstress.Color_T, Start=mindesk_toggle)
mdsk_geometry_17 = MDSK(Geometry=viewstress.Legend, Color=viewstress.Color_legend, Start=mindesk_toggle)
mdsk_geometry_18 = MDSK(Geometry=viewstress.Solid, Color=viewstress.Color_solid, Start=mindesk_toggle)

headlines_curves = Curve([<curve referenced from the Rhino model> x3])
# VR HEADLINES
headlines = CreateHeadlines(Curves=headlines_curves, Mesh=meshsbrep)  # -> Text, Size, Plane, Colors
mdsk_text_17 = VRTEXT(Text=headlines.Text, Size=headlines.Size, Plane=headlines.Plane, Color=headlines.Colors, Start=mindesk_toggle)
