# Grasshopper definition Case1_Grasshopper.gh (Grasshopper 1.0.7)
# plug-ins: MindeskText, SolidsVR, MDSKGrasshopper

# CASE 1 HEXAHEDRON
# TURN ON VR-DISPLAY
preview_toggle = BooleanToggle(True)

surface_1 = Brep(<brep referenced from the Rhino model>)
surface_2 = Brep(<brep referenced from the Rhino model>)
area = Area(Geometry=surface_1)  # -> Area, Centroid
area_2 = Area(Geometry=surface_2)  # -> Area, Centroid
# GEOMETRY
ln = Line(StartPoint=area.Centroid, EndPoint=area_2.Centroid)
swp1 = Sweep1(Rail=ln, Sections=[surface_1, surface_2], Miter=1)
cap = CapHoles(Brep=swp1)
# PRE-PROCESSING
mdsk_geometry = MDSK(Geometry=cap, Color=RGB(255, 255, 255), Start=preview_toggle)

# ----
# CONTROL POINT
debrep = DeconstructBrep(Brep=cap)  # -> Faces, Edges, Vertices
item = ListItem(List=debrep.Vertices, Index=0, Wrap=True)  # -> Item, Item1, Item2, Item3, Item4, Item5, Item6, Item7
pt = Point([item.Item6, item.Item5, item.Item4, item.Item7, item.Item3, item.Item, item.Item1, item.Item2])

division_slider = Curve([<curve referenced from the Rhino model> x3])
# MESHING
divslider = DivisionSlider(SliderVR=division_slider, Brep=cap)  # -> MeshDivisionU, MeshDivisionV, MeshDivisionW, Text, Size, Plane, Colors, Geometry
mdsk_geometry_2 = MDSK(Geometry=divslider.Geometry, Color=divslider.Colors, Start=preview_toggle)
mdsk_text = VRTEXT(Text=divslider.Text, Size=divslider.Size, Plane=divslider.Plane, Color=divslider.Colors, Start=preview_toggle)
meshcbrep = MeshCBrep(
    Brep=cap,
    Point=pt,
    UCount=divslider.MeshDivisionU,
    VCount=divslider.MeshDivisionV,
    WCount=divslider.MeshDivisionW,
    VolumeToRemove=0)

surface_slider = Curve(<curve referenced from the Rhino model>)
load_slider = Curve(<curve referenced from the Rhino model>)
loadslider = LoadSlider(SliderVR=load_slider, Geometry=cap)  # -> Load, Text, Size, Plane, Colors, Geometry
surfslider = SurfaceSlider(SliderVR=surface_slider, Geometry=cap)  # -> SurfaceNumber, Text, Size, Plane, Colors, Geometry
# LOADS
mdsk_text_2 = VRTEXT(Text=surfslider.Text, Size=surfslider.Size, Plane=surfslider.Plane, Color=surfslider.Colors, Start=preview_toggle)
mdsk_text_3 = VRTEXT(Text=loadslider.Text, Size=loadslider.Size, Plane=loadslider.Plane, Color=loadslider.Colors, Start=preview_toggle)
mdsk_geometry_3 = MDSK(Geometry=loadslider.Geometry, Color=loadslider.Colors, Start=preview_toggle)
mdsk_geometry_4 = MDSK(Geometry=surfslider.Geometry, Color=surfslider.Colors, Start=preview_toggle)
uniloads = UniformLoadComponentForFEA(SurfaceNumber=surfslider.SurfaceNumber, LoadVector=loadslider.Load, Mesh=meshcbrep)  # -> PointLoads, LoadArrows, ArrowColoring
mdsk_geometry_5 = MDSK(Geometry=uniloads.LoadArrows, Color=uniloads.ArrowColoring, Start=preview_toggle)

surface_slider_2 = Curve(<curve referenced from the Rhino model>)
surfslider_2 = SurfaceSlider(SliderVR=surface_slider_2, Geometry=cap)  # -> SurfaceNumber, Text, Size, Plane, Colors, Geometry
# BC
mdsk_text_4 = VRTEXT(
    Text=surfslider_2.Text,
    Size=surfslider_2.Size,
    Plane=surfslider_2.Plane,
    Color=surfslider_2.Colors,
    Start=preview_toggle)
mdsk_geometry_6 = MDSK(Geometry=surfslider_2.Geometry, Color=surfslider_2.Colors, Start=preview_toggle)
unibc = SetUniBC(SurfaceNumber=surfslider_2.SurfaceNumber, Mesh=meshcbrep)  # -> BoundaryConditions, Geometry, Color
mdsk_geometry_7 = MDSK(Geometry=unibc.Geometry, Color=unibc.Color, Start=preview_toggle)

# ----
# MATERIAL
panel = Panel("210000")
material = CreateMaterial(EModulus=panel, PRatio="0.3", YieldStress="255")

# ----
# VR HEADLINES
headline_curves = Curve([<curve referenced from the Rhino model> x3])
headline = HeadLine(Curves=headline_curves, Mesh=meshcbrep)  # -> Text, Size, Plane, Colors
mdsk_text_5 = VRTEXT(Text=headline.Text, Size=headline.Size, Plane=headline.Plane, Color=headline.Colors, Start=preview_toggle)

predef_slider = Curve(<curve referenced from the Rhino model>)
# PREDEF
predef_sphere = Brep(<brep referenced from the Rhino model>)

predispslider = PreDispSlider(SliderVR=predef_slider, Geoemtry=cap)  # -> PrescribedDisplacement, Text, Size, Plane, Colors, Geometry
preddisp = PreDisp(Sphere=predef_sphere, PrescribedDisplacement=predispslider.PrescribedDisplacement, Mesh=meshcbrep)  # -> PrescribedDisplacement, Text, Size, Plane, Colors

mdsk_geometry_8 = MDSK(Geometry=predispslider.Geometry, Color=predispslider.Colors, Start=preview_toggle)
mdsk_text_6 = VRTEXT(
    Text=predispslider.Text,
    Size=predispslider.Size,
    Plane=predispslider.Plane,
    Color=predispslider.Colors,
    Start=preview_toggle)
mdsk_text_7 = VRTEXT(Text=preddisp.Text, Size=preddisp.Size, Plane=preddisp.Plane, Color=preddisp.Colors, Start=preview_toggle)

# ----
# ANALYZING
# ANALYZE
femsolver = FEMSolver(
    Mesh=meshcbrep,
    BoundaryConditions=unibc.BoundaryConditions,
    PointLoads=uniloads.PointLoads,
    PreDeformations=preddisp.PrescribedDisplacement,
    Material=material)  # -> Displacement, Strain, Stress, Text, Size, Plane, ColorT
mdsk_text_8 = VRTEXT(Text=femsolver.Text, Size=femsolver.Size, Plane=femsolver.Plane, Color=femsolver.ColorT, Start=preview_toggle)

scale_slider = Curve(<curve referenced from the Rhino model>)
# POST-PROCESSING
# DEFORMATION VR PREVIEW
defslider = DeformationSlider(SliderVR=scale_slider, Geometry=cap)  # -> Scale, Text, Size, Plane, Colors, Geometry
# STRESS VR PREVIEW
mdsk_geometry_9 = MDSK(Geometry=defslider.Geometry, Color=defslider.Colors, Start=preview_toggle)
mdsk_text_9 = VRTEXT(Text=defslider.Text, Size=defslider.Size, Plane=defslider.Plane, Color=defslider.Colors, Start=preview_toggle)
viewdef = ViewDeformations(Mesh=meshcbrep, Displacement=femsolver.Displacement, Scaling=defslider.Scale)  # -> BrepSolid, ColorSolid, BrepOuterEdges, ColorEdges, Text, Size, Plane, ColorT
mdsk_geometry_10 = MDSK(Geometry=viewdef.BrepSolid, Color=viewdef.ColorSolid, Start=preview_toggle)
mdsk_geometry_11 = MDSK(Geometry=viewdef.BrepOuterEdges, Color=viewdef.ColorEdges, Start=preview_toggle)
mdsk_text_10 = VRTEXT(Text=viewdef.Text, Size=viewdef.Size, Plane=viewdef.Plane, Color=viewdef.ColorT, Start=preview_toggle)

stress_direction_slider = Curve(<curve referenced from the Rhino model>)
stressslider = StressDirectionSlider(SliderVR=stress_direction_slider, Geometry=cap)  # -> StressDirection, Text, Size, Plane, Color, Geometry
mdsk_text_11 = VRTEXT(Text=stressslider.Text, Size=stressslider.Size, Plane=stressslider.Plane, Color=stressslider.Color, Start=preview_toggle)
mdsk_geometry_12 = MDSK(Geometry=stressslider.Geometry, Color=stressslider.Color, Start=preview_toggle)
viewstress = ViewStresses(Mesh=meshcbrep, Stress=femsolver.Stress, StressDirection=stressslider.StressDirection, Scaling=defslider.Scale)  # -> Solid, Color_solid, Legend, Color_legend, Text, Size, Plane, Color_T
mdsk_geometry_13 = MDSK(Geometry=viewstress.Solid, Color=viewstress.Color_solid, Start=preview_toggle)
mdsk_geometry_14 = MDSK(Geometry=viewstress.Legend, Color=viewstress.Color_legend, Start=preview_toggle)
mdsk_text_12 = VRTEXT(Text=viewstress.Text, Size=viewstress.Size, Plane=viewstress.Plane, Color=viewstress.Color_T, Start=preview_toggle)

# ----
# NODE VR INFO
node_info_sphere = Brep(<brep referenced from the Rhino model>)

nodeinfo = NodeInfo(Sphere=node_info_sphere, Mesh=meshcbrep)  # -> Text, Size, Plane, Colors, TextSphere, Size_2, PlaneSphere

mdsk_text_13 = VRTEXT(Text=nodeinfo.TextSphere, Size=nodeinfo.Size_2, Plane=nodeinfo.PlaneSphere, Color=nodeinfo.Colors, Start=preview_toggle)
mdsk_text_14 = VRTEXT(Text=nodeinfo.Text, Size=nodeinfo.Size, Plane=nodeinfo.Plane, Color=nodeinfo.Colors, Start=preview_toggle)
