# Grasshopper definition Case2_Grasshopper.gh (Grasshopper 1.0.7)
# plug-ins: MindeskText, SolidsVR, MDSKGrasshopper

section_2 = Curve(<curve referenced from the Rhino model>)
# CROSS SECTION 2
explode = Explode(Curve=section_2, Recursive=True)  # -> Segments, Vertices
item = ListItem(List=explode.Vertices, Index=0, Wrap=True)  # -> Item, Item1, Item2, Item3
pt = Point([item.Item1, item.Item, item.Item3, item.Item2])
pline = PolyLine(Vertices=pt, Closed=Toggle(True))  # -> flatten(Polyline)

# ----
# CROSS SECTION 1
section_1 = Curve(<curve referenced from the Rhino model>)
# RAIL
rail = Curve(<curve referenced from the Rhino model>)
# CASE 2 CURVED GEOMETRY
# TURN ON VR-DISPLAY
toggle = BooleanToggle(True)

swp1 = Sweep1(Rail=rail, Sections=[section_1, pline], Miter=1)
# GEOMETRY
cap = CapHoles(Brep=swp1)
debrep = DeconstructBrep(Brep=cap)  # -> Faces, Edges, Vertices
mdsk_geometry = MDSK(Geometry=cap, Color=RGB(255, 255, 255), Start=toggle)

# ----
# CONTROL POINTS
item_2 = ListItem(List=debrep.Vertices, Index=0, Wrap=True)  # -> Item, Item1, Item2, Item3, Item4, Item5, Item6, Item7
pt_2 = Point([item_2.Item6, item_2.Item7, item_2.Item4, item_2.Item5, item_2.Item3, item_2.Item2, item_2.Item1, item_2.Item])

crv = Curve([<curve referenced from the Rhino model> x3])
# PRE-PROCESSING
# MESH
divslider = DivisionSlider(SliderVR=crv, Brep=cap)  # -> UCount, VCount, WCount, Text, Size, Plane, Colors, Geometry
mdsk_text = VRTEXT(Text=divslider.Text, Size=divslider.Size, Plane=divslider.Plane, Color=divslider.Colors, Start=toggle)
mdsk_geometry_2 = MDSK(Geometry=divslider.Geometry, Color=divslider.Colors, Start=toggle)
meshcbrep = MeshCBrep(Brep=cap, Point=pt_2, UCount=divslider.UCount, VCount=divslider.VCount, WCount=divslider.WCount, VolumeToRemove=0)

crv_2 = Curve(<curve referenced from the Rhino model>)
crv_3 = Curve(<curve referenced from the Rhino model>)
surfslider = SurfaceSlider(SliderVR=crv_2, Brep=cap)  # -> SurfaceNumber, Text, Size, Plane, Colors, Geometry
surfslider_2 = SurfaceSlider(SliderVR=crv_3, Brep=cap)  # -> SurfaceNumber, Text, Size, Plane, Colors, Geometry
mdsk_geometry_3 = MDSK(Geometry=surfslider.Geometry, Color=surfslider.Colors, Start=toggle)
# BC
mdsk_text_2 = VRTEXT(Text=surfslider.Text, Size=surfslider.Size, Plane=surfslider.Plane, Color=surfslider.Colors, Start=toggle)
mdsk_text_3 = VRTEXT(Text=surfslider_2.Text, Size=surfslider_2.Size, Plane=surfslider_2.Plane, Color=surfslider_2.Colors, Start=toggle)
mdsk_geometry_4 = MDSK(Geometry=surfslider_2.Geometry, Color=surfslider_2.Colors, Start=toggle)
unibc = UniformBCComponentForFEA(SurfaceNumber=surfslider.SurfaceNumber, Mesh=meshcbrep)  # -> BCPoints, BCCones, ColoringForBCCones
unibc_2 = UniformBCComponentForFEA(SurfaceNumber=surfslider_2.SurfaceNumber, Mesh=meshcbrep)  # -> BCPoints, BCCones, ColoringForBCCones
mdsk_geometry_5 = MDSK(Geometry=unibc.BCCones, Color=unibc.ColoringForBCCones, Start=toggle)
mdsk_geometry_6 = MDSK(Geometry=unibc_2.BCCones, Color=unibc_2.ColoringForBCCones, Start=toggle)

crv_4 = Curve(<curve referenced from the Rhino model>)
crv_5 = Curve(<curve referenced from the Rhino model>)
surfslider_3 = SurfaceSlider(SliderVR=crv_4, Brep=cap)  # -> SurfaceNumber, Text, Size, Plane, Colors, Geometry
loadslider = LoadSlider(SliderVR=crv_5, Brep=cap)  # -> Load, Text, Size, Plane, Colors, Geometry
# LOADS
mdsk_text_4 = VRTEXT(Text=surfslider_3.Text, Size=surfslider_3.Size, Plane=surfslider_3.Plane, Color=surfslider_3.Colors, Start=toggle)
mdsk_geometry_7 = MDSK(Geometry=surfslider_3.Geometry, Color=surfslider_3.Colors, Start=toggle)
mdsk_text_5 = VRTEXT(Text=loadslider.Text, Size=loadslider.Size, Plane=loadslider.Plane, Color=loadslider.Colors, Start=toggle)
mdsk_geometry_8 = MDSK(Geometry=loadslider.Geometry, Color=loadslider.Colors, Start=toggle)
uniloads = UniformLoadComponentForFEA(SurfaceNumber=surfslider_3.SurfaceNumber, LoadVector=loadslider.Load, Mesh=meshcbrep)  # -> PointLoads, LoadArrows, ArrowColoring
mdsk_geometry_9 = MDSK(Geometry=uniloads.LoadArrows, Color=uniloads.ArrowColoring, Start=toggle)

# ----
# MATERIAL
panel = Panel("210000")
material = CreateMaterial(EModulus=panel, PRatio="0.3", YieldStress="255")

node_info_sphere = Brep(<brep referenced from the Rhino model>)
# NODE VR INFO
node_info = GetInformationOfNode(Sphere=node_info_sphere, Mesh=meshcbrep)  # -> Text, Size, Plane, Colors, TextSphere, Size_2, PlaneSphere
mdsk_text_6 = VRTEXT(Text=node_info.TextSphere, Size=node_info.Size_2, Plane=node_info.PlaneSphere, Color=node_info.Colors, Start=toggle)
mdsk_text_7 = VRTEXT(Text=node_info.Text, Size=node_info.Size, Plane=node_info.Plane, Color=node_info.Colors, Start=toggle)

# ----
# VR HEADLINES
headlines_curves = Curve([<curve referenced from the Rhino model> x3])
headlines = CreateHeadlines(Curves=headlines_curves, Mesh=meshcbrep)  # -> Text, Size, Plane, Colors
mdsk_text_8 = VRTEXT(Text=headlines.Text, Size=headlines.Size, Plane=headlines.Plane, Color=headlines.Colors, Start=toggle)

crv_6 = Curve(<curve referenced from the Rhino model>)
# PREDEF
brep = Brep(<brep referenced from the Rhino model>)

predispslider = PreDispSlider(SliderVR=crv_6, Geoemtry=cap)  # -> PrescribedDisplacement, Text, Size, Plane, Colors, Geometry
preddisp = PreDisp(Sphere=brep, PrescribedDisplacement=predispslider.PrescribedDisplacement, Mesh=meshcbrep)  # -> PrescribedDisplacement, Text, Size, Plane, Colors

mdsk_geometry_10 = MDSK(Geometry=predispslider.Geometry, Color=predispslider.Colors, Start=toggle)
mdsk_text_9 = VRTEXT(Text=predispslider.Text, Size=predispslider.Size, Plane=predispslider.Plane, Color=predispslider.Colors, Start=toggle)
mdsk_text_10 = VRTEXT(Text=preddisp.Text, Size=preddisp.Size, Plane=preddisp.Plane, Color=preddisp.Colors, Start=toggle)

# ----
# ANALYZING
# ANALYZE
femsolver = FEMSolver(
    Mesh=meshcbrep,
    BoundaryConditions=[unibc.BCPoints, unibc_2.BCPoints],
    PointLoads=uniloads.PointLoads,
    PreDeformations=preddisp.PrescribedDisplacement,
    Material=material)  # -> Displacement, Strain, Stress, Text, Size, Plane, ColorT
mdsk_text_11 = VRTEXT(Text=femsolver.Text, Size=femsolver.Size, Plane=femsolver.Plane, Color=femsolver.ColorT, Start=toggle)

crv_7 = Curve(<curve referenced from the Rhino model>)
# POST-PROCESSING
# DEFORMATION VR PREVIEW
defslider = DeformationSlider(SliderVR=crv_7, Brep=cap)  # -> Scale, Text, Size, Plane, Colors, Geometry
mdsk_text_12 = VRTEXT(Text=defslider.Text, Size=defslider.Size, Plane=defslider.Plane, Color=defslider.Colors, Start=toggle)
mdsk_geometry_11 = MDSK(Geometry=defslider.Geometry, Color=defslider.Colors, Start=toggle)
viewdef = ViewDeformations(Mesh=meshcbrep, Displacement=femsolver.Displacement, Scaling=defslider.Scale)  # -> BrepSolid, ColorSolid, BrepOuterEdges, ColorEdges, Text, Size, Plane, ColorT
mdsk_geometry_12 = MDSK(Geometry=viewdef.BrepSolid, Color=viewdef.ColorSolid, Start=toggle)
mdsk_geometry_13 = MDSK(Geometry=viewdef.BrepOuterEdges, Color=viewdef.ColorEdges, Start=toggle)
mdsk_text_13 = VRTEXT(Text=viewdef.Text, Size=viewdef.Size, Plane=viewdef.Plane, Color=viewdef.ColorT, Start=toggle)

crv_8 = Curve(<curve referenced from the Rhino model>)
# STRESS VR PREVIEW
stressslider = StressDirectionSlider(SliderVR=crv_8, Brep=cap)  # -> StressDirection, Text, Size, Plane, Color, Geometry
mdsk_text_14 = VRTEXT(Text=stressslider.Text, Size=stressslider.Size, Plane=stressslider.Plane, Color=stressslider.Color, Start=toggle)
mdsk_geometry_14 = MDSK(Geometry=stressslider.Geometry, Color=stressslider.Color, Start=toggle)
viewstress = ViewStresses(Mesh=meshcbrep, Stress=femsolver.Stress, StressDirection=stressslider.StressDirection, Scaling=defslider.Scale)  # -> Solid, Color_solid, Legend, Color_legend, Text, Size, Plane, Color_T
mdsk_geometry_15 = MDSK(Geometry=viewstress.Solid, Color=viewstress.Color_solid, Start=toggle)
mdsk_geometry_16 = MDSK(Geometry=viewstress.Legend, Color=viewstress.Color_legend, Start=toggle)
mdsk_text_15 = VRTEXT(Text=viewstress.Text, Size=viewstress.Size, Plane=viewstress.Plane, Color=viewstress.Color_T, Start=toggle)
