# Grasshopper definition Case4_Grasshopper.gh (Grasshopper 1.0.7)
# plug-ins: MindeskText, SolidsVR, MDSKGrasshopper

crv = Curve(<curve referenced from the Rhino model>)
crv_2 = Curve(<curve referenced from the Rhino model>)
crv_3 = Curve(<curve referenced from the Rhino model>)
# Cross Section 1
crv_4 = Curve(<curve referenced from the Rhino model>)
edgesrf = EdgeSurface(CurveA=crv_4, CurveB=crv, CurveC=crv_2, CurveD=crv_3)

# ----
# Cross Section 2
crv_5 = Curve(<curve referenced from the Rhino model>)
crv_6 = Curve(<curve referenced from the Rhino model>)
crv_7 = Curve(<curve referenced from the Rhino model>)
crv_8 = Curve(<curve referenced from the Rhino model>)
edgesrf_2 = EdgeSurface(CurveA=crv_5, CurveB=crv_6, CurveC=crv_7, CurveD=crv_8)

# ----
# RAIL
crv_9 = Curve(<curve referenced from the Rhino model>)
# CASE 4 ITERATIVE REMOVAL OF ELMENTS
# PRE-PROCESSING
# TURN ON VR-DISPLAY
preview_toggle = BooleanToggle(True)

# ----
# GEOMETRY
swp1 = Sweep1(Rail=crv_9, Sections=[edgesrf, edgesrf_2], Miter=1)
join = BrepJoin(Breps=flatten([swp1, edgesrf, edgesrf_2]))  # -> Breps, Closed
debrep = DeconstructBrep(Brep=join.Breps)  # -> Faces, Edges, Vertices
mdsk_geometry = MDSK(Geometry=join.Breps, Color=RGB(255, 255, 255), Start=preview_toggle)

# ----
# CONTROL POINTS
item = ListItem(List=debrep.Vertices, Index=0, Wrap=True)  # -> Item, Item1, Item2, Item3, Item4, Item5, Item6, Item7
pt = Point([item.Item2, item.Item3, item.Item, item.Item1, item.Item6, item.Item7, item.Item4, item.Item5])

crv_10 = Curve([<curve referenced from the Rhino model> x3])
crv_11 = Curve(<curve referenced from the Rhino model>)
# MESHING
divslider = DivisionSlider(SliderVR=crv_10, Geometry=join.Breps)  # -> UCount, VCount, WCount, Text, Size, Plane, Colors, Geometry
volumeslider = VolumePercentageSlider(SliderVR=crv_11, Brep=join.Breps)  # -> VolumePercentage, Text, Size, Plane, Color, Geometry
mdsk_geometry_2 = MDSK(Geometry=divslider.Geometry, Color=divslider.Colors, Start=preview_toggle)
mdsk_geometry_3 = MDSK(Geometry=volumeslider.Geometry, Color=volumeslider.Color, Start=preview_toggle)
mdsk_text = VRTEXT(Text=divslider.Text, Size=divslider.Size, Plane=divslider.Plane, Color=divslider.Colors, Start=preview_toggle)
meshs = MeshSurface(
    Geometry=join.Breps,
    Point=pt,
    UCount=divslider.UCount,
    VCount=divslider.VCount,
    WCount=divslider.WCount,
    VolumeToRemove=volumeslider.VolumePercentage)

mdsk_text_2 = VRTEXT(Text=volumeslider.Text, Size=volumeslider.Size, Plane=volumeslider.Plane, Color=volumeslider.Color, Start=preview_toggle)

surface_slider = Curve(<curve referenced from the Rhino model>)
load_slider = Curve(<curve referenced from the Rhino model>)
surfslider = SurfaceSlider(SliderVR=surface_slider, Geometry=join.Breps)  # -> SurfaceNumber, Text, Size, Plane, Colors, Geometry
loadslider = LoadSlider(SliderVR=load_slider, Geometry=join.Breps)  # -> Load, Text, Size, Plane, Colors, Geometry
# LOADS
mdsk_text_3 = VRTEXT(Text=surfslider.Text, Size=surfslider.Size, Plane=surfslider.Plane, Color=surfslider.Colors, Start=preview_toggle)
mdsk_geometry_4 = MDSK(Geometry=surfslider.Geometry, Color=surfslider.Colors, Start=preview_toggle)
mdsk_text_4 = VRTEXT(Text=loadslider.Text, Size=loadslider.Size, Plane=loadslider.Plane, Color=loadslider.Colors, Start=preview_toggle)
mdsk_geometry_5 = MDSK(Geometry=loadslider.Geometry, Color=loadslider.Colors, Start=preview_toggle)
uniloads = UniformLoadComponentForFEA(SurfaceNumber=surfslider.SurfaceNumber, LoadVector=loadslider.Load, Mesh=meshs)  # -> PointLoads, LoadArrows, ArrowColoring
mdsk_geometry_6 = MDSK(Geometry=uniloads.LoadArrows, Color=uniloads.ArrowColoring, Start=preview_toggle)

surface_slider_2 = Curve(<curve referenced from the Rhino model>)
surface_slider_3 = Curve(<curve referenced from the Rhino model>)
surfslider_2 = SurfaceSlider(SliderVR=surface_slider_3, Geometry=join.Breps)  # -> SurfaceNumber, Text, Size, Plane, Colors, Geometry
surfslider_3 = SurfaceSlider(SliderVR=surface_slider_2, Geometry=join.Breps)  # -> SurfaceNumber, Text, Size, Plane, Colors, Geometry
# BC
mdsk_text_5 = VRTEXT(
    Text=surfslider_2.Text,
    Size=surfslider_2.Size,
    Plane=surfslider_2.Plane,
    Color=surfslider_2.Colors,
    Start=preview_toggle)
mdsk_geometry_7 = MDSK(Geometry=surfslider_2.Geometry, Color=surfslider_2.Colors, Start=preview_toggle)
mdsk_text_6 = VRTEXT(
    Text=surfslider_3.Text,
    Size=surfslider_3.Size,
    Plane=surfslider_3.Plane,
    Color=surfslider_3.Colors,
    Start=preview_toggle)
mdsk_geometry_8 = MDSK(Geometry=surfslider_3.Geometry, Color=surfslider_3.Colors, Start=preview_toggle)
unibc = SetUniBC(SurfaceNumber=surfslider_2.SurfaceNumber, Mesh=meshs)  # -> BoundaryConditions, Geometry, Color
unibc_2 = SetUniBC(SurfaceNumber=surfslider_3.SurfaceNumber, Mesh=meshs)  # -> BoundaryConditions, Geometry, Color
mdsk_geometry_9 = MDSK(Geometry=unibc.Geometry, Color=unibc.Color, Start=preview_toggle)
mdsk_geometry_10 = MDSK(Geometry=unibc_2.Geometry, Color=unibc_2.Color, Start=preview_toggle)

# ----
# MATERIAL
panel = Panel("210000")
material = CreateMaterial(EModulus=panel, PRatio="0.3", YieldStress="355")

headline_curves = Curve([<curve referenced from the Rhino model> x3])
# VR HEADLINES
headline = HeadLine(Curves=headline_curves, Mesh=meshs)  # -> Text, Size, Plane, Colors
mdsk_text_7 = VRTEXT(Text=headline.Text, Size=headline.Size, Plane=headline.Plane, Color=headline.Colors, Start=preview_toggle)

predef_slider = Curve(<curve referenced from the Rhino model>)
# PREDEF
predef_sphere = Brep(<brep referenced from the Rhino model>)

predispslider = PreDispSlider(SliderVR=predef_slider, Geoemtry=join.Breps)  # -> PrescribedDisplacement, Text, Size, Plane, Colors, Geometry
preddisp = PreDisp(Sphere=predef_sphere, PrescribedDisplacement=predispslider.PrescribedDisplacement, Mesh=meshs)  # -> PrescribedDisplacement, Text, Size, Plane, Colors

mdsk_geometry_11 = MDSK(Geometry=predispslider.Geometry, Color=predispslider.Colors, Start=preview_toggle)
mdsk_text_8 = VRTEXT(
    Text=predispslider.Text,
    Size=predispslider.Size,
    Plane=predispslider.Plane,
    Color=predispslider.Colors,
    Start=preview_toggle)
mdsk_text_9 = VRTEXT(Text=preddisp.Text, Size=preddisp.Size, Plane=preddisp.Plane, Color=preddisp.Colors, Start=preview_toggle)

# ----
# ANALYZING
# ANALYZE
femsolver = FEMSolver(
    Mesh=meshs,
    BoundaryConditions=[unibc.BoundaryConditions, unibc_2.BoundaryConditions],
    PointLoads=uniloads.PointLoads,
    PreDeformations=preddisp.PrescribedDisplacement,
    Material=material)  # -> Displacement, Strain, Stress, Text, Size, Plane, ColorT
mdsk_text_10 = VRTEXT(Text=femsolver.Text, Size=femsolver.Size, Plane=femsolver.Plane, Color=femsolver.ColorT, Start=preview_toggle)

scale_slider = Curve(<curve referenced from the Rhino model>)
# POST-PROCESSING
# DEFORMATION VR PREVIEW
defslider = DeformationSlider(SliderVR=scale_slider, Geometry=join.Breps)  # -> Scale, Text, Size, Plane, Colors, Geometry
# STRESS VR PREVIEW
mdsk_geometry_12 = MDSK(Geometry=defslider.Geometry, Color=defslider.Colors, Start=preview_toggle)
mdsk_text_11 = VRTEXT(Text=defslider.Text, Size=defslider.Size, Plane=defslider.Plane, Color=defslider.Colors, Start=preview_toggle)
viewdef = ViewDeformations(Mesh=meshs, Displacement=femsolver.Displacement, Scaling=defslider.Scale)  # -> BrepSolid, ColorSolid, BrepOuterEdges, ColorEdges, Text, Size, Plane, ColorT
mdsk_geometry_13 = MDSK(Geometry=viewdef.BrepSolid, Color=viewdef.ColorSolid, Start=preview_toggle)
mdsk_geometry_14 = MDSK(Geometry=viewdef.BrepOuterEdges, Color=viewdef.ColorEdges, Start=preview_toggle)
mdsk_text_12 = VRTEXT(Text=viewdef.Text, Size=viewdef.Size, Plane=viewdef.Plane, Color=viewdef.ColorT, Start=preview_toggle)

stress_direction_slider = Curve(<curve referenced from the Rhino model>)
stressslider = StressDirectionSlider(SliderVR=stress_direction_slider, Geometry=join.Breps)  # -> StressDirection, Text, Size, Plane, Color, Geometry
mdsk_text_13 = VRTEXT(Text=stressslider.Text, Size=stressslider.Size, Plane=stressslider.Plane, Color=stressslider.Color, Start=preview_toggle)
mdsk_geometry_15 = MDSK(Geometry=stressslider.Geometry, Color=stressslider.Color, Start=preview_toggle)
viewstress = ViewStresses(Mesh=meshs, Stress=femsolver.Stress, StressDirection=stressslider.StressDirection, Scaling=defslider.Scale)  # -> Solid, Color_solid, Legend, Color_legend, Text, Size, Plane, Color_T
mdsk_geometry_16 = MDSK(Geometry=viewstress.Solid, Color=viewstress.Color_solid, Start=preview_toggle)
mdsk_geometry_17 = MDSK(Geometry=viewstress.Legend, Color=viewstress.Color_legend, Start=preview_toggle)
mdsk_text_14 = VRTEXT(Text=viewstress.Text, Size=viewstress.Size, Plane=viewstress.Plane, Color=viewstress.Color_T, Start=preview_toggle)

node_info_sphere = Brep(<brep referenced from the Rhino model>)

# ----
# NODE VR INFO
nodeinfo = NodeInfo(Sphere=node_info_sphere, Mesh=meshs)  # -> Text, Size, Plane, Colors, TextSphere, Size_2, PlaneSphere

mdsk_text_15 = VRTEXT(Text=nodeinfo.TextSphere, Size=nodeinfo.Size_2, Plane=nodeinfo.PlaneSphere, Color=nodeinfo.Colors, Start=preview_toggle)
mdsk_text_16 = VRTEXT(Text=nodeinfo.Text, Size=nodeinfo.Size, Plane=nodeinfo.Plane, Color=nodeinfo.Colors, Start=preview_toggle)
