# Grasshopper definition AnalyseBrep_1.gh (Grasshopper 1.0.7)
# plug-ins: MindeskText, SolidsVR, MDSKGrasshopper

number_slider = Slider(1000, range=0..1000)
pt = Point([<point referenced from the Rhino model> x8])
# PREDEF
sphere = Brep()
load_value = Curve(<curve referenced from the Rhino model>)
load_surf = Curve(<curve referenced from the Rhino model>)
# LOAD AND BC
bc_surf = Curve(<curve referenced from the Rhino model>)
brep = Brep(<brep referenced from the Rhino model>)
# MESHING
_3_mesh_curves = Curve([<curve referenced from the Rhino model> x3])
pt_2 = ConstructPoint(XCoordinate=0, YCoordinate=number_slider, ZCoordinate=number_slider)
# BREP
p2b = PointsToBrep(Points=pt)
pt_3 = ConstructPoint(XCoordinate=number_slider, YCoordinate=number_slider, ZCoordinate=number_slider)
pt_4 = ConstructPoint(XCoordinate=number_slider, YCoordinate=0, ZCoordinate=number_slider)
pt_5 = ConstructPoint(XCoordinate=number_slider, YCoordinate=number_slider, ZCoordinate=0)
pt_6 = ConstructPoint(XCoordinate=0, YCoordinate=number_slider, ZCoordinate=0)
pt_7 = ConstructPoint(XCoordinate=0, YCoordinate=0, ZCoordinate=number_slider)
pt_8 = ConstructPoint(XCoordinate=0, YCoordinate=0, ZCoordinate=0)
pt_9 = ConstructPoint(XCoordinate=number_slider, YCoordinate=number_slider, ZCoordinate=Slider(900, range=0..1000))
pt_10 = ConstructPoint(XCoordinate=number_slider, YCoordinate=0, ZCoordinate=0)
ln = Line(StartPoint=pt_3, EndPoint=pt_9)
panel = Panel("0,0,0")
number_slider_2 = Slider(2, range=0..9)
p2b_2 = PointsToBrep(Points=[pt_8, pt_10, pt_5, pt_6, pt_7, pt_4, pt_3, pt_2])
debrep = DeconstructBrep(Brep=p2b_2)  # -> Faces, Edges, Vertices
item = ListItem(List=debrep.Faces, Index=Slider(5, range=0..10), Wrap=True)
predefslider = PreDefSlider(SliderVR=ln, Brep=p2b_2)  # -> Load, Text, Size, Plane, Colors, Geometry
item_2 = ListItem(List=debrep.Faces, Index=Slider(4, range=0..10), Wrap=True)
Z = UnitZ(Factor="-10")
surfslider = SurfaceSlider(SliderVR=load_surf, Brep=p2b)  # -> Surface, Text, Size, Plane, Colors, Geometry
surfslider_2 = SurfaceSlider(SliderVR=bc_surf, Brep=p2b)  # -> Surface, Text, Size, Plane, Colors, Geometry
divslider = DivisionSlider(SliderVR=_3_mesh_curves, Brep=p2b)  # -> MeshDivisionU, MeshDivisionV, MeshDivisionW, Text, Size, Plane, Colors, Geometry
predef = PreDef(Points=pt_7, PrescribedDeformations=predefslider.Load)
mdsk_text = VRTEXT(Text=surfslider.Text, Size=surfslider.Size, Plane=surfslider.Plane, Color=surfslider.Colors, Start=False)
meshtbrep = MeshTBrep(Brep=p2b_2, UCount=number_slider_2, VCount=number_slider_2, WCount=number_slider_2)
unibc = UniformBCComponentForFEA(Surface=item_2, UCount=number_slider_2, VCount=number_slider_2, WCount=number_slider_2, Brep=p2b_2)  # -> BCPoints, BCCones, ColoringForBCCones
material = CreateMaterial(EModulus="210000", PRatio="0.3")
uniloads = UniformLoadComponentForFEA(Surface=item, LoadVector=Z, UCount=number_slider_2, VCount=number_slider_2, WCount=number_slider_2, Brep=p2b_2)  # -> PointLoads, LoadArrows, ArrowColoring
loadslider = LoadSlider(SliderVR=load_value, Brep=p2b)  # -> Load, Text, Size, Plane, Colors, Geometry
femeshtbrep = FiniteElementOfMeshedTBrep(
    Mesh=meshtbrep,
    BoundaryConditions=unibc.BCPoints,
    PointLoads=uniloads.PointLoads,
    PreDeformations=predef,
    Brep=p2b_2,
    Material=material)  # -> Displacement, Strain, Stress, Nodes, Text, Size, Plane, ColorT
viewdef = ViewDeformations(Mesh=meshtbrep, Displacement=femeshtbrep.Displacement, Scaling=Slider(24, range=0..1000), Brep=p2b_2)  # -> BrepSolid, ColorSolid, BrepOuterEdges, ColorEdges, Text, Size, Plane, ColorT
# MODEL TOGGLE
model_toggle = BooleanToggle(False)
mdsk_text_2 = VRTEXT(Text=divslider.Text, Size=divslider.Size, Plane=divslider.Plane, Color=divslider.Colors, Start=model_toggle)
mdsk_text_3 = VRTEXT(Text=surfslider_2.Text, Size=surfslider_2.Size, Plane=surfslider_2.Plane, Color=surfslider_2.Colors, Start=model_toggle)
mdsk_geometry = MDSK(Geometry=divslider.Geometry, Color=divslider.Colors, Start=model_toggle)
mdsk_geometry_2 = MDSK(Geometry=surfslider_2.Geometry, Color=surfslider_2.Colors, Start=model_toggle)
mdsk_geometry_3 = MDSK(Geometry=surfslider.Geometry, Color=surfslider.Colors, Start=model_toggle)
mdsk_text_4 = VRTEXT(Text=loadslider.Text, Size=loadslider.Size, Plane=loadslider.Plane, Color=loadslider.Colors, Start=model_toggle)
unibc_2 = UniformBCComponentForFEA(
    Surface=surfslider_2.Surface,
    UCount=divslider.MeshDivisionU,
    VCount=divslider.MeshDivisionV,
    WCount=divslider.MeshDivisionW,
    Brep=p2b)  # -> BCPoints, BCCones, ColoringForBCCones
uniloads_2 = UniformLoadComponentForFEA(
    Surface=surfslider.Surface,
    LoadVector=loadslider.Load,
    UCount=divslider.MeshDivisionU,
    VCount=divslider.MeshDivisionV,
    WCount=divslider.MeshDivisionW,
    Brep=p2b)  # -> PointLoads, LoadArrows, ArrowColoring
mdsk_geometry_4 = MDSK(Geometry=loadslider.Geometry, Color=loadslider.Colors, Start=model_toggle)
panel_2 = Panel(femeshtbrep.Displacement)
mdsk_geometry_5 = MDSK(Geometry=uniloads_2.LoadArrows, Color=uniloads_2.ArrowColoring, Start=model_toggle)
mdsk_geometry_6 = MDSK(Geometry=unibc_2.BCCones, Color=unibc_2.ColoringForBCCones, Start=model_toggle)
vec = VectorXYZ(XComponent=0, YComponent=0, ZComponent=0)  # -> Vector, Length
meshtbrep_2 = MeshTBrep(TBrep=p2b, UCount=divslider.MeshDivisionU, VCount=divslider.MeshDivisionV, WCount=divslider.MeshDivisionW)
closest_point = FindTheClosestPointToSphere(Sphere=sphere, Connectivity=meshtbrep_2)  # -> Point, Text, Plane, Colors
predef_2 = PreDef(Points=closest_point.Point, PrescribedDeformations=vec.Vector)
# ANALYSE TOGGLE
preview_toggle = BooleanToggle(False)
# ANALYSE
femeshtbrep_2 = FiniteElementOfMeshedTBrep(
    Connectivity=meshtbrep_2,
    BoundaryConditions=unibc_2.BCPoints,
    PointLoads=uniloads_2.PointLoads,
    PreDeformations=predef_2)  # -> Displacement, Strain, Stress, Nodes, Text, Size, Plane, ColorT
mdsk_text_5 = VRTEXT(
    Text=femeshtbrep_2.Text,
    Size=femeshtbrep_2.Size,
    Plane=femeshtbrep_2.Plane,
    Color=femeshtbrep_2.ColorT,
    Start=preview_toggle)
scale_def_curve = Curve(<curve referenced from the Rhino model>)
stress_direction = Curve(<curve referenced from the Rhino model>)
defslider = DeformationSlider(SliderVR=scale_def_curve)  # -> Scale, Text, Size, Plane, Colors, Geometry
stressslider = StressDirectionSlider(SliderVR=stress_direction)  # -> StressDirection, Text, Size, Plane, Color, Geometry
# DEFORMATION PREVIEW
viewdef_2 = ViewDeformations(Connectivity=meshtbrep_2, Displacement=femeshtbrep_2.Displacement, Scaling=defslider.Scale)  # -> BrepSolid, ColorSolid, BrepOuterEdges, ColorEdges, Text, Size, Plane, ColorT
# STRESS PREVIEW
viewstress = ViewStresses(
    Connectivity=meshtbrep_2,
    Stresses=femeshtbrep_2.Stress,
    StressDirection=stressslider.StressDirection,
    Displacement=femeshtbrep_2.Displacement,
    Scaling=defslider.Scale)  # -> Solid, Color_solid, Legend, Color_legend, Text, Size, Plane, Color_T
mdsk_text_6 = VRTEXT(Text=viewdef_2.Text, Size=viewdef_2.Size, Plane=viewdef_2.Plane, Color=viewdef_2.ColorT, Start=preview_toggle)
mdsk_text_7 = VRTEXT(Text=viewstress.Text, Size=viewstress.Size, Plane=viewstress.Plane, Color=viewstress.Color_T, Start=preview_toggle)
mdsk_geometry_7 = MDSK(Geometry=viewdef_2.BrepSolid, Color=viewdef_2.ColorSolid, Start=preview_toggle)
mdsk_geometry_8 = MDSK(Geometry=viewdef_2.BrepOuterEdges, Color=viewdef_2.ColorEdges, Start=preview_toggle)
mdsk_geometry_9 = MDSK(Geometry=viewstress.Solid, Color=viewstress.Color_solid, Start=preview_toggle)
mdsk_geometry_10 = MDSK(Geometry=viewstress.Legend, Color=viewstress.Color_legend, Start=preview_toggle)
