# Grasshopper definition Case1_Cube_Grasshopper.gh (Grasshopper 1.0.7)
# plug-ins: MindeskText, SolidsVR, MDSKGrasshopper

pt = Point([<point referenced from the Rhino model> x8])
# PREDEF
sphere = Brep(<brep referenced from the Rhino model>)
predef_slider = Curve(<curve referenced from the Rhino model>)
load_value = Curve(<curve referenced from the Rhino model>)
load_surf = Curve(<curve referenced from the Rhino model>)
# LOAD AND BC
bc_surf = Curve(<curve referenced from the Rhino model>)
# BREP
p2b = PointsToBrep(Points=pt)
# MESHING
_3_mesh_curves = Curve([<curve referenced from the Rhino model> x3])
boolean_toggle = BooleanToggle(True)
loadslider = LoadSlider(SliderVR=load_value, Brep=p2b)  # -> Load, Text, Size, Plane, Colors, Geometry
surfslider = SurfaceSlider(SliderVR=load_surf, Brep=p2b)  # -> Surface, Text, Size, Plane, Colors, Geometry
surfslider_2 = SurfaceSlider(SliderVR=bc_surf, Brep=p2b)  # -> Surface, Text, Size, Plane, Colors, Geometry
divslider = DivisionSlider(SliderVR=_3_mesh_curves, Brep=p2b)  # -> MeshDivisionU, MeshDivisionV, MeshDivisionW, Text, Size, Plane, Colors, Geometry

number_slider = Slider(1000, range=0..1000)  # disabled
pt_2 = ConstructPoint(XCoordinate=number_slider, YCoordinate=number_slider, ZCoordinate=number_slider)  # disabled
pt_3 = ConstructPoint(XCoordinate=0, YCoordinate=number_slider, ZCoordinate=number_slider)  # disabled
pt_4 = ConstructPoint(XCoordinate=number_slider, YCoordinate=0, ZCoordinate=number_slider)  # disabled
# TESTING
pt_5 = ConstructPoint(XCoordinate=number_slider, YCoordinate=number_slider, ZCoordinate=0)  # disabled
pt_6 = ConstructPoint(XCoordinate=0, YCoordinate=number_slider, ZCoordinate=0)  # disabled
pt_7 = ConstructPoint(XCoordinate=0, YCoordinate=0, ZCoordinate=number_slider)  # disabled
ln = Line(StartPoint=pt_2, EndPoint=pt_3)  # disabled
panel = Panel("0,0,0")  # disabled
number_slider_2 = Slider(5, range=0..10)  # disabled
pt_8 = ConstructPoint(XCoordinate=0, YCoordinate=0, ZCoordinate=0)  # disabled
pt_9 = ConstructPoint(XCoordinate=number_slider, YCoordinate=0, ZCoordinate=0)  # disabled
number_slider_3 = Slider(1, range=0..9)  # disabled
panel_2 = Panel("-10")  # disabled
p2b_2 = PointsToBrep(Points=[pt_8, pt_9, pt_5, pt_6, pt_7, pt_4, pt_2, pt_3])  # disabled
debrep = DeconstructBrep(Brep=p2b_2)  # -> Faces, Edges, Vertices; disabled
number_slider_4 = Slider(4, range=0..10)  # disabled
item = ListItem(List=debrep.Faces, Index=number_slider_2, Wrap=True)  # disabled
predefslider = PreDefSlider(SliderVR=ln, Brep=p2b_2)  # -> Load, Text, Size, Plane, Colors, Geometry; disabled
item_2 = ListItem(List=debrep.Faces, Index=number_slider_4, Wrap=True)  # disabled
panel_3 = Panel("0.3")  # disabled
Z = UnitZ(Factor=panel_2)  # disabled
predef = PreDef(Points=pt_8, PrescribedDeformations=predefslider.Load)  # disabled
panel_4 = Panel("210000")  # disabled
meshtbrep = MeshTBrep(Brep=p2b_2, UCount=number_slider_3, VCount=number_slider_3, WCount=number_slider_3)  # disabled
unibc = UniformBCComponentForFEA(Surface=item_2, UCount=number_slider_3)  # -> BCPoints, BCCones, ColoringForBCCones; disabled
uniloads = UniformLoadComponentForFEA(Surface=item, LoadVector=Z, UCount=number_slider_3)  # -> PointLoads, LoadArrows, ArrowColoring; disabled
material = CreateMaterial(EModulus=panel_4, PRatio=panel_3)  # disabled
femeshtbrep = FiniteElementOfMeshedTBrep(
    Mesh=meshtbrep,
    BoundaryConditions=unibc.BCPoints,
    PointLoads=uniloads.PointLoads,
    PreDeformations=predef,
    Brep=p2b_2,
    Material=material)  # -> Disp, Strain, Stress, N, Text, Size, Plane, Color_T, Nodes; disabled
panel_5 = Panel(femeshtbrep.Disp)  # disabled

# ----
# MESH
meshcbrep = MeshCBrep(Brep=p2b, Point=pt, UCount=divslider.MeshDivisionU, VCount=divslider.MeshDivisionV, WCount=divslider.MeshDivisionW)
# MODEL TOGGLE
model_toggle = BooleanToggle(True)
mdsk = MDSK(Geometry=p2b, Color=RGB(255, 255, 255), Start=model_toggle)
vr_text = VRTEXT(Text=surfslider.Text, Size=surfslider.Size, Plane=surfslider.Plane, Color=surfslider.Colors, Start=model_toggle)
mdsk_2 = MDSK(Geometry=surfslider.Geometry, Color=surfslider.Colors, Start=model_toggle)
vr_text_2 = VRTEXT(Text=surfslider_2.Text, Size=surfslider_2.Size, Plane=surfslider_2.Plane, Color=surfslider_2.Colors, Start=model_toggle)
mdsk_3 = MDSK(Geometry=surfslider_2.Geometry, Color=surfslider_2.Colors, Start=model_toggle)
vr_text_3 = VRTEXT(Text=loadslider.Text, Size=loadslider.Size, Plane=loadslider.Plane, Color=loadslider.Colors, Start=model_toggle)
mdsk_4 = MDSK(Geometry=loadslider.Geometry, Color=loadslider.Colors, Start=model_toggle)
vr_text_4 = VRTEXT(Text=divslider.Text, Size=divslider.Size, Plane=divslider.Plane, Color=divslider.Colors, Start=model_toggle)
mdsk_5 = MDSK(Geometry=divslider.Geometry, Color=divslider.Colors, Start=model_toggle)
predefslider_2 = PreDefSlider(SliderVR=predef_slider, Brep=p2b)  # -> PrescribedDeformation, Text, Size, Plane, Colors, Geometry
# LOADS
uniloads_2 = UniformLoadComponentForFEA(SurfaceNumber=surfslider.Surface, LoadVector=loadslider.Load, Mesh=meshcbrep)  # -> PointLoads, LoadArrows, ArrowColoring
vr_text_5 = VRTEXT(
    Text=predefslider_2.Text,
    Size=predefslider_2.Size,
    Plane=predefslider_2.Plane,
    Color=predefslider_2.Colors,
    Start=model_toggle)
mdsk_6 = MDSK(Geometry=predefslider_2.Geometry, Color=predefslider_2.Colors, Start=model_toggle)
unibc_2 = UniformBCComponentForFEA(SurfaceNumber=surfslider_2.Surface, Mesh=meshcbrep)  # -> BCPoints, BCCones, ColoringForBCCones
mdsk_7 = MDSK(Geometry=uniloads_2.LoadArrows, Color=uniloads_2.ArrowColoring, Start=model_toggle)
pt_10 = ConstructPoint(XCoordinate="999", YCoordinate="999", ZCoordinate="999")
predef_2 = PreDef(Points=pt_10, PrescribedDeformations=predefslider_2.PrescribedDeformation)
# BC
mdsk_8 = MDSK(Geometry=unibc_2.BCCones, Color=unibc_2.ColoringForBCCones, Start=model_toggle)
# ANALYSE TOGGLE
preview_toggle = BooleanToggle(True)
material_2 = CreateMaterial(EModulus="210000", PRatio="0.3")
# ANALYSE
femeshtbrep_2 = FiniteElementOfMeshedTBrep(
    Mesh=meshcbrep,
    BoundaryConditions=unibc_2.BCPoints,
    PointLoads=uniloads_2.PointLoads,
    PreDeformations=predef_2,
    Brep=p2b,
    Material=material_2)  # -> Disp, Strain, Stress, N, Text, Size, Plane, Color_T, Nodes
vr_text_6 = VRTEXT(
    Text=femeshtbrep_2.Text,
    Size=femeshtbrep_2.Size,
    Plane=femeshtbrep_2.Plane,
    Color=femeshtbrep_2.Color_T,
    Start=preview_toggle)
scale_def_curve = Curve(<curve referenced from the Rhino model>)
stress_direction = Curve(<curve referenced from the Rhino model>)
defslider = DeformationSlider(SliderVR=scale_def_curve, Brep=p2b)  # -> Scale, Text, Size, Plane, Colors, Geometry
stressslider = StressDirectionSlider(SliderVR=stress_direction, Brep=p2b)  # -> StressDirection, Text, Size, Plane, Color, Geometry
# DEFORMATION PREVIEW
viewdef = ViewDeformations(Mesh=meshcbrep, Displacement=femeshtbrep_2.Disp, Scaling=defslider.Scale)  # -> BrepSolid, ColorSolid, BrepOuterEdges, ColorEdges, Text, Size, Plane, ColorT
vr_text_7 = VRTEXT(Text=defslider.Text, Size=defslider.Size, Plane=defslider.Plane, Color=defslider.Colors, Start=preview_toggle)
mdsk_geometry = MDSK(Geometry=defslider.Geometry, Color=defslider.Colors, Start=preview_toggle)
mdsk_9 = MDSK(Geometry=stressslider.Geometry, Color=stressslider.Color, Start=preview_toggle)
vr_text_8 = VRTEXT(Text=stressslider.Text, Size=stressslider.Size, Plane=stressslider.Plane, Color=stressslider.Color, Start=preview_toggle)
# STRESS PREVIEW
viewstress = ViewStresses(
    Mesh=meshcbrep,
    Stresses=femeshtbrep_2.Stress,
    StressDirection=stressslider.StressDirection,
    Displacement=femeshtbrep_2.Disp,
    Scaling=defslider.Scale)  # -> Solid, Color_solid, Legend, Color_legend, Text, Size, Plane, Color_T
brep = Brep()
mdsk_10 = MDSK(Geometry=viewdef.BrepOuterEdges, Color=viewdef.ColorEdges, Start=preview_toggle)
mdsk_11 = MDSK(Geometry=viewdef.BrepSolid, Color=viewdef.ColorSolid, Start=preview_toggle)
vr_text_9 = VRTEXT(Text=viewdef.Text, Size=viewdef.Size, Plane=viewdef.Plane, Color=viewdef.ColorT, Start=preview_toggle)
mdsk_12 = MDSK(Geometry=viewstress.Solid, Color=viewstress.Color_solid, Start=preview_toggle)
vr_text_10 = VRTEXT(Text=viewstress.Text, Size=viewstress.Size, Plane=viewstress.Plane, Color=viewstress.Color_T, Start=preview_toggle)
mdsk_13 = MDSK(Geometry=viewstress.Legend, Color=viewstress.Color_legend, Start=preview_toggle)
crv = Curve()
brep_2 = Brep()
brep_3 = Brep()
brep_4 = Brep()
