# Grasshopper definition Case1_Cube_Grasshopper_ferdig.gh (Grasshopper 1.0.7)
# plug-ins: MindeskText, SolidsVR, MDSKGrasshopper

# BREP
brep = Brep()
# PREDEF
sphere = Brep(<brep referenced from the Rhino model>)
predef_slider = Curve(<curve referenced from the Rhino model>)
brep_2 = Brep(<brep referenced from the Rhino model>)
brep_3 = Brep(<brep referenced from the Rhino model>)
load_value = Curve(<curve referenced from the Rhino model>)
# LOAD AND BC
bc_surf = Curve(<curve referenced from the Rhino model>)
load_surf = Curve(<curve referenced from the Rhino model>)
# MESHING
_3_mesh_curves = Curve([<curve referenced from the Rhino model> x3])
area = Area(Geometry=brep_2)  # -> Area, Centroid
area_2 = Area(Geometry=brep_3)  # -> Area, Centroid
line = Line(StartPoint=area.Centroid, EndPoint=area_2.Centroid)
sweep1 = Sweep1(Rail=line, Sections=brep_2, Miter=1)
cap_holes = CapHoles(Brep=sweep1)
loadslider = LoadSlider(SliderVR=load_value, Brep=cap_holes)  # -> Load, Text, Size, Plane, Colors, Geometry
surfslider = SurfaceSlider(SliderVR=load_surf, Brep=cap_holes)  # -> Surface, Text, Size, Plane, Colors, Geometry
surfslider_2 = SurfaceSlider(SliderVR=bc_surf, Brep=cap_holes)  # -> Surface, Text, Size, Plane, Colors, Geometry
divslider = DivisionSlider(SliderVR=_3_mesh_curves, Brep=cap_holes)  # -> MeshDivisionU, MeshDivisionV, MeshDivisionW, Text, Size, Plane, Colors, Geometry
deconstruct_brep = DeconstructBrep(Brep=cap_holes)  # -> Faces, Edges, Vertices
list_item = ListItem(List=deconstruct_brep.Vertices, Index=0, Wrap=True)  # -> Item, Item1, Item2, Item3, Item4, Item5, Item6, Item7
# MODEL TOGGLE
model_toggle = BooleanToggle(True)
vr_text = VRTEXT(Text=surfslider.Text, Size=surfslider.Size, Plane=surfslider.Plane, Color=surfslider.Colors, Start=model_toggle)
mdsk = MDSK(Geometry=surfslider.Geometry, Color=surfslider.Colors, Start=model_toggle)
mdsk_2 = MDSK(Geometry=surfslider_2.Geometry, Color=surfslider_2.Colors, Start=model_toggle)
vr_text_2 = VRTEXT(Text=loadslider.Text, Size=loadslider.Size, Plane=loadslider.Plane, Color=loadslider.Colors, Start=model_toggle)
mdsk_3 = MDSK(Geometry=loadslider.Geometry, Color=loadslider.Colors, Start=model_toggle)
vr_text_3 = VRTEXT(Text=divslider.Text, Size=divslider.Size, Plane=divslider.Plane, Color=divslider.Colors, Start=model_toggle)
mdsk_4 = MDSK(Geometry=divslider.Geometry, Color=divslider.Colors, Start=model_toggle)
vr_text_4 = VRTEXT(Text=surfslider_2.Text, Size=surfslider_2.Size, Plane=surfslider_2.Plane, Color=surfslider_2.Colors, Start=model_toggle)
predefslider = PreDefSlider(SliderVR=predef_slider, Brep=cap_holes)  # -> PrescribedDeformation, Text, Size, Plane, Colors, Geometry
mdsk_5 = MDSK(Geometry=cap_holes, Color=RGB(255, 255, 255), Start=model_toggle)
point = Point([list_item.Item2, list_item.Item7, list_item.Item6, list_item.Item3, list_item.Item1, list_item.Item4, list_item.Item5, list_item.Item])
# MESH
meshcbrep = MeshCBrep(
    Brep=cap_holes,
    Point=point,
    UCount=divslider.MeshDivisionU,
    VCount=divslider.MeshDivisionV,
    WCount=divslider.MeshDivisionW,
    VolumeToRemove="0")
deconstruct_mesh = DeconstructMesh(Mesh=meshcbrep)  # -> ElementVertices, Connectivity, Edges, Surfaces, Points, Nodes, Elements
# LOADS
uniform_load_component_for_fea = UniformLoadComponentForFEA(SurfaceNumber=surfslider.Surface, LoadVector=loadslider.Load, Mesh=meshcbrep)  # -> PointLoads, LoadArrows, ArrowColoring
deconstruct_mesh_2 = DeconstructMesh(Mesh=meshcbrep)  # -> ElementVertices, Connectivity, Edges, Surfaces, Points, Nodes, Elements
unibc = UniformBCComponentForFEA(SurfaceNumber=surfslider_2.Surface, Mesh=meshcbrep)  # -> BCPoints, BCCones, ColoringForBCCones
vr_text_5 = VRTEXT(Text=predefslider.Text, Size=predefslider.Size, Plane=predefslider.Plane, Color=predefslider.Colors, Start=model_toggle)
mdsk_6 = MDSK(Geometry=predefslider.Geometry, Color=predefslider.Colors, Start=model_toggle)
mdsk_7 = MDSK(
    Geometry=uniform_load_component_for_fea.LoadArrows,
    Color=uniform_load_component_for_fea.ArrowColoring,
    Start=model_toggle)
panel = Panel("3")
# BC
mdsk_8 = MDSK(Geometry=unibc.BCCones, Color=unibc.ColoringForBCCones, Start=model_toggle)
# ANALYSE TOGGLE
preview_toggle = BooleanToggle(True)
material = CreateMaterial(EModulus="210000", PRatio="0.3", YieldStress="255")
brep_4 = Brep(<brep referenced from the Rhino model>)
curve = Curve([<curve referenced from the Rhino model> x3])
predef = PreDef(Sphere=brep_4, PrescribedDeformations=predefslider.PrescribedDeformation, Mesh=meshcbrep)  # -> Prescribed_deformations, Text, Plane, Colors, Color
# ANALYSE
topopt = TopOpt(
    Mesh=meshcbrep,
    BoundaryConditions=unibc.BCPoints,
    PointLoads=uniform_load_component_for_fea.PointLoads,
    PreDeformations=predef.Prescribed_deformations,
    Material=material)  # -> Displacement, Strain, Stress, Text, Size, Plane, Colors
vr_text_6 = VRTEXT(Text=topopt.Text, Size=topopt.Size, Plane=topopt.Plane, Color=topopt.Colors, Start=preview_toggle)
brep_5 = Brep(<brep referenced from the Rhino model>)
get_information_of_node = GetInformationOfNode(Sphere=brep_5, Mesh=meshcbrep)  # -> Text, Size, Plane, Colors, TextSphere, Size_2, PlaneSphere
scale_def_curve = Curve(<curve referenced from the Rhino model>)
stress_direction = Curve(<curve referenced from the Rhino model>)
create_headlines = CreateHeadlines(Curves=curve, Mesh=meshcbrep)  # -> Text, Size, Plane, Colors
defslider = DeformationSlider(SliderVR=scale_def_curve, Brep=cap_holes)  # -> Scale, Text, Size, Plane, Colors, Geometry
vr_text_7 = VRTEXT(Text=predef.Text, Size=predef.Plane, Plane=predef.Colors, Color=predef.Color, Start=preview_toggle)
stressslider = StressDirectionSlider(SliderVR=stress_direction, Brep=cap_holes)  # -> StressDirection, Text, Size, Plane, Color, Geometry
vr_text_8 = VRTEXT(
    Text=get_information_of_node.Text,
    Size=get_information_of_node.Size,
    Plane=get_information_of_node.Plane,
    Color=get_information_of_node.Colors,
    Start=preview_toggle)
vr_text_9 = VRTEXT(
    Text=get_information_of_node.TextSphere,
    Size=get_information_of_node.Size_2,
    Plane=get_information_of_node.PlaneSphere,
    Color=get_information_of_node.Colors,
    Start=preview_toggle)
vr_text_10 = VRTEXT(
    Text=create_headlines.Text,
    Size=create_headlines.Size,
    Plane=create_headlines.Plane,
    Color=create_headlines.Colors,
    Start=preview_toggle)
mdsk_9 = MDSK(Geometry=defslider.Geometry, Color=defslider.Colors, Start=preview_toggle)
# DEFORMATION PREVIEW
viewdef = ViewDeformations(Mesh=meshcbrep, Displacement=topopt.Displacement, Scaling=defslider.Scale)  # -> BrepSolid, ColorSolid, BrepOuterEdges, ColorEdges, Text, Size, Plane, ColorT
vr_text_11 = VRTEXT(Text=defslider.Text, Size=defslider.Size, Plane=defslider.Plane, Color=defslider.Colors, Start=preview_toggle)
mdsk_10 = MDSK(Geometry=stressslider.Geometry, Color=stressslider.Color, Start=preview_toggle)
vr_text_12 = VRTEXT(Text=stressslider.Text, Size=stressslider.Size, Plane=stressslider.Plane, Color=stressslider.Color, Start=preview_toggle)
# STRESS PREVIEW
viewstresses = ViewStresses(Mesh=meshcbrep, Stress=topopt.Stress, StressDirection=stressslider.StressDirection, Scaling=defslider.Scale)  # -> BrepSolid, Colors, StressLegend, Colors_2, Text, Size, Plane, Colors_3
mdsk_11 = MDSK(Geometry=viewdef.BrepOuterEdges, Color=viewdef.ColorEdges, Start=preview_toggle)
mdsk_12 = MDSK(Geometry=viewdef.BrepSolid, Color=viewdef.ColorSolid, Start=preview_toggle)
vr_text_13 = VRTEXT(Text=viewdef.Text, Size=viewdef.Size, Plane=viewdef.Plane, Color=viewdef.ColorT, Start=preview_toggle)
vr_text_14 = VRTEXT(
    Text=viewstresses.Text,
    Size=viewstresses.Size,
    Plane=viewstresses.Plane,
    Color=viewstresses.Colors_3,
    Start=preview_toggle)
mdsk_13 = MDSK(Geometry=viewstresses.BrepSolid, Color=viewstresses.Colors, Start=preview_toggle)
mdsk_14 = MDSK(Geometry=viewstresses.StressLegend, Color=viewstresses.Colors_2, Start=preview_toggle)
