# Grasshopper definition Case2_CurvePointSection_Grasshopper.gh (Grasshopper 1.0.7)
# plug-ins: SolidsVR

point = Point([<point referenced from the Rhino model> x4])
rail = Curve(<curve referenced from the Rhino model>)
section_1 = Curve(<curve referenced from the Rhino model>)
polyline = PolyLine(Vertices=point, Closed=Toggle(True))
sweep1 = Sweep1(Rail=rail, Sections=[section_1, polyline], Miter=1)
cap_holes = CapHoles(Brep=sweep1)
deconstruct_brep = DeconstructBrep(Brep=cap_holes)  # -> Faces, Edges, Vertices
list_item = ListItem(List=deconstruct_brep.Vertices, Index=0, Wrap=True)  # -> Item, Item1, Item2, Item3, Item4, Item5, Item6, Item7
point_2 = Point([list_item.Item4, list_item.Item7, list_item.Item6, list_item.Item5, list_item.Item1, list_item.Item2, list_item.Item3, list_item.Item])
list_item_2 = ListItem(List=point_2, Index=Slider(7, range=0..7), Wrap=True)
point_3 = Point()
pt = Point()
number_slider = Slider(3, range=0..10)
debrep = DeconstructBrep()  # -> Faces, Edges, Vertices
item = ListItem(List=debrep.Faces, Index=Slider(2, range=0..5), Wrap=True)
material = CreateMaterial(EModulus="210000", PRatio="0.3")
Z = UnitZ(Factor=Slider(0, range=0..100))
meshcbrep = MeshCBrep(Brep=cap_holes, Point=point_2, UCount=number_slider, VCount=number_slider, WCount=Slider(9, range=0..10))
Z_2 = UnitZ(Factor="-5")
volume = Volume()  # -> Volume, Centroid
unibc = UniformBCComponentForFEA(SurfaceNumber=Slider(4, range=0..5), Mesh=meshcbrep)  # -> BCPoints, BCCones, ColoringForBCCones
unibc_2 = UniformBCComponentForFEA(SurfaceNumber=Slider(5, range=0..5), Mesh=meshcbrep)  # -> BCPoints, BCCones, ColoringForBCCones
uniloads = UniformLoadComponentForFEA(SurfaceNumber=Slider(3, range=0..5), LoadVector=Z_2, Mesh=meshcbrep)  # -> PointLoads, LoadArrows, ArrowColoring
predef = PreDef(Points="0,0,0", PrescribedDeformations=Z)
femeshtbrep = FiniteElementOfMeshedTBrep(
    Mesh=meshcbrep,
    BoundaryConditions=[unibc.BCPoints, unibc_2.BCPoints],
    PointLoads=uniloads.PointLoads,
    PreDeformations=predef,
    Brep=cap_holes,
    Material=material)  # -> Disp, Strain, Stress, N, Text, Size, Plane, Color_T, Nodes
number_slider_2 = Slider(194, range=0..1000)
deconstruct_meshcbrep = DeconstructMesh(Mesh=meshcbrep)  # -> ElementVertices, Connectivity, Edges, Surfaces, Nodes, Nodes_2, Elements
item_2 = ListItem(List=deconstruct_meshcbrep.Surfaces, Index=Slider(0, range=0..10), Wrap=True)
viewdef = ViewDeformations(Mesh=meshcbrep, Displacement=femeshtbrep.Disp, Scaling=number_slider_2)  # -> BrepSolid, ColorSolid, BrepOuterEdges, ColorEdges, Text, Size, Plane, ColorT
srf = Surface(item_2)
viewstress = ViewStresses(
    Mesh=meshcbrep,
    Stresses=femeshtbrep.Stress,
    StressDirection=Slider(6, range=0..6),
    Displacement=femeshtbrep.Disp,
    Scaling=number_slider_2)  # -> Solid, Color_solid, Legend, Color_legend, Text, Size, Plane, Color_T
