# Grasshopper definition test1.gh (Grasshopper 1.0.7)
# plug-ins: SolidsVR, MDSKGrasshopper

section_2 = Curve(<curve referenced from the Rhino model>)
explode = Explode(Curve=section_2, Recursive=True)  # -> Segments, Vertices
section_1 = Curve(<curve referenced from the Rhino model>)
rail = Curve(<curve referenced from the Rhino model>)
list_item = ListItem(List=explode.Vertices, Index=Slider(2, range=0..3), Wrap=True)
list_item_2 = ListItem(List=explode.Vertices, Index=0, Wrap=True)  # -> Item, Item1, Item2, Item3
point = Point([list_item_2.Item1, list_item_2.Item, list_item_2.Item3, list_item_2.Item2])
polyline = PolyLine(Vertices=point, Closed=Toggle(True))  # -> flatten(Polyline)
sweep1 = Sweep1(Rail=rail, Sections=[section_1, polyline], Miter=1)
cap_holes = CapHoles(Brep=sweep1)
deconstruct_brep = DeconstructBrep(Brep=cap_holes)  # -> Faces, Edges, Vertices
list_item_3 = ListItem(List=deconstruct_brep.Vertices, Index=0, Wrap=True)  # -> Item, Item1, Item2, Item3, Item4, Item5, Item6, Item7
point_2 = Point([list_item_3.Item4, list_item_3.Item7, list_item_3.Item6, list_item_3.Item5, list_item_3.Item1, list_item_3.Item2, list_item_3.Item3, list_item_3.Item])
list_item_4 = ListItem(List=point_2, Index=Slider(7, range=0..7), Wrap=True)
curve = Curve(<curve referenced from the Rhino model>)
curve_2 = Curve([<curve referenced from the Rhino model> x3])
curve_3 = Curve(<curve referenced from the Rhino model>)
curve_4 = Curve(<curve referenced from the Rhino model>)
curve_5 = Curve(<curve referenced from the Rhino model>)
surfaceslider = SurfaceSlider(SliderVR=curve_4, Brep=cap_holes)  # -> SurfaceNumber, Text, Size, Plane, Colors, Geometry
divisionslider = DivisionSlider(SliderVR=curve_2, Brep=cap_holes)  # -> UCount, VCount, WCount, Text, Size, Plane, Colors, Geometry
surfaceslider_2 = SurfaceSlider(SliderVR=curve_3, Brep=cap_holes)  # -> SurfaceNumber, Text, Size, Plane, Colors, Geometry
surfaceslider_3 = SurfaceSlider(SliderVR=curve, Brep=cap_holes)  # -> SurfaceNumber, Text, Size, Plane, Colors, Geometry
loadslider = LoadSlider(SliderVR=curve_5, Brep=cap_holes)  # -> Load, Text, Size, Plane, Colors, Geometry
boolean_toggle = BooleanToggle(True)
mdsk = MDSK(Geometry=cap_holes, Color=RGB(255, 255, 255), Start=boolean_toggle)
mdsk_2 = MDSK(Geometry=surfaceslider_2.Geometry, Color=surfaceslider_2.Colors, Start=boolean_toggle)
mdsk_3 = MDSK(Geometry=loadslider.Geometry, Color=loadslider.Colors, Start=boolean_toggle)
mdsk_4 = MDSK(Geometry=surfaceslider.Geometry, Color=surfaceslider.Colors, Start=boolean_toggle)
mdsk_5 = MDSK(Geometry=divisionslider.Geometry, Color=divisionslider.Colors, Start=boolean_toggle)
mdsk_6 = MDSK(Geometry=surfaceslider_3.Geometry, Color=surfaceslider_3.Colors, Start=boolean_toggle)
meshcbrep = MeshCBrep(
    Brep=cap_holes,
    Point=point_2,
    UCount=divisionslider.UCount,
    VCount=divisionslider.VCount,
    WCount=divisionslider.WCount,
    VolumeToRemove=0)
predefslider = PreDefSlider()  # -> PrescribedDeformation, Text, Size, Plane, Colors, Geometry
unibc = UniformBCComponentForFEA(SurfaceNumber=surfaceslider.SurfaceNumber, Mesh=meshcbrep)  # -> BCPoints, BCCones, ColoringForBCCones
unibc_2 = UniformBCComponentForFEA(SurfaceNumber=surfaceslider_2.SurfaceNumber, Mesh=meshcbrep)  # -> BCPoints, BCCones, ColoringForBCCones
Z = UnitZ(Factor=Slider(0, range=0..100))
uniloads = UniformLoadComponentForFEA(SurfaceNumber=surfaceslider_3.SurfaceNumber, LoadVector=loadslider.Load, Mesh=meshcbrep)  # -> PointLoads, LoadArrows, ArrowColoring
predef = PreDef(Points="0,0,0", PrescribedDeformations=Z)  # -> PrescribedDeformations, Text, Plane, Colors
material = CreateMaterial(EModulus="210000", PRatio="0.3")
mdsk_7 = MDSK(Geometry=unibc_2.BCCones, Color=unibc_2.ColoringForBCCones, Start=boolean_toggle)
mdsk_8 = MDSK(Geometry=unibc.BCCones, Color=unibc.ColoringForBCCones, Start=boolean_toggle)
mdsk_9 = MDSK(Geometry=uniloads.LoadArrows, Color=uniloads.ArrowColoring, Start=boolean_toggle)
femeshtbrep = FiniteElementOfMeshedTBrep(
    Mesh=meshcbrep,
    BoundaryConditions=[unibc.BCPoints, unibc_2.BCPoints],
    PointLoads=uniloads.PointLoads,
    PreDeformations=predef.PrescribedDeformations,
    Brep=cap_holes)  # -> Displacement, Strain, Stress, Nodes, Text, Size, Plane
curve_6 = Curve(<curve referenced from the Rhino model>)
curve_7 = Curve(<curve referenced from the Rhino model>)
stressdirectionslider = StressDirectionSlider(SliderVR=curve_6, Brep=cap_holes)  # -> StressDirection, Text, Size, Plane, Color, Geometry
deformationslider = DeformationSlider(SliderVR=curve_7, Brep=cap_holes)  # -> Scale, Text, Size, Plane, Colors, Geometry
mdsk_10 = MDSK(Geometry=stressdirectionslider.Geometry, Color=stressdirectionslider.Color, Start=boolean_toggle)
mdsk_11 = MDSK(Geometry=deformationslider.Geometry, Color=deformationslider.Colors, Start=boolean_toggle)
viewstress = ViewStresses(
    Mesh=meshcbrep,
    Stresses=femeshtbrep.Stress,
    StressDirection=stressdirectionslider.StressDirection,
    Displacement=femeshtbrep.Displacement)  # -> Solid, Color_solid, Legend, Color_legend, Text, Size, Plane, Color_T
viewdef = ViewDeformations(Mesh=meshcbrep, Displacement=femeshtbrep.Displacement, Scaling=deformationslider.Scale)  # -> BrepSolid, ColorSolid, BrepOuterEdges, ColorEdges, Text, Size, Plane, ColorT
mdsk_12 = MDSK(Geometry=viewdef.BrepOuterEdges, Color=viewdef.ColorEdges, Start=boolean_toggle)
mdsk_13 = MDSK(Geometry=viewdef.BrepSolid, Color=viewdef.ColorSolid, Start=boolean_toggle)
mdsk_14 = MDSK(Geometry=viewstress.Solid, Color=viewstress.Color_solid, Start=boolean_toggle)
mdsk_15 = MDSK(Geometry=viewstress.Legend, Color=viewstress.Color_legend, Start=boolean_toggle)
panel = Panel(viewdef.BrepOuterEdges)
panel_2 = Panel(viewstress.Text)
list_item_5 = ListItem(List=viewstress.Plane, Index=Slider(15, range=0..20), Wrap=True)
panel_3 = Panel(viewstress.Plane)
