# Grasshopper definition ArchComparing_case3.gh (Grasshopper 1.0.7)
# plug-ins: Karamba, SolidsVR

number_slider = Slider(500, range=0..2050)
pt = ConstructPoint(XCoordinate=number_slider, YCoordinate=Slider(-25, range=-50..50), ZCoordinate=Slider(525, range=450..550))
pt_2 = ConstructPoint(XCoordinate=Slider(-25, range=-50..50), YCoordinate=Slider(-25, range=-50..50), ZCoordinate=0)
pt_3 = ConstructPoint(XCoordinate=number_slider, YCoordinate=Slider(25, range=-50..50), ZCoordinate=Slider(525, range=450..550))
pt_4 = ConstructPoint(XCoordinate=number_slider, YCoordinate=Slider(-25, range=-50..50), ZCoordinate=Slider(475, range=450..550))
pt_5 = ConstructPoint(XCoordinate=Slider(25, range=-50..50), YCoordinate=Slider(-25, range=-50..50), ZCoordinate=0)
pt_6 = ConstructPoint(XCoordinate=number_slider, YCoordinate=Slider(25, range=-50..50), ZCoordinate=Slider(475, range=450..550))
pt_7 = ConstructPoint(XCoordinate=Slider(25, range=-50..50), YCoordinate=Slider(25, range=-50..50), ZCoordinate=0)
pt_8 = ConstructPoint(XCoordinate=Slider(-25, range=-50..50), YCoordinate=Slider(25, range=-50..50), ZCoordinate=0)
pt_9 = ConstructPoint(XCoordinate=0, YCoordinate=0, ZCoordinate=0)
pt_10 = ConstructPoint(XCoordinate=Slider(500, range=0..2000), YCoordinate=0, ZCoordinate=Slider(500, range=0..2000))
pt_11 = ConstructPoint(XCoordinate="146.4", YCoordinate=0, ZCoordinate="353.6")
pt_12 = ConstructPoint(XCoordinate="12.5", YCoordinate=0, ZCoordinate=0)
pt_13 = ConstructPoint(XCoordinate=Slider(25, range=-50..50), YCoordinate=Slider(25, range=-50..50), ZCoordinate=0)
pt_14 = ConstructPoint(XCoordinate=Slider(-37.5, range=-100..0), YCoordinate=0, ZCoordinate=0)
pt_15 = ConstructPoint(XCoordinate=Slider(25, range=-50..50), YCoordinate=Slider(-25, range=-50..50), ZCoordinate=0)
pt_16 = ConstructPoint(XCoordinate=Slider(-25, range=-50..50), YCoordinate=Slider(25, range=-50..50), ZCoordinate=0)
pt_17 = ConstructPoint(XCoordinate=Slider(-25, range=-50..50), YCoordinate=Slider(-25, range=-50..50), ZCoordinate=0)
pt_18 = Point([pt_2, pt_5, pt_7, pt_8, pt, pt_4, pt_6, pt_3])
ln = Line(StartPoint=pt_16, EndPoint=pt_13)
arc = Arc3Pt(PointA=pt_9, PointB=pt_11, PointC=pt_10)  # -> Arc, Plane, Radius
ln_2 = Line(StartPoint=pt_15, EndPoint=pt_17)
arc_2 = Arc3Pt(PointA=pt_13, PointB=pt_12, PointC=pt_15)  # -> Arc, Plane, Radius
arc_3 = Arc3Pt(PointA=pt_17, PointB=pt_14, PointC=pt_16)  # -> Arc, Plane, Radius
crv = Curve(ln_2)
number_slider_2 = Slider(3, range=0..10)
crv_2 = Curve(ln)
crv_3 = Curve(arc_2.Arc)
crv_4 = Curve(arc_3.Arc)
xy = XYPlane(Origin=Point(0, 0, 0))
vec = VectorXYZ(XComponent="500", YComponent="500", ZComponent="500")  # -> Vector, Length
edgesrf = EdgeSurface(CurveA=crv_2, CurveB=crv_3, CurveC=crv, CurveD=crv_4)
swp1 = Sweep1(Rail=arc.Arc, Sections=edgesrf, Miter=1)
move = Move(Geometry=xy, Motion=vec.Vector)  # -> Geometry, Transform
cap = CapHoles(Brep=swp1)
mesh_crazy_geometry = MeshingBrep(Brep=cap, Point=pt_18, UCount=number_slider_2, VCount=number_slider_2, WCount=Slider(20, range=0..128), RunTopOpt=False)  # -> Mesh, Curve, Surface, Curve_2, Surfaces
brep = Brep(mesh_crazy_geometry.Surfaces)
crv_5 = Curve(mesh_crazy_geometry.Curve)
Z = UnitZ(Factor="0")
vec_2 = VectorXYZ(XComponent="3.16", YComponent=0, ZComponent="-3.16")  # -> Vector, Length
sph = Sphere(Base=move.Geometry, Radius="1")
Z_2 = UnitZ(Factor="-10")
item = ListItem(List=brep, Index=Slider(4, range=0..5), Wrap=True)
Y = UnitY(Factor="-10")
unibc = UniformBCComponentForFEA(SurfaceNumber=Slider(5, range=0..5), Mesh=mesh_crazy_geometry.Mesh)  # -> BCPoints, BCCones, ColoringForBCCones
item_2 = ListItem(List=crv_5, Index=0, Wrap=True)  # -> Item, Item1, Item2, Item3, Item4, Item5, Item6, Item7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
unibc_2 = UniformBCComponentForFEA(SurfaceNumber=Slider(4, range=0..5), Mesh=mesh_crazy_geometry.Mesh)  # -> BCPoints, BCCones, ColoringForBCCones
uniloads = UniformLoadComponentForFEA(SurfaceNumber=Slider(2, range=0..5), LoadVector=Y, Mesh=mesh_crazy_geometry.Mesh)  # -> PointLoads, LoadArrows, ArrowColoring
predef = PreDef(Sphere=sph, PrescribedDeformations=Z, Mesh=mesh_crazy_geometry.Mesh)  # -> PrescribedDeformations, Text, Plane, Colors
item_3 = ListItem(List=crv_5, Index=Slider(5, range=0..12), Wrap=True)
deconstruct_meshcbrep = DeconstructMesh(Mesh=mesh_crazy_geometry.Mesh)  # -> ElementVertices, Connectivity, Edges, Surfaces, Points, Nodes, Elements
edgesrf_2 = EdgeSurface(CurveA=item_2.Item2, CurveB=item_2.Item7, CurveC=item_2.Item3, CurveD=item_2.Item6)
deconstruct_node = DeconstructNode(Node=deconstruct_meshcbrep.Nodes)  # -> Point, Elements, StringPos, Surfaces, Deformations, Strains, GlobalStrain, GlobalStress
material = CreateMaterial(EModulus="210000", PRatio="0.3", YieldStress="300")
femeshtbrep = FiniteElementOfMeshedTBrep(
    Mesh=mesh_crazy_geometry.Mesh,
    BoundaryConditions=[unibc_2.BCPoints, unibc.BCPoints],
    PointLoads=uniloads.PointLoads,
    PreDeformations=predef.PrescribedDeformations,
    Brep=material)  # -> Disp, Strain, Stress, N, Text, Size, Plane, Color_T, Nodes
item_4 = ListItem(List=femeshtbrep.N, Index=Slider(960, range=0..2000), Wrap=True)
branch = TreeBranch(Tree=simplify(deconstruct_meshcbrep.Edges), Path=Slider(10, range=0..10), MaintainPaths=True)
pt_19 = ConstructPoint(XCoordinate="1000", YCoordinate="50", ZCoordinate="1050")
panel = Panel(deconstruct_meshcbrep.Points)
panel_2 = Panel(item_4)
pt_20 = Point(flatten([deconstruct_meshcbrep.Points, pt_19]))
rdpoints = RemoveDuplicatePointsKaramba3D(Point=pt_20, LimitDistance=0.005)  # -> OutPoint, Info, Indexes
panel_3 = Panel(pt_20)
panel_4 = Panel(femeshtbrep.Strain)
pt_21 = ConstructPoint(XCoordinate=0, YCoordinate=0, ZCoordinate=0)
panel_6 = Panel(femeshtbrep.Stress)
flatten = FlattenTree(Tree=femeshtbrep.Disp, Path="{0}")
panel_7 = Panel(rdpoints.Indexes)
sort = SortList(Keys=flatten)  # -> Keys, ValuesA
viewdef = ViewDeformations(Mesh=mesh_crazy_geometry.Mesh, Scaling=femeshtbrep.Disp, Scaling_2=Slider(10, range=0..1000))  # -> BrepSolid, ColorSolid, BrepOuterEdges, ColorEdges, Text, Size, Plane, ColorT
panel_8 = Panel(sort.Keys)
