# Grasshopper definition ArchComparing_case3_2.gh (Grasshopper 1.0.7)
# plug-ins: Karamba, SolidsVR

pt = ConstructPoint(XCoordinate=Slider(-50, range=-50..50), YCoordinate=Slider(-50, range=-50..50), ZCoordinate=0)
pt_2 = ConstructPoint(XCoordinate=Slider(50, range=-50..50), YCoordinate=Slider(-50, range=-50..50), ZCoordinate=0)
pt_3 = ConstructPoint(XCoordinate=Slider(50, range=-50..50), YCoordinate=Slider(50, range=-50..50), ZCoordinate=0)
pt_4 = ConstructPoint(XCoordinate=Slider(-50, range=-50..50), YCoordinate=Slider(50, range=-50..50), ZCoordinate=0)
pt_5 = ConstructPoint(
    XCoordinate=Slider(1000, range=950..1000),
    YCoordinate=Slider(50, range=-50..50),
    ZCoordinate=Slider(1050, range=0..1050))
pt_6 = ConstructPoint(
    XCoordinate=Slider(1000, range=950..1000),
    YCoordinate=Slider(-50, range=-50..50),
    ZCoordinate=Slider(1050, range=0..1050))
pt_7 = ConstructPoint(
    XCoordinate=Slider(1000, range=950..1000),
    YCoordinate=Slider(-50, range=-50..50),
    ZCoordinate=Slider(950, range=0..1050))
pt_8 = ConstructPoint(XCoordinate=Slider(1000, range=950..1000), YCoordinate=Slider(50, range=-50..50), ZCoordinate=Slider(950, range=0..1050))
pt_9 = ConstructPoint(XCoordinate=0, YCoordinate=0, ZCoordinate=0)
pt_10 = ConstructPoint(XCoordinate=Slider(1000, range=0..1000), YCoordinate=0, ZCoordinate=Slider(1000, range=0..1000))
pt_11 = ConstructPoint(XCoordinate="292.9", YCoordinate=0, ZCoordinate="707.1")
pt_12 = ConstructPoint(XCoordinate=0, YCoordinate=0, ZCoordinate=0)
pt_13 = ConstructPoint(XCoordinate=Slider(50, range=-50..50), YCoordinate=Slider(50, range=-50..50), ZCoordinate=0)
pt_14 = ConstructPoint(XCoordinate=Slider(-99, range=-100..0), YCoordinate=0, ZCoordinate=0)
pt_15 = ConstructPoint(XCoordinate=Slider(-50, range=-50..50), YCoordinate=Slider(50, range=-50..50), ZCoordinate=0)
pt_16 = ConstructPoint(XCoordinate=Slider(50, range=-50..50), YCoordinate=Slider(-50, range=-50..50), ZCoordinate=0)
pt_17 = ConstructPoint(XCoordinate=Slider(-50, range=-50..50), YCoordinate=Slider(-50, range=-50..50), ZCoordinate=0)
pt_18 = Point([pt, pt_2, pt_3, pt_4, pt_6, pt_7, pt_8, pt_5])
arc = Arc3Pt(PointA=pt_9, PointB=pt_11, PointC=pt_10)  # -> Arc, Plane, Radius
ln = Line(StartPoint=pt_15, EndPoint=pt_13)
ln_2 = Line(StartPoint=pt_16, EndPoint=pt_17)
arc_2 = Arc3Pt(PointA=pt_17, PointB=pt_14, PointC=pt_15)  # -> Arc, Plane, Radius
arc_3 = Arc3Pt(PointA=pt_13, PointB=pt_12, PointC=pt_16)  # -> Arc, Plane, Radius
crv = Curve(ln_2)
crv_2 = Curve(ln)
crv_3 = Curve(arc_3.Arc)
crv_4 = Curve(arc_2.Arc)
xy = XYPlane(Origin=Point(0, 0, 0))
vec = VectorXYZ(XComponent="500", YComponent="500", ZComponent="500")  # -> Vector, Length
edgesrf = EdgeSurface(CurveA=crv_2, CurveB=crv_3, CurveC=crv, CurveD=crv_4)
swp1 = Sweep1(Rail=arc.Arc, Sections=edgesrf, Miter=1)
move = Move(Geometry=xy, Motion=vec.Vector)  # -> Geometry, Transform
cap = CapHoles(Brep=swp1)
debrep = DeconstructBrep(Brep=cap)  # -> Faces, Edges, Vertices
item = ListItem(List=debrep.Faces, Index=0, Wrap=True)  # -> Item, Item1, Item2, Item3, Item4, Item5
Z = UnitZ(Factor="0")
Z_2 = UnitZ(Factor="-10")
sph = Sphere(Base=move.Geometry, Radius="1")
number_slider = Slider(4, range=0..10)
item_2 = ListItem(List=debrep.Faces, Index=Slider(0, range=0..5), Wrap=True)
brep = Brep([item.Item4, item.Item5, item.Item2, item.Item3, item.Item1, item.Item])
mesh_crazy_geometry = MeshingBrep(Brep=cap, Point=pt_18, UCount=number_slider, VCount=number_slider, WCount=Slider(16, range=0..128), Surfaces=brep)  # -> Mesh, Curve, Surface, Curve_2, Surfaces
unibc = UniformBCComponentForFEA(SurfaceNumber=Slider(4, range=0..5), Mesh=mesh_crazy_geometry.Mesh)  # -> BCPoints, BCCones, ColoringForBCCones
unibc_2 = UniformBCComponentForFEA(SurfaceNumber=Slider(5, range=0..5), Mesh=mesh_crazy_geometry.Mesh)  # -> BCPoints, BCCones, ColoringForBCCones
uniloads = UniformLoadComponentForFEA(SurfaceNumber=Slider(3, range=0..5), LoadVector=Z_2, Mesh=mesh_crazy_geometry.Mesh)  # -> PointLoads, LoadArrows, ArrowColoring
predef = PreDef(Sphere=sph, PrescribedDeformations=Z, Mesh=mesh_crazy_geometry.Mesh)  # -> PrescribedDeformations, Text, Plane, Colors
item_3 = ListItem(List=mesh_crazy_geometry.Curve, Index=Slider(4, range=0..12), Wrap=True)
item_4 = ListItem(List=mesh_crazy_geometry.Surfaces, Index=Slider(5, range=0..5), Wrap=True)
number_slider_2 = Slider(5, range=0..5)
deconstruct_meshcbrep = DeconstructMesh(Mesh=mesh_crazy_geometry.Mesh)  # -> ElementVertices, Connectivity, Edges, Surfaces, Points, Nodes, Elements
crv_5 = Curve(mesh_crazy_geometry.Curve_2)
material = CreateMaterial(EModulus="210000", PRatio="0.3", YieldStress="355")
femeshtbrep = FiniteElementOfMeshedTBrep(
    Mesh=mesh_crazy_geometry.Mesh,
    BoundaryConditions=[unibc.BCPoints, unibc_2.BCPoints],
    PointLoads=uniloads.PointLoads,
    PreDeformations=predef.PrescribedDeformations,
    Material=material)  # -> Disp, Strain, Stress, N, Text, Size, Plane, Color_T, Nodes
femeshtbrep_2 = FiniteElementOfMeshedTBrep(
    Mesh=mesh_crazy_geometry.Mesh,
    BoundaryConditions=[unibc.BCPoints, unibc_2.BCPoints],
    PointLoads=uniloads.PointLoads,
    PreDeformations=predef.PrescribedDeformations,
    Brep=cap)  # -> Disp, Strain, Stress, N, Text, Size, Plane, Color_T, Nodes
branch = TreeBranch(Tree=simplify(deconstruct_meshcbrep.Surfaces), Path=Slider(3, range=0..10), MaintainPaths=True)
pt_19 = ConstructPoint(XCoordinate="257.544661", YCoordinate="-50", ZCoordinate="742.455339")
item_5 = ListItem(List=femeshtbrep_2.N, Index=Slider(20, range=0..100), Wrap=True)
panel = Panel(deconstruct_meshcbrep.Nodes)
pt_20 = Point(flatten([deconstruct_meshcbrep.Points, pt_19]))
panel_2 = Panel(femeshtbrep.Disp)
rdpoints = RemoveDuplicatePointsKaramba3D(Point=pt_20, LimitDistance=0.005)  # -> OutPoint, Info, Indexes
panel_3 = Panel(rdpoints.Indexes)
panel_4 = Panel(item_5)
pt_21 = ConstructPoint(XCoordinate=0, YCoordinate=0, ZCoordinate=0)
panel_5 = Panel(pt_20)
panel_6 = Panel(deconstruct_meshcbrep.Points)
panel_7 = Panel(femeshtbrep_2.Disp)
cullpt = CullDuplicates(Tolerance=0.1, CullMode=3)  # -> Points, Indices, Valence
flatten = FlattenTree(Tree=femeshtbrep_2.Disp, Path="{0}")
sort = SortList(Keys=flatten)  # -> Keys, ValuesA
viewdef = ViewDeformations(Mesh=mesh_crazy_geometry.Mesh, Scaling=femeshtbrep.Disp, Scaling_2=Slider(120, range=0..1000))  # -> BrepSolid, ColorSolid, BrepOuterEdges, ColorEdges, Text, Size, Plane, ColorT
panel_8 = Panel(sort.Keys)
