# Grasshopper definition ArchComparing_case3_degbugging.gh (Grasshopper 1.0.7)
# plug-ins: SolidsVR

pt = ConstructPoint(XCoordinate=Slider(-50, range=-50..50), YCoordinate=Slider(-50, range=-50..50), ZCoordinate=0)
pt_2 = ConstructPoint(XCoordinate=Slider(50, range=-50..50), YCoordinate=Slider(-50, range=-50..50), ZCoordinate=0)
pt_3 = ConstructPoint(XCoordinate=Slider(50, range=-50..50), YCoordinate=Slider(50, range=-50..50), ZCoordinate=0)
pt_4 = ConstructPoint(XCoordinate=Slider(-50, range=-50..50), YCoordinate=Slider(50, range=-50..50), ZCoordinate=0)
pt_5 = ConstructPoint(
    XCoordinate=Slider(1000, range=950..1000),
    YCoordinate=Slider(50, range=-50..50),
    ZCoordinate=Slider(1050, range=0..1050))
pt_6 = ConstructPoint(
    XCoordinate=Slider(1000, range=950..1000),
    YCoordinate=Slider(-50, range=-50..50),
    ZCoordinate=Slider(1050, range=0..1050))
pt_7 = ConstructPoint(
    XCoordinate=Slider(1000, range=950..1000),
    YCoordinate=Slider(-50, range=-50..50),
    ZCoordinate=Slider(950, range=0..1050))
pt_8 = ConstructPoint(XCoordinate=Slider(1000, range=950..1000), YCoordinate=Slider(50, range=-50..50), ZCoordinate=Slider(950, range=0..1050))
pt_9 = ConstructPoint(XCoordinate=0, YCoordinate=0, ZCoordinate=0)
pt_10 = ConstructPoint(XCoordinate=Slider(1000, range=0..1000), YCoordinate=0, ZCoordinate=Slider(1000, range=0..1000))
pt_11 = ConstructPoint(XCoordinate="292.9", YCoordinate=0, ZCoordinate="707.1")
pt_12 = ConstructPoint(XCoordinate=0, YCoordinate=0, ZCoordinate=0)
pt_13 = ConstructPoint(XCoordinate=Slider(50, range=-50..50), YCoordinate=Slider(50, range=-50..50), ZCoordinate=0)
pt_14 = ConstructPoint(XCoordinate=Slider(-78, range=-100..0), YCoordinate=0, ZCoordinate=0)
pt_15 = ConstructPoint(XCoordinate=Slider(-50, range=-50..50), YCoordinate=Slider(50, range=-50..50), ZCoordinate=0)
pt_16 = ConstructPoint(XCoordinate=Slider(50, range=-50..50), YCoordinate=Slider(-50, range=-50..50), ZCoordinate=0)
pt_17 = ConstructPoint(XCoordinate=Slider(-50, range=-50..50), YCoordinate=Slider(-50, range=-50..50), ZCoordinate=0)
pt_18 = Point([pt, pt_2, pt_3, pt_4, pt_6, pt_7, pt_8, pt_5])
arc = Arc3Pt(PointA=pt_9, PointB=pt_11, PointC=pt_10)  # -> Arc, Plane, Radius
ln = Line(StartPoint=pt_15, EndPoint=pt_13)
ln_2 = Line(StartPoint=pt_16, EndPoint=pt_17)
arc_2 = Arc3Pt(PointA=pt_13, PointB=pt_12, PointC=pt_16)  # -> Arc, Plane, Radius
arc_3 = Arc3Pt(PointA=pt_17, PointB=pt_14, PointC=pt_15)  # -> Arc, Plane, Radius
crv = Curve(ln_2)
crv_2 = Curve(ln)
crv_3 = Curve(arc_2.Arc)
crv_4 = Curve(arc_3.Arc)
edgesrf = EdgeSurface(CurveA=crv_2, CurveB=crv_3, CurveC=crv, CurveD=crv_4)
swp1 = Sweep1(Rail=arc.Arc, Sections=edgesrf, Miter=1)
xy = XYPlane(Origin=Point(0, 0, 0))
cap = CapHoles(Brep=swp1)
debrep = DeconstructBrep(Brep=cap)  # -> Faces, Edges, Vertices
vec = VectorXYZ(XComponent="500", YComponent="500", ZComponent="500")  # -> Vector, Length
item = ListItem(List=debrep.Faces, Index=0, Wrap=True)  # -> Item, Item1, Item2, Item3, Item4, Item5
Z = UnitZ(Factor="0")
move = Move(Geometry=xy, Motion=vec.Vector)  # -> Geometry, Transform
Z_2 = UnitZ(Factor="-10")
item_2 = ListItem(List=debrep.Faces, Index=0, Wrap=True)
number_slider = Slider(2, range=0..10)
brep = Brep()
sph = Sphere(Base=move.Geometry, Radius="1")
brep_2 = Brep([item.Item4, item.Item5, item.Item2, item.Item3, item.Item1, item.Item])
mesh_crazy_geometry = MeshingBrep(Brep=cap, Point=pt_18, UCount=number_slider, VCount=number_slider, WCount=Slider(9, range=0..128), Surfaces=brep_2)  # -> Mesh, Curve, Surface, Curve_2, Surfaces
unibc = UniformBCComponentForFEA(SurfaceNumber=Slider(5, range=0..5), Mesh=mesh_crazy_geometry.Mesh)  # -> BCPoints, BCCones, ColoringForBCCones
unibc_2 = UniformBCComponentForFEA(SurfaceNumber=Slider(4, range=0..5), Mesh=mesh_crazy_geometry.Mesh)  # -> BCPoints, BCCones, ColoringForBCCones
uniloads = UniformLoadComponentForFEA(SurfaceNumber=Slider(3, range=0..5), LoadVector=Z_2, Mesh=mesh_crazy_geometry.Mesh)  # -> PointLoads, LoadArrows, ArrowColoring
predef = PreDef(Sphere=sph, PrescribedDeformations=Z, Mesh=mesh_crazy_geometry.Mesh)  # -> PrescribedDeformations, Text, Plane, Colors
crv_5 = Curve(mesh_crazy_geometry.Curve_2)
material = CreateMaterial(EModulus="210000", PRatio="0.3")
number_slider_2 = Slider(5, range=0..5)
femeshtbrep = FiniteElementOfMeshedTBrep(
    Mesh=mesh_crazy_geometry.Mesh,
    BoundaryConditions=[unibc_2.BCPoints, unibc.BCPoints],
    PointLoads=uniloads.PointLoads,
    PreDeformations=predef.PrescribedDeformations,
    Brep=cap,
    Material=material)  # -> Disp, Strain, Stress, N, Text, Size, Plane, Color_T, Nodes
panel = Panel(femeshtbrep.Disp)
panel_2 = Panel(femeshtbrep.Stress)
flatten = FlattenTree(Tree=femeshtbrep.Disp, Path="{0}")
sort = SortList(Keys=flatten)  # -> Keys, ValuesA
panel_3 = Panel(sort.Keys)
