# Grasshopper definition Cantliver_Topology_case3.gh (Grasshopper 1.0.7)
# plug-ins: SolidsVR

number_slider = Slider(1000, range=0..1000)
panel = Panel("0")
number_slider_2 = Slider(200, range=0..200)
number_slider_3 = Slider(200, range=0..200)
pt = ConstructPoint(XCoordinate=number_slider_2, YCoordinate=number_slider_2, ZCoordinate=0)
pt_2 = ConstructPoint(XCoordinate=number_slider_3, YCoordinate=number_slider_3, ZCoordinate=0)
pt_3 = ConstructPoint(XCoordinate=0, YCoordinate=0, ZCoordinate=0)
pt_4 = ConstructPoint(XCoordinate=number_slider_2, YCoordinate=0, ZCoordinate=0)
pt_5 = ConstructPoint(XCoordinate=0, YCoordinate=number_slider_2, ZCoordinate=0)
pt_6 = ConstructPoint(XCoordinate=0, YCoordinate=0, ZCoordinate=0)
pt_7 = ConstructPoint(XCoordinate=number_slider_3, YCoordinate=0, ZCoordinate=0)
pt_8 = ConstructPoint(XCoordinate=0, YCoordinate=number_slider_3, ZCoordinate=0)
pt_9 = ConstructPoint(XCoordinate=0, YCoordinate=0, ZCoordinate=number_slider)
pt_10 = ConstructPoint(XCoordinate=number_slider_3, YCoordinate=0, ZCoordinate=number_slider)
pt_11 = ConstructPoint(XCoordinate=number_slider_3, YCoordinate=number_slider_3, ZCoordinate=number_slider)
pt_12 = ConstructPoint(XCoordinate=0, YCoordinate=number_slider_3, ZCoordinate=number_slider)
pt_13 = Point([pt_6, pt_7, pt_2, pt_8, pt_9, pt_10, pt_11, pt_12])
p2b = PointsToBrep(Points=pt_13)
vec = VectorXYZ(XComponent=0, YComponent=Slider(-500, range=-500..0), ZComponent=0)  # -> Vector, Length
number_slider_4 = Slider(3, range=0..50)
number_slider_5 = Slider(4, range=0..50)
number_slider_6 = Slider(20, range=0..50)
division = Division(A=number_slider, B=number_slider_6)
subtraction = Subtraction(A=Slider(1000, range=0..1000), B=division)
pt_14 = ConstructPoint(XCoordinate=0, YCoordinate=0, ZCoordinate=subtraction)
pt_15 = ConstructPoint(XCoordinate=number_slider_2, YCoordinate=0, ZCoordinate=subtraction)
pt_16 = ConstructPoint(XCoordinate=number_slider_2, YCoordinate=number_slider_2, ZCoordinate=subtraction)
pt_17 = ConstructPoint(XCoordinate=0, YCoordinate=number_slider_2, ZCoordinate=subtraction)
pt_18 = Point([pt_3, pt_4, pt, pt_5, pt_14, pt_15, pt_16, pt_17])
p2b_2 = PointsToBrep(Points=pt_18)
move = Move(Geometry=p2b_2, Motion=vec.Vector)  # -> Geometry, Transform
move_2 = Move(Geometry=pt_18, Motion=vec.Vector)  # -> Geometry, Transform
X = UnitX(Factor="10")
Z = UnitZ(Factor="0")
X_2 = UnitX(Factor="10")
Z_2 = UnitZ(Factor="0")
meshcbrep = MeshCBrep(
    Brep=move.Geometry,
    Point=move_2.Geometry,
    UCount=number_slider_4,
    VCount=number_slider_4,
    WCount=Slider(20, range=0..20))
meshcbrep_2 = MeshCBrep(Brep=p2b, Point=pt_13, UCount=number_slider_5, VCount=number_slider_5, WCount=number_slider_6)
sph = Sphere(Base=PlaneXY(0, 0, 0), Radius=1)
uniloads = UniformLoadComponentForFEA(SurfaceNumber=Slider(3, range=0..5), LoadVector=X, Mesh=meshcbrep_2)  # -> PointLoads, LoadArrows, ArrowColoring
unibc = UniformBCComponentForFEA(Surface=Slider(4, range=0..5), UCount=meshcbrep_2)  # -> BCPoints, BCCones, ColoringForBCCones
unibc_2 = UniformBCComponentForFEA(Surface=Slider(5, range=0..5), UCount=meshcbrep_2)  # -> BCPoints, BCCones, ColoringForBCCones
sph_2 = Sphere(Base=PlaneXY(0, 0, 0), Radius=1)
predef = PreDef(Sphere=sph, PrescribedDeformations=Z, Mesh=meshcbrep_2)  # -> PrescribedDeformations, Text, Plane, Colors
uniloads_2 = UniformLoadComponentForFEA(SurfaceNumber=Slider(3, range=0..5), LoadVector=X_2, Mesh=meshcbrep)  # -> PointLoads, LoadArrows, ArrowColoring
unibc_3 = UniformBCComponentForFEA(Surface=Slider(4, range=0..5), UCount=meshcbrep)  # -> BCPoints, BCCones, ColoringForBCCones
predef_2 = PreDef(Sphere=sph_2, PrescribedDeformations=Z_2, Mesh=meshcbrep)  # -> PrescribedDeformations, Text, Plane, Colors
deconstruct_meshcbrep = DeconstructMesh(Mesh=meshcbrep)  # -> ElementVertices, Connectivity, Edges, Surfaces, Points, Nodes, Elements
deconstruct_meshcbrep_2 = DeconstructMesh(Mesh=meshcbrep_2)  # -> ElementVertices, Connectivity, Edges, Surfaces, Points, Nodes, Elements
number_slider_7 = Slider(89, range=0..100)
material = CreateMaterial(EModulus="210000", PRatio="0.3")
item = ListItem(List=deconstruct_meshcbrep.Points, Index=Slider(5, range=0..100), Wrap=True)
item_2 = ListItem(List=deconstruct_meshcbrep_2.Edges, Index=number_slider_7, Wrap=True)
material_2 = CreateMaterial(EModulus="210000", PRatio="0.3")
femeshtbrep = FiniteElementOfMeshedTBrep(
    Mesh=meshcbrep_2,
    BoundaryConditions=[unibc.BCPoints, unibc_2.BCPoints],
    PointLoads=uniloads.PointLoads,
    PreDeformations=predef.PrescribedDeformations,
    Brep=p2b,
    Material=material)  # -> Disp, Strain, Stress, N, Text, Size, Plane, Color_T, Nodes
femeshtbrep_2 = FiniteElementOfMeshedTBrep(
    Mesh=meshcbrep,
    BoundaryConditions=unibc_3.BCPoints,
    PointLoads=uniloads_2.PointLoads,
    PreDeformations=predef_2.PrescribedDeformations,
    Brep=move.Geometry,
    Material=material_2)  # -> Disp, Strain, Stress, N, Text, Size, Plane, Color_T, Nodes
branch = TreeBranch(Tree=simplify(deconstruct_meshcbrep_2.Edges), Path=number_slider_7, MaintainPaths=True)
panel_2 = Panel(femeshtbrep_2.Disp)
viewdef = ViewDeformations(Mesh=meshcbrep, Displacement=Slider(7, range=0..1000))  # -> BrepSolid, ColorSolid, BrepOuterEdges, ColorEdges, Text, Size, Plane, ColorT; disabled
viewdef_2 = ViewDeformations(Mesh=meshcbrep_2, Displacement=Slider(7, range=0..1000))  # -> BrepSolid, ColorSolid, BrepOuterEdges, ColorEdges, Text, Size, Plane, ColorT
