# Grasshopper definition HalfArch_Topology_case3.gh (Grasshopper 1.0.7)
# plug-ins: SolidsVR

brep = Brep(<brep referenced from the Rhino model>)
area = Area(Geometry=brep)  # -> Area, Centroid
pt = Point(area.Centroid)
panel = Panel(pt)
panel_2 = Panel("707.1")
panel_3 = Panel("292.9")
pt_2 = ConstructPoint(XCoordinate=Slider(-50, range=-50..50), YCoordinate=Slider(-50, range=-50..50), ZCoordinate=0)
pt_3 = ConstructPoint(XCoordinate=Slider(50, range=-50..50), YCoordinate=Slider(-50, range=-50..50), ZCoordinate=0)
pt_4 = ConstructPoint(XCoordinate=Slider(50, range=-50..50), YCoordinate=Slider(50, range=-50..50), ZCoordinate=0)
pt_5 = ConstructPoint(XCoordinate=Slider(-50, range=-50..50), YCoordinate=Slider(50, range=-50..50), ZCoordinate=0)
pt_6 = ConstructPoint(
    XCoordinate=Slider(1000, range=950..1000),
    YCoordinate=Slider(50, range=-50..50),
    ZCoordinate=Slider(1050, range=0..1050))
pt_7 = ConstructPoint(
    XCoordinate=Slider(1000, range=950..1000),
    YCoordinate=Slider(-50, range=-50..50),
    ZCoordinate=Slider(1050, range=0..1050))
pt_8 = ConstructPoint(
    XCoordinate=Slider(1000, range=950..1000),
    YCoordinate=Slider(-50, range=-50..50),
    ZCoordinate=Slider(950, range=0..1050))
pt_9 = ConstructPoint(XCoordinate=Slider(1000, range=950..1000), YCoordinate=Slider(50, range=-50..50), ZCoordinate=Slider(950, range=0..1050))
pt_10 = ConstructPoint(XCoordinate=0, YCoordinate=0, ZCoordinate=0)
Z = UnitZ(Factor=Slider(-39, range=-200..200))
pt_11 = ConstructPoint(XCoordinate=Slider(1000, range=0..1000), YCoordinate=0, ZCoordinate=Slider(1000, range=0..1000))
pt_12 = ConstructPoint(XCoordinate="292.9", YCoordinate=0, ZCoordinate="707.1")
pt_13 = ConstructPoint(XCoordinate=0, YCoordinate=0, ZCoordinate=0)
pt_14 = ConstructPoint(XCoordinate=Slider(50, range=-50..50), YCoordinate=Slider(50, range=-50..50), ZCoordinate=0)
pt_15 = ConstructPoint(XCoordinate=Slider(-99, range=-100..0), YCoordinate=0, ZCoordinate=0)
pt_16 = ConstructPoint(XCoordinate=Slider(-50, range=-50..50), YCoordinate=Slider(50, range=-50..50), ZCoordinate=0)
pt_17 = ConstructPoint(XCoordinate=Slider(50, range=-50..50), YCoordinate=Slider(-50, range=-50..50), ZCoordinate=0)
pt_18 = ConstructPoint(XCoordinate=0, YCoordinate=0, ZCoordinate=0)
pt_19 = ConstructPoint(XCoordinate=Slider(-50, range=-50..50), YCoordinate=Slider(-50, range=-50..50), ZCoordinate=0)
move = Move(Geometry=pt, Motion=Z)  # -> Geometry, Transform
pt_20 = ConstructPoint(XCoordinate=Slider(1000, range=0..1000), YCoordinate=0, ZCoordinate=Slider(1000, range=0..1000))
pt_21 = ConstructPoint(XCoordinate=Slider(372, range=0..500), YCoordinate=0, ZCoordinate=Slider(780, range=0..1000))
pt_22 = ConstructPoint(XCoordinate=0, YCoordinate=0, ZCoordinate=0)
pt_23 = ConstructPoint(XCoordinate=Slider(50, range=-50..50), YCoordinate=Slider(50, range=-50..50), ZCoordinate=0)
pt_24 = ConstructPoint(XCoordinate=Slider(-99, range=-100..0), YCoordinate=0, ZCoordinate=0)
pt_25 = ConstructPoint(XCoordinate=Slider(-50, range=-50..50), YCoordinate=Slider(50, range=-50..50), ZCoordinate=0)
pt_26 = ConstructPoint(XCoordinate=Slider(50, range=-50..50), YCoordinate=Slider(-50, range=-50..50), ZCoordinate=0)
pt_27 = Point([pt_2, pt_3, pt_4, pt_5, pt_7, pt_8, pt_9, pt_6])
pt_28 = ConstructPoint(XCoordinate=Slider(-50, range=-50..50), YCoordinate=Slider(-50, range=-50..50), ZCoordinate=0)
arc = Arc3Pt(PointA=pt_10, PointB=pt_12, PointC=pt_11)  # -> Arc, Plane, Radius
ln = Line(StartPoint=pt_16, EndPoint=pt_14)
ln_2 = Line(StartPoint=pt_17, EndPoint=pt_19)
arc_2 = Arc3Pt(PointA=pt_19, PointB=pt_15, PointC=pt_16)  # -> Arc, Plane, Radius
arc_3 = Arc3Pt(PointA=pt_14, PointB=pt_13, PointC=pt_17)  # -> Arc, Plane, Radius
panel_4 = Panel(move.Geometry)
arc_4 = Arc3Pt(PointA=pt_18, PointB=pt_21, PointC=move.Geometry)  # -> Arc, Plane, Radius
ln_3 = Line(StartPoint=pt_25, EndPoint=pt_23)
ln_4 = Line(StartPoint=pt_26, EndPoint=pt_28)
crv = Curve(ln_2)
arc_5 = Arc3Pt(PointA=pt_28, PointB=pt_24, PointC=pt_25)  # -> Arc, Plane, Radius
arc_6 = Arc3Pt(PointA=pt_23, PointB=pt_22, PointC=pt_26)  # -> Arc, Plane, Radius
crv_2 = Curve(ln)
crv_3 = Curve(arc_3.Arc)
crv_4 = Curve(arc_2.Arc)
crv_5 = Curve(ln_4)
crv_6 = Curve(ln_3)
crv_7 = Curve(arc_6.Arc)
crv_8 = Curve(arc_5.Arc)
edgesrf = EdgeSurface(CurveA=crv_2, CurveB=crv_3, CurveC=crv, CurveD=crv_4)
swp1 = Sweep1(Rail=arc.Arc, Sections=edgesrf, Miter=1)
cap = CapHoles(Brep=swp1)
edgesrf_2 = EdgeSurface(CurveA=crv_6, CurveB=crv_7, CurveC=crv_5, CurveD=crv_8)
swp1_2 = Sweep1(Rail=arc_4.Arc, Sections=edgesrf_2, Miter=1)
cap_2 = CapHoles(Brep=swp1_2)
number_slider = Slider(4, range=0..10)
vec = VectorXYZ(XComponent=0, YComponent=Slider(-1000, range=-1000..0), ZComponent=0)  # -> Vector, Length
pt_29 = Point(pt_27)
brep_2 = Brep(cap)
move_2 = Move(Geometry=cap_2, Motion=vec.Vector)  # -> Geometry, Transform
mesh_crazy_geometry = MeshingBrep(Brep=brep_2, Point=pt_29, UCount=number_slider, VCount=number_slider, WCount=Slider(59, range=0..128))  # -> Mesh, Curve, Surface, Curve_2, Surfaces
item = ListItem(List=mesh_crazy_geometry.Curve, Index=Slider(4, range=0..12), Wrap=True)
xy = XYPlane(Origin=Point(0, 0, 0))
deconstruct_meshcbrep = DeconstructMesh(Mesh=mesh_crazy_geometry.Mesh)  # -> ElementVertices, Connectivity, Edges, Surfaces, Points, Nodes, Elements
vec_2 = VectorXYZ(XComponent="500", YComponent="500", ZComponent="500")  # -> Vector, Length
debrep = DeconstructBrep(Brep=move_2.Geometry)  # -> Faces, Edges, Vertices
unibc = UniformBCComponentForFEA(SurfaceNumber=Slider(5, range=0..5), Mesh=mesh_crazy_geometry.Mesh)  # -> BCPoints, BCCones, ColoringForBCCones
unibc_2 = UniformBCComponentForFEA(SurfaceNumber=Slider(4, range=0..5), Mesh=mesh_crazy_geometry.Mesh)  # -> BCPoints, BCCones, ColoringForBCCones
move_3 = Move(Geometry=xy, Motion=vec_2.Vector)  # -> Geometry, Transform
item_2 = ListItem(List=debrep.Vertices, Index=0, Wrap=True)  # -> Item, Item1, Item2, Item3, Item4, Item5, Item6, Item7
branch = TreeBranch(Tree=simplify(deconstruct_meshcbrep.Edges), Path=Slider(10, range=0..10), MaintainPaths=True)
Z_2 = UnitZ(Factor="0")
Z_3 = UnitZ(Factor="-10")
uniloads = UniformLoadComponentForFEA(SurfaceNumber=Slider(3, range=0..5), LoadVector=Z_3, Mesh=mesh_crazy_geometry.Mesh)  # -> PointLoads, LoadArrows, ArrowColoring
sph = Sphere(Base=move_3.Geometry, Radius="1")
predef = PreDef(Sphere=sph, PrescribedDeformations=Z_2, Mesh=mesh_crazy_geometry.Mesh)  # -> PrescribedDeformations, Text, Plane, Colors
panel_5 = Panel(deconstruct_meshcbrep.Nodes)
brep_3 = Brep(move_2.Geometry)
pt_30 = Point([item_2.Item7, item_2.Item6, item_2.Item5, item_2.Item4, item_2.Item2, item_2.Item3, item_2.Item, item_2.Item1])
item_3 = ListItem(List=pt_30, Index=Slider(7, range=0..7), Wrap=True)
number_slider_2 = Slider(10, range=0..10)
number_slider_3 = Slider(3, range=0..5)
number_slider_4 = Slider(5, range=0..10)
material = CreateMaterial(EModulus="210000", PRatio="0.3")
meshsbrep = MeshSBrep(Brep=brep_3, Point=pt_30, UCount=number_slider_4, VCount=number_slider_4, WCount=Slider(100, range=0..100))  # -> Mesh, Curve, Surface, Curve_2, Surfaces
deconstruct_meshcbrep_2 = DeconstructMesh(Mesh=meshsbrep.Mesh)  # -> ElementVertices, Connectivity, Edges, Surfaces, Points, Nodes, Elements
femeshtbrep = FiniteElementOfMeshedTBrep(
    Mesh=mesh_crazy_geometry.Mesh,
    BoundaryConditions=[unibc_2.BCPoints, unibc.BCPoints],
    PointLoads=uniloads.PointLoads,
    PreDeformations=predef.PrescribedDeformations,
    Brep=cap,
    Material=material)  # -> Disp, Strain, Stress, N, Text, Size, Plane, Color_T, Nodes; disabled
panel_6 = Panel(femeshtbrep.Disp)
xy_2 = XYPlane(Origin=Point(0, 0, 0))
vec_3 = VectorXYZ(XComponent="500", YComponent="500", ZComponent="500")  # -> Vector, Length
unibc_3 = UniformBCComponentForFEA(SurfaceNumber=Slider(5, range=0..5), Mesh=meshsbrep.Mesh)  # -> BCPoints, BCCones, ColoringForBCCones; disabled
viewdef = ViewDeformations(Mesh=mesh_crazy_geometry.Mesh, Scaling=Slider(1, range=0..10))  # -> BrepSolid, ColorSolid, BrepOuterEdges, ColorEdges, Text, Size, Plane, ColorT
unibc_4 = UniformBCComponentForFEA(SurfaceNumber=Slider(4, range=0..5), Mesh=meshsbrep.Mesh)  # -> BCPoints, BCCones, ColoringForBCCones
move_4 = Move(Geometry=xy_2, Motion=vec_3.Vector)  # -> Geometry, Transform
Z_4 = UnitZ(Factor="0")
Z_5 = UnitZ(Factor="-10")
uniloads_2 = UniformLoadComponentForFEA(SurfaceNumber=Slider(3, range=0..5), LoadVector=Z_5, Mesh=meshsbrep.Mesh)  # -> PointLoads, LoadArrows, ArrowColoring
sph_2 = Sphere(Base=move_4.Geometry, Radius="1")
predef_2 = PreDef(Sphere=sph_2, PrescribedDeformations=Z_4, Mesh=meshsbrep.Mesh)  # -> PrescribedDeformations, Text, Plane, Colors
material_2 = CreateMaterial(EModulus="210000", PRatio="0.3")
femeshtbrep_2 = FiniteElementOfMeshedTBrep(
    Mesh=meshsbrep.Mesh,
    BoundaryConditions=unibc_4.BCPoints,
    PointLoads=uniloads_2.PointLoads,
    PreDeformations=predef_2.PrescribedDeformations,
    Brep=brep_3,
    Material=material_2)  # -> Disp, Strain, Stress, N, Text, Size, Plane, Color_T, Nodes
panel_7 = Panel(femeshtbrep_2.Disp)
viewdef_2 = ViewDeformations(Mesh=meshsbrep.Mesh, Scaling=Slider(1, range=0..5))  # -> BrepSolid, ColorSolid, BrepOuterEdges, ColorEdges, Text, Size, Plane, ColorT; disabled
