# Grasshopper definition VR_geometry.gh (Grasshopper 1.0.7)
# plug-ins: SolidsVR

point2 = Point(<point referenced from the Rhino model>)
point3 = Point(<point referenced from the Rhino model>)
# Cross Section 1
point1 = Point(<point referenced from the Rhino model>)
point4 = Point(<point referenced from the Rhino model>)
point2_2 = Point(<point referenced from the Rhino model>)
point3_2 = Point(<point referenced from the Rhino model>)
point1_2 = Point(<point referenced from the Rhino model>)
point4_2 = Point(<point referenced from the Rhino model>)
# POINTS FOR FIXING ORDER
pt = Point([point1, point2, point3, point4, point1_2, point2_2, point3_2, point4_2])

# ---- group: Curve1
control1 = Point(<point referenced from the Rhino model>)
control2 = Point(<point referenced from the Rhino model>)
pt_2 = Point([point1, control1, control2, point2])
nurbs = NurbsCurve(Vertices=pt_2, Degree=3, Periodic=False)  # -> Curve, Length, Domain

# ---- group: Curve1 / Curve3
control1_2 = Point(<point referenced from the Rhino model>)
control2_2 = Point(<point referenced from the Rhino model>)
pt_3 = Point([point3, control1_2, control2_2, point4])
nurbs_2 = NurbsCurve(Vertices=pt_3, Degree=3, Periodic=False)  # -> Curve, Length, Domain

# ---- group: Curve1 / Curve2
control1_3 = Point(<point referenced from the Rhino model>)
control2_3 = Point(<point referenced from the Rhino model>)
pt_4 = Point([point2, control1_3, control2_3, point3])
nurbs_3 = NurbsCurve(Vertices=pt_4, Degree=3, Periodic=False)  # -> Curve, Length, Domain

# ---- group: Curve1 / Curve4
control1_4 = Point(<point referenced from the Rhino model>)
control2_4 = Point(<point referenced from the Rhino model>)
pt_5 = Point([point4, control1_4, control2_4, point1])
nurbs_4 = NurbsCurve(Vertices=pt_5, Degree=3, Periodic=False)  # -> Curve, Length, Domain

# ---- group: Curve1
# Cross Section 2
control1_5 = Point(<point referenced from the Rhino model>)
control2_5 = Point(<point referenced from the Rhino model>)
pt_6 = Point([point1_2, control1_5, control2_5, point2_2])
nurbs_5 = NurbsCurve(Vertices=pt_6, Degree=3, Periodic=False)  # -> Curve, Length, Domain

# ---- group: Curve1 / Curve3
control1_6 = Point(<point referenced from the Rhino model>)
control2_6 = Point(<point referenced from the Rhino model>)
pt_7 = Point([point3_2, control1_6, control2_6, point4_2])
nurbs_6 = NurbsCurve(Vertices=pt_7, Degree=3, Periodic=False)  # -> Curve, Length, Domain

# ---- group: Curve1 / Curve2
control1_7 = Point(<point referenced from the Rhino model>)
control2_7 = Point(<point referenced from the Rhino model>)
pt_8 = Point([point2_2, control1_7, control2_7, point3_2])
nurbs_7 = NurbsCurve(Vertices=pt_8, Degree=3, Periodic=False)  # -> Curve, Length, Domain

# ---- group: Curve1 / Curve4
control1_8 = Point(<point referenced from the Rhino model>)
control2_8 = Point(<point referenced from the Rhino model>)
pt_9 = Point([point4_2, control1_8, control2_8, point1_2])
nurbs_8 = NurbsCurve(Vertices=pt_9, Degree=3, Periodic=False)  # -> Curve, Length, Domain

# ----
# RAIL
crv = Curve(<curve referenced from the Rhino model>)
crv_2 = Curve(<curve referenced from the Rhino model>)
crv_3 = Curve(<curve referenced from the Rhino model>)
crv_4 = Curve(<curve referenced from the Rhino model>)
crv_5 = Curve(<curve referenced from the Rhino model>)
crv_6 = Curve(<curve referenced from the Rhino model>)
crv_7 = Curve(<curve referenced from the Rhino model>)
crv_8 = Curve(<curve referenced from the Rhino model>)
crv_9 = Curve(<curve referenced from the Rhino model>)
edgesrf = EdgeSurface(CurveA=crv_2, CurveB=crv_3, CurveC=crv_4, CurveD=crv_5)
edgesrf_2 = EdgeSurface(CurveA=crv_7, CurveB=crv_6, CurveC=crv_8, CurveD=crv_9)
area = Area(Geometry=edgesrf_2)  # -> Area, Centroid
area_2 = Area(Geometry=edgesrf)  # -> Area, Centroid
swp1 = Sweep1(Rail=crv, Sections=[edgesrf, edgesrf_2], Miter=1)
join = BrepJoin(Breps=flatten([swp1, edgesrf, edgesrf_2]))  # -> Breps, Closed
cap = CapHoles(Brep=swp1)
# MESH
number_slider = Slider(2, range=0..10)
meshsbrep = MeshSBrep(Brep=join.Breps, Point=pt, UCount=number_slider, VCount=Slider(2, range=0..10), WCount=Slider(9, range=0..10))  # -> Mesh, Curve, Surface, Curve_2, Surfaces
deconstruct_meshcbrep = DeconstructMesh(Mesh=meshsbrep.Mesh)  # -> ElementVertices, Connectivity, Edges, Surfaces, Points, Nodes, Elements
crv_10 = Curve()
crv_11 = Curve()
crv_12 = Curve()
crv_13 = Curve()
loadslider = LoadSlider(SliderVR=crv_10, Brep=cap)  # -> Load, Text, Size, Plane, Colors, Geometry
predefslider = PreDefSlider(SliderVR=crv_11, Brep=cap)  # -> PrescribedDeformation, Text, Size, Plane, Colors, Geometry
xy = XYPlane(Origin=Point(0, 0, 0))
surfslider = SurfaceSlider(SliderVR=crv_12, Brep=cap)  # -> SurfaceNumber, Text, Size, Plane, Colors, Geometry
vec = VectorXYZ(XComponent="500", YComponent="500", ZComponent="500")  # -> Vector, Length
surfslider_2 = SurfaceSlider(SliderVR=crv_13, Brep=join.Breps)  # -> SurfaceNumber, Text, Size, Plane, Colors, Geometry
brep = Brep()
move = Move(Geometry=xy, Motion=vec.Vector)  # -> Geometry, Transform
brep_2 = Brep()
Z = UnitZ(Factor="0")
Z_2 = UnitZ(Factor="-10")
node_info = GetInformationOfNode(Sphere=brep_2, Mesh=meshsbrep.Mesh)  # -> Text, Plane, Colors, TextSphere, PlaneSphere
sph = Sphere(Base=move.Geometry, Radius="1")
predef = PreDef(Sphere=sph, PrescribedDeformations=Z, Mesh=meshsbrep.Mesh)  # -> PrescribedDeformations, Text, Plane, Colors
unibc = UniformBCComponentForFEA(SurfaceNumber=Slider(5, range=0..5), Mesh=meshsbrep.Mesh)  # -> BCPoints, BCCones, ColoringForBCCones
uniloads = UniformLoadComponentForFEA(SurfaceNumber=Slider(3, range=0..5), LoadVector=Z_2, Mesh=meshsbrep.Mesh)  # -> PointLoads, LoadArrows, ArrowColoring
unibc_2 = UniformBCComponentForFEA(SurfaceNumber=Slider(4, range=0..5), Mesh=meshsbrep.Mesh)  # -> BCPoints, BCCones, ColoringForBCCones
material = CreateMaterial(EModulus="210000", PRatio="0.3")
femeshtbrep = FiniteElementOfMeshedTBrep(
    Mesh=meshsbrep.Mesh,
    BoundaryConditions=[unibc_2.BCPoints, unibc.BCPoints],
    PointLoads=uniloads.PointLoads,
    PreDeformations=predef.PrescribedDeformations,
    Brep=cap,
    Material=material)  # -> Disp, Strain, Stress, N, Text, Size, Plane, Color_T, Nodes
crv_14 = Curve()
stressslider = StressDirectionSlider(SliderVR=crv_14, Brep=cap)  # -> StressDirection, Text, Size, Plane, Color, Geometry
number_slider_2 = Slider(247, range=0..1000)
crv_15 = Curve()
defslider = DeformationSlider(SliderVR=crv_15, Brep=cap)  # -> Scale, Text, Size, Plane, Colors, Geometry
viewstress = ViewStresses(Mesh=meshsbrep.Mesh, StressDirection=Slider(0, range=0..6), Scaling=number_slider_2)  # -> Solid, Color_solid, Legend, Color_legend, Text, Size, Plane, Color_T
viewdef = ViewDeformations(Mesh=meshsbrep.Mesh, Scaling=number_slider_2)  # -> BrepSolid, ColorSolid, BrepOuterEdges, ColorEdges, Text, Size, Plane, ColorT
