# Grasshopper definition meshTest_Advanced_Grasshopper.gh (Grasshopper 1.0.7)
# plug-ins: SolidsVR

pt = ConstructPoint(XCoordinate=Slider(100, range=0..100), YCoordinate=Slider(30, range=0..30), ZCoordinate=Slider(29, range=0..30))
pt_2 = ConstructPoint(XCoordinate=Slider(100, range=0..100), YCoordinate=Slider(30, range=0..30), ZCoordinate=Slider(11, range=0..30))
crv = Curve(<curve referenced from the Rhino model>)
crv_2 = Curve(<curve referenced from the Rhino model>)
crv_3 = Curve(<curve referenced from the Rhino model>)
crv_4 = Curve(<curve referenced from the Rhino model>)
pt_3 = ConstructPoint(XCoordinate=Slider(80, range=0..80), YCoordinate=Slider(23, range=0..30), ZCoordinate=Slider(11, range=0..30))
end = EndPoints(Curve=crv)  # -> Start, End
end_2 = EndPoints(Curve=crv_3)  # -> Start, End
pt_4 = ConstructPoint(XCoordinate=Slider(80, range=0..100), YCoordinate=Slider(23, range=0..30), ZCoordinate=Slider(29, range=0..30))
pt_5 = ConstructPoint(XCoordinate=Slider(30, range=0..30), YCoordinate=Slider(30, range=0..30), ZCoordinate=Slider(19, range=0..30))
pt_6 = ConstructPoint(XCoordinate=Slider(60, range=0..60), YCoordinate=Slider(30, range=0..30), ZCoordinate=Slider(19, range=0..30))
pt_7 = Point(end.End)
pt_8 = Point(end_2.End)
pt_9 = Point(end.Start)
pt_10 = Point(end_2.Start)
pt_11 = Point([pt_9, pt_7, pt_10, pt_8, pt, pt_4, pt_3, pt_2])
panel = Panel(pt_8)
pline = PolyLine(Vertices=[pt_2, pt_3, pt_4, pt], Closed=Toggle(True))
crv_5 = Curve([crv, crv_4, crv_3, crv_2])
edgesrf = EdgeSurface(CurveA=crv, CurveB=crv_2, CurveC=crv_3, CurveD=crv_4)
nurbs = NurbsCurve(Vertices=[pt_5, pt_6, pt_3], Degree=3, Periodic=False)  # -> Curve, Length, Domain
explode = Explode(Curve=pline, Recursive=True)  # -> Segments, Vertices
len = Length()
swp1 = Sweep1(Rail=nurbs.Curve, Sections=[edgesrf, pline], Miter=1)
item = ListItem(List=explode.Vertices, Index=Slider(3, range=0..4), Wrap=True)
item_2 = ListItem(List=crv_5, Index=Slider(0, range=0..5), Wrap=True)
debrep = DeconstructBrep(Brep=edgesrf)  # -> Faces, Edges, Vertices
cap = CapHoles(Brep=swp1)
panel_2 = Panel(len)
item_3 = ListItem(List=pt_11, Index=Slider(7, range=0..8), Wrap=True)
debrep_2 = DeconstructBrep(Brep=cap)  # -> Faces, Edges, Vertices
item_4 = ListItem(Index=0, Wrap=True)
mesh_crazy_geometry = MeshingBrep(
    Brep=cap,
    Point=pt_11,
    UCount=Slider(3, range=0..6),
    VCount=Slider(3, range=0..6),
    WCount=Slider(10, range=0..10),
    Curves=crv_5)  # -> Mesh, Curve, Surface
item_5 = ListItem(List=debrep_2.Faces, Index=Slider(0, range=0..12), Wrap=True)
deconstruct_meshcbrep = DeconstructMesh(Mesh=mesh_crazy_geometry.Mesh)  # -> ElementVertices, Connectivity, Edges, Surfaces, Points, Nodes, Elements
item_6 = ListItem(List=mesh_crazy_geometry.Surface, Index=Slider(0, range=0..12), Wrap=True)
debrep_3 = DeconstructBrep(Brep=item_5)  # -> Faces, Edges, Vertices
area = Area(Geometry=item_5)  # -> Area, Centroid
panel_3 = Panel(debrep_3.Vertices)
crv_6 = Curve(item_6)
panel_4 = Panel(deconstruct_meshcbrep.ElementVertices)
branch = TreeBranch(Tree=simplify(deconstruct_meshcbrep.ElementVertices), Path=Slider(50, range=0..50), MaintainPaths=True)
brep = Brep(<brep referenced from the Rhino model>)
Z = UnitZ(Factor="0")
Z_2 = UnitZ(Factor="-10")
predef = PreDef(Sphere=brep, PrescribedDeformations=Z, Mesh=mesh_crazy_geometry.Mesh)  # -> PrescribedDeformations, Text, Plane, Colors
unibc = UniformBCComponentForFEA(SurfaceNumber=Slider(4, range=0..6), Mesh=mesh_crazy_geometry.Mesh)  # -> BCPoints, BCCones, ColoringForBCCones
unibc_2 = UniformBCComponentForFEA(SurfaceNumber=Slider(5, range=0..6), Mesh=mesh_crazy_geometry.Mesh)  # -> BCPoints, BCCones, ColoringForBCCones
uniloads = UniformLoadComponentForFEA(SurfaceNumber=Slider(0, range=0..5), LoadVector=Z_2, Mesh=mesh_crazy_geometry.Mesh)  # -> PointLoads, LoadArrows, ArrowColoring
material = CreateMaterial(EModulus="210000", PRatio="0.3")
femeshtbrep = FiniteElementOfMeshedTBrep(
    Mesh=mesh_crazy_geometry.Mesh,
    BoundaryConditions=[unibc.BCPoints, unibc_2.BCPoints],
    PointLoads=uniloads.PointLoads,
    PreDeformations=predef.PrescribedDeformations,
    Brep=cap,
    Material=material)  # -> Disp, Strain, Stress, N, Text, Size, Plane, Color_T, Nodes
viewdef = ViewDeformations(Mesh=mesh_crazy_geometry.Mesh, Displacement=femeshtbrep.Disp, Scaling=Slider(0, range=0..1000))  # -> BrepSolid, ColorSolid, BrepOuterEdges, ColorEdges, Text, Size, Plane, ColorT
panel_5 = Panel(femeshtbrep.Disp)
