# Grasshopper definition ClampedCantileverWithVaryingCrossSection.gh (Grasshopper 1.0.7)
# plug-ins: SolidsVR

number_slider = Slider(1000, range=0..1000)
number_slider_2 = Slider(-250, range=-500..1500)
number_slider_3 = Slider(1250, range=0..1500)
pt = ConstructPoint(XCoordinate=number_slider_2, YCoordinate=0, ZCoordinate=0)
pt_2 = ConstructPoint(XCoordinate=Slider(1250, range=0..1500), YCoordinate=0, ZCoordinate=0)
pt_3 = ConstructPoint(XCoordinate=number_slider_3, YCoordinate=number_slider_3, ZCoordinate=0)
pt_4 = ConstructPoint(XCoordinate=number_slider_2, YCoordinate=Slider(1000, range=0..1000), ZCoordinate=0)
pt_5 = ConstructPoint(XCoordinate=Slider(-1000, range=-1000..2000), YCoordinate=0, ZCoordinate=number_slider)
pt_6 = ConstructPoint(XCoordinate=Slider(2000, range=-1000..2000), YCoordinate=0, ZCoordinate=number_slider)
pt_7 = ConstructPoint(XCoordinate=Slider(2000, range=-1000..2000), YCoordinate=Slider(1000, range=-1000..2000), ZCoordinate=number_slider)
pt_8 = ConstructPoint(XCoordinate=Slider(-1000, range=-1000..2000), YCoordinate=Slider(1000, range=-1000..2000), ZCoordinate=number_slider)
pt_9 = Point([pt, pt_2, pt_3, pt_4, pt_5, pt_6, pt_7, pt_8])
p2b = PointsToBrep(Points=pt_9)
meshcbrep = MeshCBrep(
    Brep=p2b,
    Point=pt_9,
    UCount=Slider(6, range=0..10),
    VCount=Slider(6, range=0..10),
    WCount=Slider(6, range=0..10),
    VolumeToRemove=Slider(30, range=0..30))
sph = Sphere(Base="9999,9999,9999", Radius=1)
deconstruct_meshcbrep = DeconstructMesh(Mesh=meshcbrep)  # -> ElementVertices, Connectivity, Edges, Surfaces, Points, Nodes, Elements
unibc = UniformBCComponentForFEA(SurfaceNumber=Slider(3, range=0..5), Mesh=meshcbrep)  # -> BCPoints, BCCones, ColoringForBCCones
unibc_2 = UniformBCComponentForFEA(SurfaceNumber=Slider(1, range=0..5), Mesh=meshcbrep)  # -> BCPoints, BCCones, ColoringForBCCones
uniloads = UniformLoadComponentForFEA(SurfaceNumber=Slider(5, range=0..5), LoadVector="0,0,-10", Mesh=meshcbrep)  # -> PointLoads, LoadArrows, ArrowColoring
predef = PreDef(Sphere=sph, PrescribedDeformations="0,0,0", Mesh=meshcbrep)  # -> PrescribedDeformations, Text, Plane, Colors
material = CreateMaterial(EModulus="210000", PRatio="0.3", YieldStress="355")
topopt = TopOpt(
    Mesh=meshcbrep,
    BoundaryConditions=[unibc.BCPoints, unibc_2.BCPoints],
    PointLoads=uniloads.PointLoads,
    PreDeformations=predef.PrescribedDeformations,
    Material=material)  # -> Displacement, Strain, Stress, Text, Size, Plane, ColorT
viewdef = ViewDeformations(Mesh=meshcbrep, Displacement=topopt.Displacement, Scaling=Slider(1000, range=0..1000))  # -> BrepSolid, ColorSolid, BrepOuterEdges, ColorEdges, Text, Size, Plane, ColorT
