# Grasshopper definition Top_Cantilever_differentCrossSections.gh (Grasshopper 1.0.7)
# plug-ins: SolidsVR

number_slider = Slider(600, range=0..600)
number_slider_2 = Slider(1000, range=0..1000)
number_slider_3 = Slider(100, range=0..100)
number_slider_4 = Slider(500, range=0..600)
pt = ConstructPoint(XCoordinate=0, YCoordinate=number_slider_3, ZCoordinate=0)
pt_2 = ConstructPoint(XCoordinate=number_slider_2, YCoordinate=number_slider_3, ZCoordinate=number_slider_4)
pt_3 = ConstructPoint(XCoordinate=0, YCoordinate=0, ZCoordinate=number_slider)
pt_4 = ConstructPoint(XCoordinate=0, YCoordinate=0, ZCoordinate=0)
pt_5 = ConstructPoint(XCoordinate=number_slider_2, YCoordinate=0, ZCoordinate=number_slider_4)
pt_6 = ConstructPoint(XCoordinate=number_slider_2, YCoordinate=0, ZCoordinate=number_slider)
pt_7 = ConstructPoint(XCoordinate=number_slider_2, YCoordinate=number_slider_3, ZCoordinate=number_slider)
pt_8 = ConstructPoint(XCoordinate=0, YCoordinate=number_slider_3, ZCoordinate=number_slider)
pt_9 = Point([pt_4, pt_5, pt_2, pt, pt_3, pt_6, pt_7, pt_8])
sph = Sphere(Base=PlaneXY(0, 0, 0), Radius=1)
move = Move(Geometry=sph, Motion="999,999,999")  # -> Geometry, Transform
Z = UnitZ(Factor="-10")
p2b = PointsToBrep(Points=pt_9)
vec = VectorXYZ(XComponent=0, YComponent=0, ZComponent=Slider(0, range=0..100))  # -> Vector, Length
meshcbrep = MeshCBrep(
    Brep=p2b,
    Point=pt_9,
    UCount=Slider(10, range=0..10),
    VCount=Slider(4, range=0..20),
    WCount=Slider(8, range=0..10),
    VolumeToRemove=Slider(30, range=0..30))
uniloads = UniformLoadComponentForFEA(SurfaceNumber=Slider(5, range=0..5), LoadVector=Z, Mesh=meshcbrep)  # -> PointLoads, LoadArrows, ArrowColoring
unibc = UniformBCComponentForFEA(Surface=Slider(3, range=0..5), UCount=meshcbrep)  # -> BCPoints, BCCones, ColoringForBCCones
predef = PreDef(Points=move.Geometry, PrescribedDeformations=vec.Vector, Mesh=meshcbrep)  # -> PrescribedDeformations, Text, Plane, Colors
deconstruct_meshcbrep = DeconstructMesh(Mesh=meshcbrep)  # -> ElementVertices, Connectivity, Edges, Surfaces, Points, Nodes, Elements
material = CreateMaterial(EModulus="10000", PRatio="0.3", YieldStress="255")
topopt = TopOpt(
    Mesh=meshcbrep,
    BoundaryConditions=unibc.BCPoints,
    PointLoads=uniloads.PointLoads,
    PreDeformations=predef.PrescribedDeformations,
    Material=material)  # -> Disp, Strain, Stress, N, Text, Size, Plane, Color_T, Nodes
viewdef = ViewDeformations(Mesh=meshcbrep, Displacement=topopt.Disp, Scaling=Slider(3, range=0..100))  # -> BrepSolid, ColorSolid, BrepOuterEdges, ColorEdges, Text, Size, Plane, ColorT
panel = Panel(topopt.Stress)
