# Grasshopper definition VR_geometry_case4.gh (Grasshopper 1.0.7)
# plug-ins: MindeskText, SolidsVR, MDSKGrasshopper

# ----
# Cross Section 1
crv = Curve(<curve referenced from the Rhino model>)
crv_2 = Curve(<curve referenced from the Rhino model>)
crv_3 = Curve(<curve referenced from the Rhino model>)
crv_4 = Curve(<curve referenced from the Rhino model>)
edgesrf = EdgeSurface(CurveA=crv, CurveB=crv_3, CurveC=crv_2, CurveD=crv_4)

crv_5 = Curve(<curve referenced from the Rhino model>)
# Cross Section 2
crv_6 = Curve(<curve referenced from the Rhino model>)
crv_7 = Curve(<curve referenced from the Rhino model>)
crv_8 = Curve(<curve referenced from the Rhino model>)
edgesrf_2 = EdgeSurface(CurveA=crv_6, CurveB=crv_5, CurveC=crv_7, CurveD=crv_8)

# ----
# RAIL
crv_9 = Curve(<curve referenced from the Rhino model>)

swp1 = Sweep1(Rail=crv_9, Sections=[edgesrf, edgesrf_2], Miter=1)
# GEOMETRY
join = BrepJoin(Breps=flatten([swp1, edgesrf, edgesrf_2]))  # -> Breps, Closed
debrep = DeconstructBrep(Brep=join.Breps)  # -> Faces, Edges, Vertices
# CONTROL POINTS
item = ListItem(List=debrep.Vertices, Index=0, Wrap=True)  # -> Item, Item1, Item2, Item3, Item4, Item5, Item6, Item7
pt = Point([item.Item2, item.Item3, item.Item, item.Item1, item.Item6, item.Item7, item.Item4, item.Item5])

# ----
# CASE 1 HEXAHEDRON
# PRE-PROCESSING
preview_toggle = BooleanToggle(True)
mdsk = MDSK(Geometry=join.Breps, Color=RGB(255, 255, 255), Start=preview_toggle)

curve = Curve(<curve referenced from the Rhino model>)
curve_2 = Curve([<curve referenced from the Rhino model> x3])
volumepercentageslider = VolumePercentageSlider(SliderVR=curve, Brep=join.Breps)  # -> VolumePercentage, Text, Size, Plane, Color, Geometry
divslider = DivisionSlider(SliderVR=curve_2, Geometry=join.Breps)  # -> UCount, VCount, WCount, Text, Size, Plane, Colors, Geometry
# MESHING
divslider_2 = DivisionSlider()  # -> MeshDivisionU, MeshDivisionV, MeshDivisionW, Text, Size, Plane, Colors, Geometry
mdsk_geometry = MDSK(Geometry=divslider.Geometry, Color=divslider.Colors, Start=preview_toggle)
mdsk_text = VRTEXT(Text=divslider.Text, Size=divslider.Size, Plane=divslider.Plane, Color=divslider.Colors, Start=preview_toggle)
mdsk_2 = MDSK(Geometry=volumepercentageslider.Geometry, Color=volumepercentageslider.Color, Start=False)
meshcbrep = MeshCBrep(
    Brep=join.Breps,
    Point=pt,
    UCount=divslider.UCount,
    VCount=divslider.VCount,
    WCount=divslider.WCount,
    VolumeToRemove=volumepercentageslider.VolumePercentage)

mdsk_text_2 = VRTEXT(
    Text=volumepercentageslider.Text,
    Size=volumepercentageslider.Size,
    Plane=volumepercentageslider.Plane,
    Color=volumepercentageslider.Color,
    Start=preview_toggle)

surface_slider = Curve(<curve referenced from the Rhino model>)
load_slider = Curve(<curve referenced from the Rhino model>)
surfslider = SurfaceSlider(SliderVR=surface_slider, Geometry=join.Breps)  # -> SurfaceNumber, Text, Size, Plane, Colors, Geometry
loadslider = LoadSlider(SliderVR=load_slider)  # -> Load, Text, Size, Plane, Colors, Geometry
# LOADS
mdsk_text_3 = VRTEXT(Text=surfslider.Text, Size=surfslider.Size, Plane=surfslider.Plane, Color=surfslider.Colors, Start=preview_toggle)
mdsk_text_4 = VRTEXT(Text=loadslider.Text, Size=loadslider.Size, Plane=loadslider.Plane, Color=loadslider.Colors, Start=preview_toggle)
mdsk_geometry_2 = MDSK(Geometry=loadslider.Geometry, Color=loadslider.Colors, Start=preview_toggle)
mdsk_geometry_3 = MDSK(Geometry=surfslider.Geometry, Color=surfslider.Colors, Start=preview_toggle)
uniloads = UniformLoadComponentForFEA(SurfaceNumber=surfslider.SurfaceNumber, LoadVector=loadslider.Load, Mesh=meshcbrep)  # -> PointLoads, LoadArrows, ArrowColoring
mdsk_geometry_4 = MDSK(Geometry=uniloads.LoadArrows, Color=uniloads.ArrowColoring, Start=preview_toggle)

surface_slider_2 = Curve(<curve referenced from the Rhino model>)
# ANALYZING
surfslider_2 = SurfaceSlider(SliderVR=surface_slider_2, Geometry=join.Breps)  # -> SurfaceNumber, Text, Size, Plane, Colors, Geometry
# BC
mdsk_text_5 = VRTEXT(
    Text=surfslider_2.Text,
    Size=surfslider_2.Size,
    Plane=surfslider_2.Plane,
    Color=surfslider_2.Colors,
    Start=preview_toggle)
mdsk_geometry_5 = MDSK(Geometry=surfslider_2.Geometry, Color=surfslider_2.Colors, Start=preview_toggle)
unibc = SetUniBC(SurfaceNumber=surfslider_2.SurfaceNumber, Mesh=meshcbrep)  # -> BoundaryConditions, Geometry, Color
# POST-PROCESSING
mdsk_geometry_6 = MDSK(Geometry=unibc.Geometry, Color=unibc.Color, Start=preview_toggle)

# ----
# MATERIAL
panel = Panel("210000")
material = CreateMaterial(EModulus=panel, PRatio="0.3", YieldStress="255")

headline_curves = Curve([<curve referenced from the Rhino model> x3])
# VR HEADLINES
headline = HeadLine(Curves=headline_curves, Mesh=meshcbrep)  # -> Text, Size, Plane, Colors
mdsk_text_6 = VRTEXT(Text=headline.Text, Size=headline.Size, Plane=headline.Plane, Color=headline.Colors, Start=preview_toggle)

predef_slider = Curve(<curve referenced from the Rhino model>)
predefslider = PreDefSlider(SliderVR=predef_slider, Geoemtry=join.Breps)  # -> PrescribedDeformation, Text, Size, Plane, Colors, Geometry
# PREDEF
mdsk_text_7 = VRTEXT(
    Text=predefslider.Text,
    Size=predefslider.Size,
    Plane=predefslider.Plane,
    Color=predefslider.Colors,
    Start=preview_toggle)
mdsk_geometry_7 = MDSK(Geometry=predefslider.Geometry, Color=predefslider.Colors, Start=preview_toggle)
predef_sphere = Brep(<brep referenced from the Rhino model>)

predef = PreDef(Sphere=predef_sphere, PrescribedDeformations=predefslider.PrescribedDeformation, Mesh=meshcbrep)  # -> PrescribedDeformations, Text, Size, Plane, Colors

mdsk_text_8 = VRTEXT(Text=predef.Text, Size=predef.Size, Plane=predef.Plane, Color=predef.Colors, Start=preview_toggle)

# ----
# ANALYZE
femsolver = FEMSolver(
    Mesh=meshcbrep,
    BoundaryConditions=unibc.BoundaryConditions,
    PointLoads=uniloads.PointLoads,
    PreDeformations=predef.PrescribedDeformations,
    Material=material)  # -> Displacement, Strain, Stress, Text, Size, Plane, ColorT
mdsk_text_9 = VRTEXT(Text=femsolver.Text, Size=femsolver.Size, Plane=femsolver.Plane, Color=femsolver.ColorT, Start=preview_toggle)

scale_slider = Curve(<curve referenced from the Rhino model>)
# DEFORMATION VR PREVIEW
defslider = DeformationSlider(SliderVR=scale_slider)  # -> Scale, Text, Size, Plane, Colors, Geometry
# STRESS VR PREVIEW
mdsk_geometry_8 = MDSK(Geometry=defslider.Geometry, Color=defslider.Colors, Start=preview_toggle)
mdsk_text_10 = VRTEXT(Text=defslider.Text, Size=defslider.Size, Plane=defslider.Plane, Color=defslider.Colors, Start=preview_toggle)
viewdef = ViewDeformations(Mesh=meshcbrep, Displacement=femsolver.Displacement, Scaling=defslider.Scale)  # -> BrepSolid, ColorSolid, BrepOuterEdges, ColorEdges, Text, Size, Plane, ColorT
mdsk_geometry_9 = MDSK(Geometry=viewdef.BrepSolid, Color=viewdef.ColorSolid, Start=preview_toggle)
mdsk_geometry_10 = MDSK(Geometry=viewdef.BrepOuterEdges, Color=viewdef.ColorEdges, Start=preview_toggle)
mdsk_text_11 = VRTEXT(Text=viewdef.Text, Size=viewdef.Size, Plane=viewdef.Plane, Color=viewdef.ColorT, Start=preview_toggle)

stress_direction_slider = Curve(<curve referenced from the Rhino model>)
stressslider = StressDirectionSlider(SliderVR=stress_direction_slider)  # -> StressDirection, Text, Size, Plane, Color, Geometry
mdsk_text_12 = VRTEXT(Text=stressslider.Text, Size=stressslider.Size, Plane=stressslider.Plane, Color=stressslider.Color, Start=preview_toggle)
mdsk_geometry_11 = MDSK(Geometry=stressslider.Geometry, Color=stressslider.Color, Start=preview_toggle)
viewstress = ViewStresses(Mesh=meshcbrep, Stress=femsolver.Stress, StressDirection=stressslider.StressDirection, Scaling=defslider.Scale)  # -> Solid, Color_solid, Legend, Color_legend, Text, Size, Plane, Color_T
mdsk_geometry_12 = MDSK(Geometry=viewstress.Solid, Color=viewstress.Color_solid, Start=preview_toggle)
mdsk_geometry_13 = MDSK(Geometry=viewstress.Legend, Color=viewstress.Color_legend, Start=preview_toggle)
mdsk_text_13 = VRTEXT(Text=viewstress.Text, Size=viewstress.Size, Plane=viewstress.Plane, Color=viewstress.Color_T, Start=preview_toggle)

node_info_sphere = Brep(<brep referenced from the Rhino model>)

# ----
# NODE VR INFO
nodeinfo = NodeInfo(Sphere=node_info_sphere, Mesh=meshcbrep)  # -> Text, Size, Plane, Colors, TextSphere, Size_2, PlaneSphere

mdsk_text_14 = VRTEXT(Text=nodeinfo.TextSphere, Size=nodeinfo.Size_2, Plane=nodeinfo.PlaneSphere, Color=nodeinfo.Colors, Start=preview_toggle)
mdsk_text_15 = VRTEXT(Text=nodeinfo.Text, Size=nodeinfo.Size, Plane=nodeinfo.Plane, Color=nodeinfo.Colors, Start=preview_toggle)
