# Grasshopper definition case3_shell_gh.gh (Grasshopper 1.0.7)
# plug-ins: MindeskText, SolidsVR, MDSKGrasshopper

side_thickness = Slider(64, range=0..200)
# INPUT CURVES
crv = Curve([<curve referenced from the Rhino model> x3])
# THICKNESS OF SHELL
height_thickness = Slider(200, range=0..300)
Z = UnitZ(Factor=height_thickness)
end = EndPoints(Curve=crv)  # -> Start, End
X = UnitX(Factor=side_thickness)
cp = ControlPoints(Curve=crv)  # -> Points, Weights, Knots
neg = Negative(Value=Z)
move = Move(Geometry=cp.Points, Motion=neg)  # -> Geometry, Transform
neg_2 = Negative(Value=X)
move_2 = Move(Geometry=end.End, Motion=neg_2)  # -> graft(Geometry), Transform
item = ListItem(List=move.Geometry, Index=0, Wrap=True)  # -> Item, Item1, Item2, Item3, Item4
move_3 = Move(Geometry=end.Start, Motion=X)  # -> graft(Geometry), Transform
ln = Line(StartPoint=flatten(move_3.Geometry), EndPoint=end.Start)
ln_2 = Line(StartPoint=flatten(move_2.Geometry), EndPoint=end.End)
pt = Point([move_3.Geometry, item.Item1, item.Item2, item.Item3, move_2.Geometry])
nurbs = NurbsCurve(Vertices=pt, Degree=3, Periodic=False)  # -> Curve, Length, Domain

# ---- group: Lofted geometry
# CREATION OF GEOMETRY
loft = Loft(Curves=crv, Options={Adjust=False, Closed=False, LoftEnds=0, LoftSimp=0, LoftType=0, Rebuild=10, Refit=0.01})
loft_2 = Loft(
    Curves=flatten(nurbs.Curve),
    Options={Adjust=False, Closed=False, LoftEnds=0, LoftSimp=0, LoftType=0, Rebuild=10, Refit=0.01})

# ----
upper = DeconstructBrep(Brep=loft)  # -> Faces, Edges, Vertices

# ---- group: lower
debrep = DeconstructBrep(Brep=loft_2)  # -> Faces, Edges, Vertices

# ----
item_2 = ListItem(List=upper.Edges, Index=0, Wrap=True)  # -> Item, Item1, Item2, Item3
item_3 = ListItem(List=debrep.Edges, Index=0, Wrap=True)  # -> Item, Item1, Item2, Item3
item_4 = ListItem(List=ln, Index=0, Wrap=True)  # -> Item, Item1, Item2
item_5 = ListItem(List=ln_2, Index=0, Wrap=True)  # -> Item, Item1, Item2
pt_2 = Point(flatten([end.Start, end.End, move_2.Geometry, move_3.Geometry]))

# ---- group: Additional surfaces
crv_back_upper = Curve(item_2.Item1)
crv_right_upper = Curve(item_2.Item2)
crv_front_upper = Curve(item_2.Item3)
crv_left_lower = Curve(item_3.Item)
crv_back_lower = Curve(item_3.Item1)
crv_right_lower = Curve(item_3.Item2)
crv_front_lower = Curve(item_3.Item3)
crv_back_left = Curve(item_4.Item2)
crv_front_right = Curve(item_5.Item)
crv_left_upper = Curve(item_2.Item)
crv_front_left = Curve(item_4.Item)
crv_back_right = Curve(item_5.Item2)
edgesrf = EdgeSurface(CurveA=crv_front_upper, CurveB=crv_front_lower, CurveC=crv_front_left, CurveD=crv_front_right)
edgesrf_2 = EdgeSurface(CurveA=crv_back_upper, CurveB=crv_back_lower, CurveC=crv_back_left, CurveD=crv_back_right)
edgesrf_3 = EdgeSurface(CurveA=crv_left_upper, CurveB=crv_front_left, CurveC=crv_left_lower, CurveD=crv_back_left)
edgesrf_4 = EdgeSurface(CurveA=crv_right_upper, CurveB=crv_front_right, CurveC=crv_right_lower, CurveD=crv_back_right)

# ----
item_6 = ListItem(List=pt_2, Index=0, Wrap=True)  # -> Item, Item1, Item2, Item3, Item4, Item5, Item6, Item7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
# FINISHED GEOMETRY
join = BrepJoin(Breps=flatten([loft, loft_2, edgesrf, edgesrf_2, edgesrf_3, edgesrf_4]))  # -> Breps, Closed
# CONTROL POINTS
pt_3 = Point([item_6.Item, item_6.Item7, item_6.Item11, item_6.Item2, item_6.Item3, item_6.Item6, item_6.Item10, item_6.Item5])
# MESHING
meshsbrep = MeshSBrep(
    Brep=join.Breps,
    Point=pt_3,
    UCount=Slider(1, range=0..10),
    VCount=Slider(20, range=0..50),
    WCount=Slider(20, range=0..50),
    VolumeToRemove=0)
deconstruct_meshcbrep = DeconstructMesh(Mesh=meshsbrep)  # -> ElementVertices, Connectivity, Edges, Surfaces, Points, Nodes, Elements, Surfaces_2
Z_2 = UnitZ(Factor=Slider(-2, range=-10..10))
# PREDEF
sph = Sphere(Base="9999,9999,9999", Radius=1)
# MATERIAL
panel = Panel("210000")
# FEA
# BC
unibc = UniformBCComponentForFEA(SurfaceNumber=Slider(4, range=0..5), Mesh=meshsbrep)  # -> BCPoints, BCCones, ColoringForBCCones
# LOAD
uniloads = UniformLoadComponentForFEA(SurfaceNumber=Slider(3, range=0..5), LoadVector=Z_2, Mesh=meshsbrep)  # -> PointLoads, LoadArrows, ArrowColoring
unibc_2 = UniformBCComponentForFEA(SurfaceNumber=Slider(5, range=0..5), Mesh=meshsbrep)  # -> BCPoints, BCCones, ColoringForBCCones
predef = PreDef(Sphere=sph, PrescribedDeformations="0,0,0", Mesh=meshsbrep)  # -> PrescribedDeformations, Text, Plane, Colors, Colors_2
material = CreateMaterial(EModulus=panel, PRatio="0.3", YieldStress="355")
mdsk = MDSK(Geometry=uniloads.LoadArrows, Color=uniloads.ArrowColoring, Start=Toggle(False))
# CALCULATION
topopt = TopOpt(
    Mesh=meshsbrep,
    BoundaryConditions=[unibc.BCPoints, unibc_2.BCPoints],
    PointLoads=uniloads.PointLoads,
    PreDeformations=predef.PrescribedDeformations,
    Material=material)  # -> Displacement, Strain, Stress, Text, Size, Plane, ColorT
# VIEW STRESSES
number_slider = Slider(6, range=0..6)
number_slider_2 = Slider(9, range=0..1000)
# VIEW DEFORMATIONS
viewdef = ViewDeformations(Mesh=meshsbrep, Displacement=topopt.Displacement, Scaling=number_slider_2)  # -> BrepSolid, ColorSolid, BrepOuterEdges, ColorEdges, Text, Size, Plane, ColorT
toggle = BooleanToggle(True)
viewstress = ViewStresses(Mesh=meshsbrep, Stress=topopt.Stress, StressDirection=number_slider, Scaling=number_slider_2)  # -> Solid, Color_solid, Legend, Color_legend, Text, Size, Plane, Color_T
flip_plane = FlipPlane(Plane=viewstress.Plane, ReverseX=False, ReverseY=False, SwapAxes=True)
flip = Flip(Surface=viewstress.Plane)  # -> Surface, Result
mdsk_geometry = MDSK(Geometry=viewstress.Solid, Color=viewstress.Color_solid, Start=toggle)
cull_index = CullIndex(List=viewstress.Text, Indices="15", Wrap=True)
mdsk_geometry_2 = MDSK(Geometry=viewstress.Legend, Color=viewstress.Color_legend, Start=toggle)
deconstruct_plane = DeconstructPlane(Plane=viewstress.Plane)  # -> Origin, XAxis, YAxis, ZAxis
panel_2 = Panel(viewstress.Text)
panel_3 = Panel(flip_plane)
xy_plane = XYPlane(Origin=Point(0, 0, 0))
xz_plane = XZPlane(Origin=Point(0, 0, 0))
plane = Plane()
panel_4 = Panel(viewstress.Plane)
plane_origin = PlaneOrigin(Base=xz_plane, Origin=deconstruct_plane.Origin)
mdsk_text = VRTEXT(Text=cull_index, Size=viewstress.Size, Plane=plane_origin, Color=viewstress.Color_T, Start=toggle)
panel_5 = Panel(plane_origin)
