# Grasshopper definition Case4_Grasshopper.gh (Grasshopper 1.0.7)
# plug-ins: MindeskText, SolidsVR, MDSKGrasshopper

curve = Curve(<curve referenced from the Rhino model>)
curve_2 = Curve(<curve referenced from the Rhino model>)
curve_3 = Curve(<curve referenced from the Rhino model>)
# Cross Section 1
curve_4 = Curve(<curve referenced from the Rhino model>)
edge_surface = EdgeSurface(CurveA=curve_4, CurveB=curve, CurveC=curve_2, CurveD=curve_3)

# ----
# Cross Section 2
curve_5 = Curve(<curve referenced from the Rhino model>)
curve_6 = Curve(<curve referenced from the Rhino model>)
curve_7 = Curve(<curve referenced from the Rhino model>)
curve_8 = Curve(<curve referenced from the Rhino model>)
edge_surface_2 = EdgeSurface(CurveA=curve_5, CurveB=curve_6, CurveC=curve_7, CurveD=curve_8)

# ----
# RAIL
curve_9 = Curve(<curve referenced from the Rhino model>)
# CASE 4: ITERATIVE REMOVAL OF ELMENTS
# PRE-PROCESSING
# TURN ON VR-DISPLAY
preview_toggle = BooleanToggle(True)

# ----
# GEOMETRY
sweep1 = Sweep1(Rail=curve_9, Sections=[edge_surface, edge_surface_2], Miter=1)
brep_join = BrepJoin(Breps=flatten([sweep1, edge_surface, edge_surface_2]))  # -> Breps, Closed
deconstruct_brep = DeconstructBrep(Brep=brep_join.Breps)  # -> Faces, Edges, Vertices
mdsk = MDSK(Geometry=brep_join.Breps, Color=RGB(255, 255, 255), Start=preview_toggle)

# ----
# CONTROL POINTS
list_item = ListItem(List=deconstruct_brep.Vertices, Index=0, Wrap=True)  # -> Item, Item1, Item2, Item3, Item4, Item5, Item6, Item7
point = Point([list_item.Item2, list_item.Item3, list_item.Item, list_item.Item1, list_item.Item6, list_item.Item7, list_item.Item4, list_item.Item5])

curve_10 = Curve([<curve referenced from the Rhino model> x3])
curve_11 = Curve(<curve referenced from the Rhino model>)
# MESHING
divisionslider = DivisionSlider(SliderVR=curve_10, Geometry=brep_join.Breps)  # -> UCount, VCount, WCount, Text, Size, Plane, Colors, Geometry
volumepercentageslider = VolumePercentageSlider(SliderVR=curve_11, Brep=brep_join.Breps)  # -> VolumePercentage, Text, Size, Plane, Color, Geometry
mdsk_2 = MDSK(Geometry=divisionslider.Geometry, Color=divisionslider.Colors, Start=preview_toggle)
mdsk_3 = MDSK(Geometry=volumepercentageslider.Geometry, Color=volumepercentageslider.Color, Start=preview_toggle)
vr_text = VRTEXT(
    Text=divisionslider.Text,
    Size=divisionslider.Size,
    Plane=divisionslider.Plane,
    Color=divisionslider.Colors,
    Start=preview_toggle)
meshsurface = MeshSurface(
    Geometry=brep_join.Breps,
    Point=point,
    UCount=divisionslider.UCount,
    VCount=divisionslider.VCount,
    WCount=divisionslider.WCount,
    VolumeToRemove=volumepercentageslider.VolumePercentage)

vr_text_2 = VRTEXT(
    Text=volumepercentageslider.Text,
    Size=volumepercentageslider.Size,
    Plane=volumepercentageslider.Plane,
    Color=volumepercentageslider.Color,
    Start=preview_toggle)

surface_slider = Curve(<curve referenced from the Rhino model>)
load_slider = Curve(<curve referenced from the Rhino model>)
surfaceslider = SurfaceSlider(SliderVR=surface_slider, Geometry=brep_join.Breps)  # -> SurfaceNumber, Text, Size, Plane, Colors, Geometry
loadslider = LoadSlider(SliderVR=load_slider, Geometry=brep_join.Breps)  # -> Load, Text, Size, Plane, Colors, Geometry
# LOADS
vr_text_3 = VRTEXT(
    Text=surfaceslider.Text,
    Size=surfaceslider.Size,
    Plane=surfaceslider.Plane,
    Color=surfaceslider.Colors,
    Start=preview_toggle)
mdsk_4 = MDSK(Geometry=surfaceslider.Geometry, Color=surfaceslider.Colors, Start=preview_toggle)
vr_text_4 = VRTEXT(Text=loadslider.Text, Size=loadslider.Size, Plane=loadslider.Plane, Color=loadslider.Colors, Start=preview_toggle)
mdsk_5 = MDSK(Geometry=loadslider.Geometry, Color=loadslider.Colors, Start=preview_toggle)
uniloads = UniformLoadComponentForFEA(SurfaceNumber=surfaceslider.SurfaceNumber, LoadVector=loadslider.Load, Mesh=meshsurface)  # -> PointLoads, LoadArrows, ArrowColoring
mdsk_6 = MDSK(Geometry=uniloads.LoadArrows, Color=uniloads.ArrowColoring, Start=preview_toggle)

surface_slider_2 = Curve(<curve referenced from the Rhino model>)
surface_slider_3 = Curve(<curve referenced from the Rhino model>)
surfaceslider_2 = SurfaceSlider(SliderVR=surface_slider_3, Geometry=brep_join.Breps)  # -> SurfaceNumber, Text, Size, Plane, Colors, Geometry
surfaceslider_3 = SurfaceSlider(SliderVR=surface_slider_2, Geometry=brep_join.Breps)  # -> SurfaceNumber, Text, Size, Plane, Colors, Geometry
vr_text_5 = VRTEXT(
    Text=surfaceslider_2.Text,
    Size=surfaceslider_2.Size,
    Plane=surfaceslider_2.Plane,
    Color=surfaceslider_2.Colors,
    Start=preview_toggle)
mdsk_7 = MDSK(Geometry=surfaceslider_2.Geometry, Color=surfaceslider_2.Colors, Start=preview_toggle)
vr_text_6 = VRTEXT(
    Text=surfaceslider_3.Text,
    Size=surfaceslider_3.Size,
    Plane=surfaceslider_3.Plane,
    Color=surfaceslider_3.Colors,
    Start=preview_toggle)
mdsk_8 = MDSK(Geometry=surfaceslider_3.Geometry, Color=surfaceslider_3.Colors, Start=preview_toggle)
# BC
unibc = SetUniBC(SurfaceNumber=surfaceslider_2.SurfaceNumber, Mesh=meshsurface)  # -> BoundaryConditions, Geometry, Color
unibc_2 = SetUniBC(SurfaceNumber=surfaceslider_3.SurfaceNumber, Mesh=meshsurface)  # -> BoundaryConditions, Geometry, Color
mdsk_9 = MDSK(Geometry=unibc.Geometry, Color=unibc.Color, Start=preview_toggle)
mdsk_10 = MDSK(Geometry=unibc_2.Geometry, Color=unibc_2.Color, Start=preview_toggle)

# ----
# MATERIAL
panel = Panel("210000")
creatematerial = CreateMaterial(EModulus=panel, PRatio="0.3", YieldStress="355")

headline_curves = Curve([<curve referenced from the Rhino model> x3])
# VR HEADLINES
headline = HeadLine(Curves=headline_curves, Mesh=meshsurface)  # -> Text, Size, Plane, Colors
vr_text_7 = VRTEXT(Text=headline.Text, Size=headline.Size, Plane=headline.Plane, Color=headline.Colors, Start=preview_toggle)

predef_slider = Curve(<curve referenced from the Rhino model>)
predefslider = PreDefSlider(SliderVR=predef_slider, Geoemtry=brep_join.Breps)  # -> PrescribedDeformation, Text, Size, Plane, Colors, Geometry
vr_text_8 = VRTEXT(
    Text=predefslider.Text,
    Size=predefslider.Size,
    Plane=predefslider.Plane,
    Color=predefslider.Colors,
    Start=preview_toggle)
mdsk_11 = MDSK(Geometry=predefslider.Geometry, Color=predefslider.Colors, Start=preview_toggle)
# PREDEF
predef_sphere = Brep(<brep referenced from the Rhino model>)

predef = PreDef(Sphere=predef_sphere, PrescribedDeformations=predefslider.PrescribedDeformation, Mesh=meshsurface)  # -> PrescribedDeformations, Text, Size, Plane, Colors

vr_text_9 = VRTEXT(Text=predef.Text, Size=predef.Size, Plane=predef.Plane, Color=predef.Colors, Start=preview_toggle)

# ----
# ANALYZING
# ANALYZE
femsolver = FEMSolver(
    Mesh=meshsurface,
    BoundaryConditions=[unibc.BoundaryConditions, unibc_2.BoundaryConditions],
    PointLoads=uniloads.PointLoads,
    PreDeformations=predef.PrescribedDeformations,
    Material=creatematerial)  # -> Displacement, Strain, Stress, Text, Size, Plane, Colors
vr_text_10 = VRTEXT(Text=femsolver.Text, Size=femsolver.Size, Plane=femsolver.Plane, Color=femsolver.Colors, Start=preview_toggle)

scale_slider = Curve(<curve referenced from the Rhino model>)
# POST-PROCESSING
deformationslider = DeformationSlider(SliderVR=scale_slider, Geometry=brep_join.Breps)  # -> Scale, Text, Size, Plane, Colors, Geometry
# STRESS VR PREVIEW
mdsk_12 = MDSK(Geometry=deformationslider.Geometry, Color=deformationslider.Colors, Start=preview_toggle)
# DEFORMATION VR PREVIEW
vr_text_11 = VRTEXT(
    Text=deformationslider.Text,
    Size=deformationslider.Size,
    Plane=deformationslider.Plane,
    Color=deformationslider.Colors,
    Start=preview_toggle)
viewdeformations = ViewDeformations(Mesh=meshsurface, Displacement=femsolver.Displacement, Scaling=deformationslider.Scale)  # -> BrepSolid, ColorSolid, BrepOuterEdges, ColorEdges, Text, Size, Plane, ColorT
mdsk_13 = MDSK(Geometry=viewdeformations.BrepSolid, Color=viewdeformations.ColorSolid, Start=preview_toggle)
mdsk_14 = MDSK(Geometry=viewdeformations.BrepOuterEdges, Color=viewdeformations.ColorEdges, Start=preview_toggle)
vr_text_12 = VRTEXT(
    Text=viewdeformations.Text,
    Size=viewdeformations.Size,
    Plane=viewdeformations.Plane,
    Color=viewdeformations.ColorT,
    Start=preview_toggle)

stress_direction_slider = Curve(<curve referenced from the Rhino model>)
stressdirectionslider = StressDirectionSlider(SliderVR=stress_direction_slider, Geometry=brep_join.Breps)  # -> StressDirection, Text, Size, Plane, Color, Geometry
vr_text_13 = VRTEXT(
    Text=stressdirectionslider.Text,
    Size=stressdirectionslider.Size,
    Plane=stressdirectionslider.Plane,
    Color=stressdirectionslider.Color,
    Start=preview_toggle)
mdsk_15 = MDSK(Geometry=stressdirectionslider.Geometry, Color=stressdirectionslider.Color, Start=preview_toggle)
viewstresses = ViewStresses(
    Mesh=meshsurface,
    Stress=femsolver.Stress,
    StressDirection=stressdirectionslider.StressDirection,
    Scaling=deformationslider.Scale)  # -> BrepSolid, Colors, StressLegend, Colors_2, Text, Size, Plane, Colors_3
mdsk_16 = MDSK(Geometry=viewstresses.BrepSolid, Color=viewstresses.Colors, Start=preview_toggle)
mdsk_17 = MDSK(Geometry=viewstresses.StressLegend, Color=viewstresses.Colors_2, Start=preview_toggle)
vr_text_14 = VRTEXT(
    Text=viewstresses.Text,
    Size=viewstresses.Size,
    Plane=viewstresses.Plane,
    Color=viewstresses.Colors_3,
    Start=preview_toggle)

node_info_sphere = Brep(<brep referenced from the Rhino model>)

# ----
# NODE VR INFO
nodeinfo = NodeInfo(Sphere=node_info_sphere, Mesh=meshsurface)  # -> Text, Size, Plane, Colors, TextSphere, Size_2, PlaneSphere

vr_text_15 = VRTEXT(Text=nodeinfo.TextSphere, Size=nodeinfo.Size_2, Plane=nodeinfo.PlaneSphere, Color=nodeinfo.Colors, Start=preview_toggle)
vr_text_16 = VRTEXT(Text=nodeinfo.Text, Size=nodeinfo.Size, Plane=nodeinfo.Plane, Color=nodeinfo.Colors, Start=preview_toggle)
