# Grasshopper definition FixedStufff.gh (Grasshopper 1.0.7)

crv = Curve(<curve referenced from the Rhino model>)
crv_2 = Curve(<curve referenced from the Rhino model>)
crv_3 = Curve(<curve referenced from the Rhino model>)
crv_4 = Curve(<curve referenced from the Rhino model>)
crv_5 = Curve(<curve referenced from the Rhino model>)
edgesrf = EdgeSurface(CurveA=crv_4, CurveB=crv, CurveC=crv_3, CurveD=crv_2)
end = EndPoints(Curve=crv_3)  # -> Start, End
end_2 = EndPoints(Curve=crv_2)  # -> Start, End
pl_3pt = Plane3Pt(PointA=end.Start, PointB=end_2.Start, PointC=end_2.End)
frames = CurveFrames(Curve=crv_5, Count="1")  # -> Frames, Parameters
end_3 = EndPoints(Curve=crv_5)  # -> Start, End
area = Area(Geometry=edgesrf)  # -> Area, Centroid
item = ListItem(List=frames.Frames, Index=0, Wrap=True)  # -> Item, Item1
line = LineSDL(Start=end_3.Start, Direction=item.Item1, Length=Slider(100, range=0..100))
subtraction = Subtraction(A=end_3.Start, B=area.Centroid)
subtraction_2 = Subtraction(A=end_3.End, B=area.Centroid)

move = Move(Geometry=edgesrf, Motion=subtraction_2)  # -> Geometry, Transform
area_2 = Area(Geometry=move.Geometry)  # -> Area, Centroid
deplane = DeconstructPlane(Plane=item.Item1)  # -> Origin, XAxis, YAxis, ZAxis
pl_origin = PlaneOrigin(Base=pl_3pt, Origin=area_2.Centroid)
deplane_2 = DeconstructPlane(Plane=pl_origin)  # -> Origin, XAxis, YAxis, ZAxis
rotate = RotateDirection(Geometry=move.Geometry, Center=end_3.End, From=deplane_2.ZAxis, To=deplane.ZAxis)  # -> Geometry, Transform
rotate_2 = RotateDirection(Geometry=pl_origin, Center=end_3.End, From=deplane_2.ZAxis, To=deplane.ZAxis)  # -> Geometry, Transform
deplane_3 = DeconstructPlane(Plane=rotate_2.Geometry)  # -> Origin, XAxis, YAxis, ZAxis
rotate_3 = RotateDirection(Geometry=rotate_2.Geometry, Center=end_3.End, From=deplane_3.YAxis, To=deplane.YAxis)  # -> Geometry, Transform
rotate_4 = RotateDirection(Geometry=rotate.Geometry, Center=end_3.End, From=deplane_3.YAxis, To=deplane.YAxis)  # -> Geometry, Transform
deplane_4 = DeconstructPlane(Plane=rotate_3.Geometry)  # -> Origin, XAxis, YAxis, ZAxis
rotate_5 = RotateDirection(Geometry=rotate_4.Geometry, Center=end_3.End, From=deplane_4.XAxis, To=deplane.XAxis)  # -> Geometry, Transform
rotate_6 = RotateDirection(Geometry=rotate_3.Geometry, Center=end_3.End, From=deplane_4.XAxis, To=deplane.XAxis)  # -> Geometry, Transform
deplane_5 = DeconstructPlane(Plane=rotate_6.Geometry)  # -> Origin, XAxis, YAxis, ZAxis
rot3d = Rotate3D(Geometry=rotate_5.Geometry, Angle="pi/2", Center=end_3.End, Axis=deplane_5.YAxis)  # -> Geometry, Transform
rot3d_2 = Rotate3D(Geometry=rotate_6.Geometry, Angle="pi/2", Center=end_3.End, Axis=deplane_5.YAxis)  # -> Geometry, Transform
deplane_6 = DeconstructPlane(Plane=rot3d_2.Geometry)  # -> Origin, XAxis, YAxis, ZAxis
rot3d_3 = Rotate3D(Geometry=rot3d.Geometry, Angle="pi/2", Center=end_3.End, Axis=deplane_6.ZAxis)  # -> Geometry, Transform

move_2 = Move(Geometry=edgesrf, Motion=subtraction)  # -> Geometry, Transform
area_3 = Area(Geometry=move_2.Geometry)  # -> Area, Centroid
deplane_7 = DeconstructPlane(Plane=item.Item)  # -> Origin, XAxis, YAxis, ZAxis
pl_origin_2 = PlaneOrigin(Base=pl_3pt, Origin=area_3.Centroid)
deplane_8 = DeconstructPlane(Plane=pl_origin_2)  # -> Origin, XAxis, YAxis, ZAxis
rotate_7 = RotateDirection(Geometry=move_2.Geometry, Center=end_3.Start, From=deplane_8.ZAxis, To=deplane_7.ZAxis)  # -> Geometry, Transform
rotate_8 = RotateDirection(Geometry=pl_origin_2, Center=end_3.Start, From=deplane_8.ZAxis, To=deplane_7.ZAxis)  # -> Geometry, Transform
deplane_9 = DeconstructPlane(Plane=rotate_8.Geometry)  # -> Origin, XAxis, YAxis, ZAxis
rotate_9 = RotateDirection(Geometry=rotate_8.Geometry, Center=end_3.Start, From=deplane_9.YAxis, To=deplane_7.YAxis)  # -> Geometry, Transform
rotate_10 = RotateDirection(Geometry=rotate_7.Geometry, Center=end_3.Start, From=deplane_9.YAxis, To=deplane_7.YAxis)  # -> Geometry, Transform
deplane_10 = DeconstructPlane(Plane=rotate_9.Geometry)  # -> Origin, XAxis, YAxis, ZAxis
rotate_11 = RotateDirection(Geometry=rotate_10.Geometry, Center=end_3.Start, From=deplane_10.XAxis, To=deplane_7.XAxis)  # -> Geometry, Transform
rotate_12 = RotateDirection(Geometry=rotate_9.Geometry, Center=end_3.Start, From=deplane_10.XAxis, To=deplane_7.XAxis)  # -> Geometry, Transform
deplane_11 = DeconstructPlane(Plane=rotate_12.Geometry)  # -> Origin, XAxis, YAxis, ZAxis
rot3d_4 = Rotate3D(Geometry=rotate_11.Geometry, Angle="pi/2", Center=end_3.Start, Axis=deplane_11.YAxis)  # -> Geometry, Transform
rot3d_5 = Rotate3D(Geometry=rotate_12.Geometry, Angle="pi/2", Center=end_3.Start, Axis=deplane_11.YAxis)  # -> Geometry, Transform
deplane_12 = DeconstructPlane(Plane=rot3d_5.Geometry)  # -> Origin, XAxis, YAxis, ZAxis
rot3d_6 = Rotate3D(Geometry=rot3d_4.Geometry, Angle="-pi/2", Center=end_3.Start, Axis=deplane_12.ZAxis)  # -> Geometry, Transform

swp1 = Sweep1(Rail=crv_5, Sections=[rot3d_6.Geometry, rot3d_3.Geometry], Miter=1)
join = BrepJoin(Breps=flatten([swp1, rot3d_6.Geometry, rot3d_3.Geometry]))  # -> Breps, Closed
debrep = DeconstructBrep(Brep=join.Breps)  # -> Faces, Edges, Vertices
item_2 = ListItem(List=debrep.Vertices, Index=0, Wrap=True)  # -> Item, Item1, Item2, Item3, Item4, Item5, Item6, Item7
pt = Point([item_2.Item1, item_2.Item, item_2.Item3, item_2.Item2, item_2.Item5, item_2.Item4, item_2.Item7, item_2.Item6])
item_3 = ListItem(List=pt, Index=Slider(7, range=0..10), Wrap=True)
