# Grasshopper definition crossSecByLine_GH.gh (Grasshopper 1.0.7)
# plug-ins: SolidsVR

crv = Curve(<curve referenced from the Rhino model>)
crv_2 = Curve(<curve referenced from the Rhino model>)
crv_3 = Curve(<curve referenced from the Rhino model>)
crv_4 = Curve(<curve referenced from the Rhino model>)
crv_5 = Curve(<curve referenced from the Rhino model>)
edgesrf = EdgeSurface(CurveA=crv, CurveB=crv_2, CurveC=crv_4, CurveD=crv_5)
srf = Surface(edgesrf)
frames = CurveFrames(Curve=crv_3, Count="1")  # -> Frames, Parameters
end = EndPoints(Curve=crv_3)  # -> Start, End
area = Area(Geometry=srf)  # -> Area, Centroid
item = ListItem(List=frames.Frames, Index=0, Wrap=True)  # -> Item, Item1

subtraction = Subtraction(A=end.End, B=area.Centroid)
move = Move(Geometry=srf, Motion=subtraction)  # -> Geometry, Transform
deplane = DeconstructPlane(Plane=move.Geometry)  # -> Origin, XAxis, YAxis, ZAxis
deplane_2 = DeconstructPlane(Plane=item.Item1)  # -> Origin, XAxis, YAxis, ZAxis
rotate = RotateDirection(Geometry=move.Geometry, Center=end.End, From=deplane.ZAxis, To=deplane_2.ZAxis)  # -> Geometry, Transform
deplane_3 = DeconstructPlane(Plane=rotate.Geometry)  # -> Origin, XAxis, YAxis, ZAxis
rotate_2 = RotateDirection(Geometry=rotate.Geometry, Center=end.End, From=deplane_3.YAxis, To=deplane_2.YAxis)  # -> Geometry, Transform
deplane_4 = DeconstructPlane(Plane=rotate_2.Geometry)  # -> Origin, XAxis, YAxis, ZAxis
rotate_3 = RotateDirection(Geometry=rotate_2.Geometry, Center=end.End, From=deplane_4.XAxis, To=deplane_2.XAxis)  # -> Geometry, Transform
deplane_5 = DeconstructPlane(Plane=rotate_3.Geometry)  # -> Origin, XAxis, YAxis, ZAxis
rot3d = Rotate3D(Geometry=rotate_3.Geometry, Angle="pi/2", Center=end.End, Axis=deplane_5.YAxis)  # -> Geometry, Transform
deplane_6 = DeconstructPlane(Plane=rot3d.Geometry)  # -> Origin, XAxis, YAxis, ZAxis
rot3d_2 = Rotate3D(Geometry=rot3d.Geometry, Angle="pi", Center=end.End, Axis=deplane_6.XAxis)  # -> Geometry, Transform

subtraction_2 = Subtraction(A=end.Start, B=area.Centroid)
deplane_7 = DeconstructPlane(Plane=item.Item)  # -> Origin, XAxis, YAxis, ZAxis
move_2 = Move(Geometry=srf, Motion=subtraction_2)  # -> Geometry, Transform
deplane_8 = DeconstructPlane(Plane=move_2.Geometry)  # -> Origin, XAxis, YAxis, ZAxis
rotate_4 = RotateDirection(Geometry=move_2.Geometry, Center=end.Start, From=deplane_8.ZAxis, To=deplane_7.ZAxis)  # -> Geometry, Transform
deplane_9 = DeconstructPlane(Plane=rotate_4.Geometry)  # -> Origin, XAxis, YAxis, ZAxis
rotate_5 = RotateDirection(Geometry=rotate_4.Geometry, Center=end.Start, From=deplane_9.YAxis, To=deplane_7.YAxis)  # -> Geometry, Transform
deplane_10 = DeconstructPlane(Plane=rotate_5.Geometry)  # -> Origin, XAxis, YAxis, ZAxis
rotate_6 = RotateDirection(Geometry=rotate_5.Geometry, Center=end.Start, From=deplane_10.XAxis, To=deplane_7.XAxis)  # -> Geometry, Transform
deplane_11 = DeconstructPlane(Plane=rotate_6.Geometry)  # -> Origin, XAxis, YAxis, ZAxis
rot3d_3 = Rotate3D(Geometry=rotate_6.Geometry, Angle="pi/2", Center=end.Start, Axis=deplane_11.YAxis)  # -> Geometry, Transform
deplane_12 = DeconstructPlane(Plane=rot3d_3.Geometry)  # -> Origin, XAxis, YAxis, ZAxis
rot3d_4 = Rotate3D(Geometry=rot3d_3.Geometry, Angle="pi", Center=end.Start, Axis=deplane_12.YAxis)  # -> Geometry, Transform

swp1 = Sweep1(Rail=crv_3, Sections=[rot3d_4.Geometry, rot3d_2.Geometry], Miter=1)
join = BrepJoin(Breps=flatten([swp1, rot3d_2.Geometry, rot3d_4.Geometry]))  # -> Breps, Closed
debrep = DeconstructBrep(Brep=join.Breps)  # -> Faces, Edges, Vertices
item_2 = ListItem(List=debrep.Vertices, Index=0, Wrap=True)  # -> Item, Item1, Item2, Item3, Item4, Item5, Item6, Item7
pt = Point([item_2.Item5, item_2.Item6, item_2.Item7, item_2.Item4, item_2.Item1, item_2.Item2, item_2.Item3, item_2.Item])
item_3 = ListItem(List=pt, Index=Slider(7, range=0..7), Wrap=True)
number_slider = Slider(21, range=0..30)  # disabled
number_slider_2 = Slider(3, range=0..10)  # disabled
meshsbrep = MeshSBrep(Brep=join.Breps, Point=pt, UCount=number_slider_2, VCount=number_slider_2, WCount=number_slider, VolumeToRemove=0)  # disabled
deconstruct_meshcbrep = DeconstructMesh(Mesh=meshsbrep)  # -> ElementVertices, Connectivity, Edges, Surfaces, Points, Nodes, Elements; disabled
number_slider_3 = Slider(-10, range=-10..10)  # disabled
crv_6 = Curve(deconstruct_meshcbrep.Edges)  # disabled
number_slider_4 = Slider(3, range=0..5)  # disabled
panel = Panel("9999,9999,9999")  # disabled
number_slider_5 = Slider(5, range=0..5)  # disabled
number_slider_6 = Slider(4, range=0..5)  # disabled
Z = UnitZ(Factor=number_slider_3)  # disabled
# PREDEF
sph = Sphere(Base=panel, Radius=1)  # disabled
panel_2 = Panel("0,0,0")  # disabled
# MATERIAL
panel_3 = Panel("210000")  # disabled
unibc = UniformBCComponentForFEA(SurfaceNumber=number_slider_6, Mesh=meshsbrep)  # -> BCPoints, BCCones, ColoringForBCCones; disabled
panel_4 = Panel("0.3")  # disabled
# LOAD
uniloads = UniformLoadComponentForFEA(SurfaceNumber=number_slider_4, LoadVector=Z, Mesh=meshsbrep)  # -> PointLoads, LoadArrows, ArrowColoring; disabled
panel_5 = Panel("355")  # disabled
unibc_2 = UniformBCComponentForFEA(SurfaceNumber=number_slider_5, Mesh=meshsbrep)  # -> BCPoints, BCCones, ColoringForBCCones; disabled
predef = PreDef(Sphere=sph, PrescribedDeformations=panel_2, Mesh=meshsbrep)  # -> PrescribedDeformations, Text, Plane, Colors, Colors_2; disabled
material = CreateMaterial(EModulus=panel_3, PRatio=panel_4, YieldStress=panel_5)  # disabled
# CALCULATION
topopt = TopOpt(
    Mesh=meshsbrep,
    BoundaryConditions=[unibc.BCPoints, unibc_2.BCPoints],
    PointLoads=uniloads.PointLoads,
    PreDeformations=predef.PrescribedDeformations,
    Material=material)  # -> Displacement, Strain, Stress, Text, Size, Plane, ColorT; disabled
# VIEW STRESSES
number_slider_7 = Slider(6, range=0..6)  # disabled
number_slider_8 = Slider(0, range=0..1000)  # disabled
# VIEW DEFORMATIONS
viewdef = ViewDeformations(Mesh=meshsbrep, Displacement=topopt.Displacement, Scaling=number_slider_8)  # -> BrepSolid, ColorSolid, BrepOuterEdges, ColorEdges, Text, Size, Plane, ColorT; disabled
viewstress = ViewStresses(Mesh=meshsbrep, Stress=topopt.Stress, StressDirection=number_slider_7, Scaling=number_slider_8)  # -> Solid, Color_solid, Legend, Color_legend, Text, Size, Plane, Color_T; disabled
