# Grasshopper definition CurveBrep.gh (Grasshopper 1.0.7)
# plug-ins: SolidsVR

number_slider = Slider(10, range=0..10)
number_slider_2 = Slider(10, range=0..10)
number_slider_3 = Slider(10, range=0..10)
number_slider_4 = Slider(5, range=0..10)
number_slider_5 = Slider(38, range=0..110)
number_slider_6 = Slider(33, range=0..110)
number_slider_7 = Slider(10, range=0..10)
pt = ConstructPoint(XCoordinate=number_slider_4, YCoordinate=number_slider_4, ZCoordinate=0)
pt_2 = ConstructPoint(XCoordinate=number_slider_5, YCoordinate=Slider(5, range=0..10), ZCoordinate=number_slider_5)
pt_3 = ConstructPoint(XCoordinate=Slider(71, range=0..110), YCoordinate=Slider(5, range=0..10), ZCoordinate=Slider(38, range=0..110))
pt_4 = ConstructPoint(XCoordinate=Slider(105, range=0..110), YCoordinate=Slider(5, range=0..10), ZCoordinate=0)
pt_5 = ConstructPoint(XCoordinate=Slider(100, range=0..110), YCoordinate=Slider(10, range=0..10), ZCoordinate=0)
pt_6 = ConstructPoint(XCoordinate=Slider(110, range=0..110), YCoordinate=Slider(10, range=0..10), ZCoordinate=0)
pt_7 = ConstructPoint(XCoordinate=Slider(100, range=0..110), YCoordinate=0, ZCoordinate=0)
pt_8 = ConstructPoint(XCoordinate=0, YCoordinate=Slider(10, range=0..10), ZCoordinate=0)
pt_9 = ConstructPoint(XCoordinate=number_slider_7, YCoordinate=number_slider_7, ZCoordinate=0)
pt_10 = ConstructPoint(XCoordinate=0, YCoordinate=0, ZCoordinate=0)
pt_11 = ConstructPoint(XCoordinate=Slider(10, range=0..10), YCoordinate=0, ZCoordinate=0)
pt_12 = ConstructPoint(XCoordinate=Slider(110, range=0..110), YCoordinate=0, ZCoordinate=0)
pline = PolyLine(Vertices=[pt_6, pt_5, pt_7, pt_12], Closed=Toggle(True))
nurbs = NurbsCurve(Vertices=[pt, pt_2, pt_3, pt_4], Degree=3, Periodic=False)  # -> Curve, Length, Domain
number_slider_8 = Slider(2, range=0..10)
pline_2 = PolyLine(Vertices=[pt_8, pt_9, pt_11, pt_10], Closed=Toggle(True))
swp1 = Sweep1(Rail=nurbs.Curve, Sections=[pline_2, pline], Miter=1)
number_slider_9 = Slider(7, range=0..10)
pt_13 = Point([pt_10, pt_11, pt_9, pt_8, pt_12, pt_7, pt_5, pt_6])
cap = CapHoles(Brep=swp1)
material = CreateMaterial(EModulus="210000", PRatio="0.3")
debrep = DeconstructBrep(Brep=cap)  # -> Faces, Edges, Vertices
item = ListItem(List=debrep.Faces, Index=Slider(1, range=0..5), Wrap=True)
item_2 = ListItem(List=debrep.Faces, Index=Slider(0, range=0..5), Wrap=True)
item_3 = ListItem(List=debrep.Faces, Index=Slider(2, range=0..5), Wrap=True)
Z = UnitZ(Factor="-10")
brep = Brep(cap)
Z_2 = UnitZ(Factor=Slider(0, range=0..100))
meshcbrep = MeshCBrep(Brep=cap, Point=pt_13, UCount=number_slider_8, VCount=number_slider_8, WCount=number_slider_9)
unibc = UniformBCComponentForFEA(Surface=item, UCount=number_slider_8, VCount=number_slider_8, WCount=number_slider_9, Brep=cap)  # -> BCPoints, BCCones, ColoringForBCCones
debrep_2 = DeconstructBrep(Brep=brep)  # -> Faces, Edges, Vertices
unibc_2 = UniformBCComponentForFEA(Surface=item_2, UCount=number_slider_8, VCount=number_slider_8, WCount=number_slider_9, Brep=cap)  # -> BCPoints, BCCones, ColoringForBCCones
uniloads = UniformLoadComponentForFEA(Surface=item_3, LoadVector=Z, UCount=number_slider_8, VCount=number_slider_8, WCount=number_slider_9, Brep=cap)  # -> PointLoads, LoadArrows, ArrowColoring
predef = PreDef(Points="0,0,0", PrescribedDeformations=Z_2)
item_4 = ListItem(List=debrep_2.Vertices, Index=Slider(4, range=0..7), Wrap=True)
femeshtbrep = FiniteElementOfMeshedTBrep(
    Mesh=meshcbrep,
    BoundaryConditions=[unibc.BCPoints, unibc_2.BCPoints],
    PointLoads=uniloads.PointLoads,
    PreDeformations=predef,
    Brep=cap,
    Material=material)  # -> Displacement, Strain, Stress, Nodes, Text, Size, Plane, ColorT
item_5 = ListItem(List=debrep_2.Faces, Index=Slider(5, range=0..7), Wrap=True)
item_6 = ListItem(List=debrep_2.Edges, Index=Slider(0, range=0..12), Wrap=True)
deconstruct_meshcbrep = DeconstructMesh(Mesh=meshcbrep)  # -> ElementVertices, Connectivity, Edges, Surfaces, Nodes
viewdef = ViewDeformations(Mesh=meshcbrep, Displacement=femeshtbrep.Displacement, Scaling=Slider(135, range=0..1000), Brep=cap)  # -> BrepSolid, ColorSolid, BrepOuterEdges, ColorEdges, Text, Size, Plane, ColorT
divide = DivideCurve(Curve=debrep_2.Edges, Count=10, Kinks=False)  # -> Points, Tangents, Parameters
item_7 = ListItem(List=deconstruct_meshcbrep.Surfaces, Index=Slider(0, range=0..10), Wrap=True)
crv = Curve()
srf = Surface(item_7)
panel = Panel(deconstruct_meshcbrep.Surfaces)
branch = TreeBranch(Tree=simplify(deconstruct_meshcbrep.Surfaces), Path="0", MaintainPaths=True)
panel_2 = Panel(branch)
