# Grasshopper definition Case1_Cube_Grasshopper.gh (Grasshopper 1.0.7)
# plug-ins: MindeskText, SolidsVR, MDSKGrasshopper

# BREP
brep = Brep()
# PREDEF
sphere = Brep(<brep referenced from the Rhino model>)
predef_slider = Curve(<curve referenced from the Rhino model>)
brep_2 = Brep(<brep referenced from the Rhino model>)
brep_3 = Brep(<brep referenced from the Rhino model>)
load_value = Curve(<curve referenced from the Rhino model>)
# LOAD AND BC
bc_surf = Curve(<curve referenced from the Rhino model>)
load_surf = Curve(<curve referenced from the Rhino model>)
# MESHING
_3_mesh_curves = Curve([<curve referenced from the Rhino model> x3])
area = Area(Geometry=brep_2)  # -> Area, Centroid
area_2 = Area(Geometry=brep_3)  # -> Area, Centroid
line = Line(StartPoint=area.Centroid, EndPoint=area_2.Centroid)
sweep1 = Sweep1(Rail=line, Sections=brep_2, Miter=1)
cap_holes = CapHoles(Brep=sweep1)
deconstruct_brep = DeconstructBrep(Brep=cap_holes)  # -> Faces, Edges, Vertices
list_item = ListItem(List=deconstruct_brep.Vertices, Index=0, Wrap=True)  # -> Item, Item1, Item2, Item3, Item4, Item5, Item6, Item7
loadslider = LoadSlider(SliderVR=load_value, Brep=cap_holes)  # -> Load, Text, Size, Plane, Colors, Geometry
surfslider = SurfaceSlider(SliderVR=load_surf, Brep=cap_holes)  # -> Surface, Text, Size, Plane, Colors, Geometry
surfslider_2 = SurfaceSlider(SliderVR=bc_surf, Brep=cap_holes)  # -> Surface, Text, Size, Plane, Colors, Geometry
divslider = DivisionSlider(SliderVR=_3_mesh_curves, Brep=cap_holes)  # -> MeshDivisionU, MeshDivisionV, MeshDivisionW, Text, Size, Plane, Colors, Geometry
point = Point([list_item.Item3, list_item.Item7, list_item.Item6, list_item.Item2, list_item.Item, list_item.Item4, list_item.Item5, list_item.Item1])
panel = Panel(surfslider.Surface)
panel_2 = Panel("0")
deconstruct_brep_2 = DeconstructBrep(Brep=cap_holes)  # -> Faces, Edges, Vertices
# LOADS
panel_3 = Panel("4")
list_item_2 = ListItem(List=deconstruct_brep_2.Vertices, Index=0, Wrap=True)  # -> Item, Item1, Item2, Item3, Item4, Item5, Item6, Item7
# MODEL TOGGLE
model_toggle = BooleanToggle(True)
mdsk = MDSK(Geometry=cap_holes, Color=RGB(255, 255, 255), Start=model_toggle)
vr_text = VRTEXT(Text=surfslider.Text, Size=surfslider.Size, Plane=surfslider.Plane, Color=surfslider.Colors, Start=model_toggle)
mdsk_2 = MDSK(Geometry=surfslider.Geometry, Color=surfslider.Colors, Start=model_toggle)
mdsk_3 = MDSK(Geometry=surfslider_2.Geometry, Color=surfslider_2.Colors, Start=model_toggle)
vr_text_2 = VRTEXT(Text=loadslider.Text, Size=loadslider.Size, Plane=loadslider.Plane, Color=loadslider.Colors, Start=model_toggle)
mdsk_4 = MDSK(Geometry=loadslider.Geometry, Color=loadslider.Colors, Start=model_toggle)
vr_text_3 = VRTEXT(Text=divslider.Text, Size=divslider.Size, Plane=divslider.Plane, Color=divslider.Colors, Start=model_toggle)
mdsk_5 = MDSK(Geometry=divslider.Geometry, Color=divslider.Colors, Start=model_toggle)
vr_text_4 = VRTEXT(Text=surfslider_2.Text, Size=surfslider_2.Size, Plane=surfslider_2.Plane, Color=surfslider_2.Colors, Start=model_toggle)
mdsk_6 = MDSK(Geometry=cap_holes, Color=RGB(255, 255, 255), Start=model_toggle)
panel_4 = Panel(deconstruct_brep_2.Vertices)
predefslider = PreDefSlider(SliderVR=predef_slider, Brep=cap_holes)  # -> PrescribedDeformation, Text, Size, Plane, Colors, Geometry
point_2 = Point([list_item_2.Item2, list_item_2.Item7, list_item_2.Item6, list_item_2.Item3, list_item_2.Item1, list_item_2.Item4, list_item_2.Item5, list_item_2.Item])
# MESH
meshcbrep = MeshCBrep(
    Brep=cap_holes,
    Point=point_2,
    UCount=divslider.MeshDivisionU,
    VCount=divslider.MeshDivisionV,
    WCount=divslider.MeshDivisionW,
    VolumeToRemove="0")
deconstruct_mesh = DeconstructMesh(Mesh=meshcbrep)  # -> ElementVertices, Connectivity, Edges, Surfaces, Points, Nodes, Elements
uniform_load_component_for_fea = UniformLoadComponentForFEA(SurfaceNumber=surfslider.Surface, LoadVector=loadslider.Load, Mesh=meshcbrep)  # -> PointLoads, LoadArrows, ArrowColoring
unibc = UniformBCComponentForFEA(SurfaceNumber=surfslider_2.Surface, Mesh=meshcbrep)  # -> BCPoints, BCCones, ColoringForBCCones
deconstruct_mesh_2 = DeconstructMesh(Mesh=meshcbrep)  # -> ElementVertices, Connectivity, Edges, Surfaces, Points, Nodes, Elements
panel_5 = Panel("999")
vr_text_5 = VRTEXT(Text=predefslider.Text, Size=predefslider.Size, Plane=predefslider.Plane, Color=predefslider.Colors, Start=model_toggle)
mdsk_7 = MDSK(Geometry=predefslider.Geometry, Color=predefslider.Colors, Start=model_toggle)
mdsk_8 = MDSK(
    Geometry=uniform_load_component_for_fea.LoadArrows,
    Color=uniform_load_component_for_fea.ArrowColoring,
    Start=model_toggle)
sphere_2 = Sphere(Base=PlaneXY(0, 0, 0), Radius=1)
deconstruct_mesh_3 = DeconstructMesh(Mesh=meshcbrep)  # -> ElementVertices, Connectivity, Edges, Surfaces, Points, Nodes, Elements
panel_6 = Panel("3")
mdsk_9 = MDSK(Geometry=unibc.BCCones, Color=unibc.ColoringForBCCones, Start=model_toggle)
# BC
deconstruct_node = DeconstructNode(Node=deconstruct_mesh_2.Nodes)  # -> Point, Elements, Position, Surfaces, Deformations, Strains, GlobalStrain, GlobalStress
# ANALYSE TOGGLE
preview_toggle = BooleanToggle(True)
move = Move(Geometry=sphere_2, Motion="999,999,999")  # -> Geometry, Transform
predef = PreDef(Sphere=move.Geometry, PrescribedDeformations=predefslider.PrescribedDeformation, Mesh=meshcbrep)  # -> PrescribedDeformations, Text, Plane, Colors
material = CreateMaterial(EModulus="210000", PRatio="0.3", YieldStress="255")
# ANALYSE
topopt = TopOpt(
    Mesh=meshcbrep,
    BoundaryConditions=unibc.BCPoints,
    PointLoads=uniform_load_component_for_fea.PointLoads,
    PreDeformations=predef.PrescribedDeformations,
    Material=material)  # -> Displacement, Strain, Stress, Nodes, Text, Size, Plane, Colors, Nodes_2
vr_text_6 = VRTEXT(Text=topopt.Text, Size=topopt.Size, Plane=topopt.Plane, Color=topopt.Colors, Start=preview_toggle)
scale_def_curve = Curve(<curve referenced from the Rhino model>)
stress_direction = Curve(<curve referenced from the Rhino model>)
defslider = DeformationSlider(SliderVR=scale_def_curve, Brep=cap_holes)  # -> Scale, Text, Size, Plane, Colors, Geometry
stressslider = StressDirectionSlider(SliderVR=stress_direction, Brep=cap_holes)  # -> StressDirection, Text, Size, Plane, Color, Geometry
mdsk_10 = MDSK(Geometry=defslider.Geometry, Color=defslider.Colors, Start=preview_toggle)
# DEFORMATION PREVIEW
viewdef = ViewDeformations(Mesh=meshcbrep, Displacement=topopt.Displacement, Scaling=defslider.Scale)  # -> BrepSolid, ColorSolid, BrepOuterEdges, ColorEdges, Text, Size, Plane, ColorT
vr_text_7 = VRTEXT(Text=defslider.Text, Size=defslider.Size, Plane=defslider.Plane, Color=defslider.Colors, Start=preview_toggle)
mdsk_11 = MDSK(Geometry=stressslider.Geometry, Color=stressslider.Color, Start=preview_toggle)
vr_text_8 = VRTEXT(Text=stressslider.Text, Size=stressslider.Size, Plane=stressslider.Plane, Color=stressslider.Color, Start=preview_toggle)
panel_7 = Panel(defslider.Geometry)
# STRESS PREVIEW
viewstresses = ViewStresses(Mesh=meshcbrep, Stress=topopt.Stress, StressDirection=stressslider.StressDirection, Scaling=defslider.Scale)  # -> BrepSolid, Colors, StressLegend, Colors_2, Text, Size, Plane, Colors_3
mdsk_12 = MDSK(Geometry=viewdef.BrepOuterEdges, Color=viewdef.ColorEdges, Start=preview_toggle)
mdsk_13 = MDSK(Geometry=viewdef.BrepSolid, Color=viewdef.ColorSolid, Start=preview_toggle)
vr_text_9 = VRTEXT(Text=viewdef.Text, Size=viewdef.Size, Plane=viewdef.Plane, Color=viewdef.ColorT, Start=preview_toggle)
vr_text_10 = VRTEXT(
    Text=viewstresses.Text,
    Size=viewstresses.Size,
    Plane=viewstresses.Plane,
    Color=viewstresses.Colors_3,
    Start=preview_toggle)
mdsk_14 = MDSK(Geometry=viewstresses.BrepSolid, Color=viewstresses.Colors, Start=preview_toggle)
mdsk_15 = MDSK(Geometry=viewstresses.StressLegend, Color=viewstresses.Colors_2, Start=preview_toggle)
