# Grasshopper definition Sensor_case2.gh (Grasshopper 1.0.7)
# plug-ins: MindeskText, SolidsVR, MDSKGrasshopper

# ----
# DRAWN CS
crv = Curve(<curve referenced from the Rhino model>)
crv_2 = Curve(<curve referenced from the Rhino model>)
crv_3 = Curve(<curve referenced from the Rhino model>)
crv_4 = Curve(<curve referenced from the Rhino model>)
edgesrf = EdgeSurface(CurveA=crv, CurveB=crv_4, CurveC=crv_2, CurveD=crv_3)
area = Area(Geometry=edgesrf)  # -> Area, Centroid

# ----
# RAIL
crv_5 = Curve(<curve referenced from the Rhino model>)
end = EndPoints(Curve=crv_5)  # -> Start, End

# ----
# SECTION 2
endpoint_curve = Point(end.End)
subtraction = Subtraction(A=endpoint_curve, B=area.Centroid)
move = Move(Geometry=edgesrf, Motion=subtraction)  # -> Geometry, Transform
rot3d = Rotate3D(Geometry=move.Geometry, Angle="3*pi/2", Center=endpoint_curve, Axis=Vector(0, 0, 1))  # -> Geometry, Transform
Y = UnitY(Factor=1)
rot3d_2 = Rotate3D(Geometry=rot3d.Geometry, Angle="pi/2", Center=endpoint_curve, Axis=Y)  # -> Geometry, Transform
Z = UnitZ(Factor=1)
rot3d_3 = Rotate3D(Geometry=rot3d_2.Geometry, Angle="pi", Center=endpoint_curve, Axis=Z)  # -> Geometry, Transform
Z_2 = UnitZ(Factor=1)
rot3d_4 = Rotate3D(Geometry=rot3d_3.Geometry, Angle="pi", Center=endpoint_curve, Axis=Z_2)  # -> Geometry, Transform
debrep = DeconstructBrep(Brep=rot3d_4.Geometry)  # -> Faces, Edges, Vertices

# ----
# SECTION 1
startpoint_curve = Point(end.Start)
subtraction_2 = Subtraction(A=startpoint_curve, B=area.Centroid)
move_2 = Move(Geometry=edgesrf, Motion=subtraction_2)  # -> Geometry, Transform
rot3d_5 = Rotate3D(Geometry=move_2.Geometry, Angle=1.570796327, Center=startpoint_curve, Axis=Vector(0, 0, 1))  # -> Geometry, Transform
Y_2 = UnitY(Factor=1)
rot3d_6 = Rotate3D(Geometry=rot3d_5.Geometry, Angle="pi/2", Center=startpoint_curve, Axis=Y_2)  # -> Geometry, Transform
Z_3 = UnitZ(Factor=1)
rot3d_7 = Rotate3D(Geometry=rot3d_6.Geometry, Angle="pi", Center=startpoint_curve, Axis=Z_3)  # -> Geometry, Transform
debrep_2 = DeconstructBrep(Brep=rot3d_7.Geometry)  # -> Faces, Edges, Vertices

# ----
# GEOMETRY
crv_6 = Curve(crv_5)
swp1 = Sweep1(Rail=crv_6, Sections=[rot3d_7.Geometry, rot3d_4.Geometry], Miter=1)
join = BrepJoin(Breps=flatten([swp1, rot3d_7.Geometry, rot3d_4.Geometry]))  # -> Breps, Closed

# ----
# CONTROL POINTS
pt = Point(flatten([debrep_2.Vertices, debrep.Vertices]))
item = ListItem(List=flatten(pt), Index=0, Wrap=True)  # -> Item, Item1, Item2, Item3, Item4, Item5, Item6, Item7
pt_2 = Point([item.Item3, item.Item2, item.Item1, item.Item, item.Item7, item.Item6, item.Item5, item.Item4])

# ----
# CROSS-SECTION DISPLAY
crv_7 = Curve([crv, crv_4, crv_2, crv_3])
crv_8 = Curve(<curve referenced from the Rhino model>)
crv_9 = Curve([<curve referenced from the Rhino model> x3])
# MESH
divslider = DivisionSlider(SliderVR=crv_9, Brep=join.Breps)  # -> UCount, VCount, WCount, Text, Size, Plane, Colors, Geometry
volumeslider = VolumePercentageSlider(SliderVR=crv_8, Brep=join.Breps)  # -> VolumePercentage, Text, Size, Plane, Color, Geometry
meshsbrep = MeshSBrep(
    Brep=join.Breps,
    Point=pt_2,
    UCount=divslider.UCount,
    VCount=divslider.VCount,
    WCount=divslider.WCount,
    VolumeToRemove=volumeslider.VolumePercentage)
crosssec = GetInformationOfCrossSec(Curves=crv_7, Mesh=meshsbrep)  # -> Point, Colors, Text, Size, Plane, Colors_2
boolean_toggle = BooleanToggle(True)
# MESHING
mdsk = MDSK(Geometry=join.Breps, Color=RGB(255, 255, 255), Start=boolean_toggle)
vr_text = VRTEXT(Text=crosssec.Text, Size=crosssec.Size, Plane=crosssec.Plane, Color=crosssec.Colors_2, Start=boolean_toggle)
mdsk_2 = MDSK(Geometry=volumeslider.Geometry, Color=volumeslider.Color, Start=boolean_toggle)
vr_text_2 = VRTEXT(Text=volumeslider.Text, Size=volumeslider.Size, Plane=volumeslider.Plane, Color=volumeslider.Color, Start=boolean_toggle)
mdsk_3 = MDSK(Geometry=divslider.Geometry, Color=divslider.Colors, Start=boolean_toggle)
vr_text_3 = VRTEXT(Text=divslider.Text, Size=divslider.Size, Plane=divslider.Plane, Color=divslider.Colors, Start=boolean_toggle)
deconstruct_meshcbrep = DeconstructMesh(Mesh=meshsbrep)  # -> ElementVertices, Connectivity, Edges, Surfaces, Points, Nodes, Elements
colour_rgb = ColourRGB(Alpha=255, Red="0", Green="100", Blue="255")
crv_10 = Curve(<curve referenced from the Rhino model>)
crv_11 = Curve(<curve referenced from the Rhino model>)
_4point_surface = _4PointSurface(CornerA="-999,-999,0", CornerB="999,-999,0", CornerC="999,999,0", CornerD="-999,999,0")
crv_12 = Curve(<curve referenced from the Rhino model>)
# BOUNDARY CONDITIONS
crv_13 = Curve(<curve referenced from the Rhino model>)
loadslider = LoadSlider(SliderVR=crv_11, Brep=join.Breps)  # -> Load, Text, Size, Plane, Colors, Geometry
# LOADS
surfslider = SurfaceSlider(SliderVR=crv_10, Brep=join.Breps)  # -> SurfaceNumber, Text, Size, Plane, Colors, Geometry
surfslider_2 = SurfaceSlider(SliderVR=crv_13, Brep=join.Breps)  # -> SurfaceNumber, Text, Size, Plane, Colors, Geometry
surfslider_3 = SurfaceSlider(SliderVR=crv_12, Brep=join.Breps)  # -> SurfaceNumber, Text, Size, Plane, Colors, Geometry
colour_rgb_2 = ColourRGB(Alpha=255, Red="135", Green="206", Blue="255")
mdsk_4 = MDSK(Geometry=crosssec.Point, Color=colour_rgb_2, Start=boolean_toggle)
mdsk_5 = MDSK(Geometry=loadslider.Geometry, Color=loadslider.Colors, Start=boolean_toggle)
area_2 = Area(Geometry=_4point_surface)  # -> Area, Centroid
vr_text_4 = VRTEXT(Text=loadslider.Text, Size=loadslider.Size, Plane=loadslider.Plane, Color=loadslider.Colors, Start=boolean_toggle)
mdsk_6 = MDSK(Geometry=surfslider.Geometry, Color=surfslider.Colors, Start=boolean_toggle)
vr_text_5 = VRTEXT(Text=surfslider.Text, Size=surfslider.Size, Plane=surfslider.Plane, Color=surfslider.Colors, Start=boolean_toggle)
vr_text_6 = VRTEXT(
    Text=surfslider_2.Text,
    Size=surfslider_2.Size,
    Plane=surfslider_2.Plane,
    Color=surfslider_2.Colors,
    Start=boolean_toggle)
mdsk_7 = MDSK(Geometry=surfslider_3.Geometry, Color=surfslider_3.Colors, Start=boolean_toggle)
mdsk_8 = MDSK(Geometry=surfslider_2.Geometry, Color=surfslider_2.Colors, Start=boolean_toggle)
uniloads = UniformLoadComponentForFEA(SurfaceNumber=surfslider.SurfaceNumber, LoadVector=loadslider.Load, Mesh=meshsbrep)  # -> PointLoads, LoadArrows, ArrowColoring
unit_z = UnitZ(Factor=Slider(-1000, range=-1000..1000))
vr_text_7 = VRTEXT(
    Text=surfslider_3.Text,
    Size=surfslider_3.Size,
    Plane=surfslider_3.Plane,
    Color=surfslider_3.Colors,
    Start=boolean_toggle)
crv_14 = Curve(<curve referenced from the Rhino model>)
unibc = UniformBCComponentForFEA(SurfaceNumber=surfslider_2.SurfaceNumber, Mesh=meshsbrep)  # -> BCPoints, BCCones, ColoringForBCCones
scale = Scale(Geometry=_4point_surface, Center=area_2.Centroid, Factor=Slider(585, range=0..1000))  # -> Geometry, Transform
predefslider = PreDefSlider(SliderVR=crv_14, Brep=join.Breps)  # -> PrescribedDeformation, Text, Size, Plane, Colors, Geometry
unibc_2 = UniformBCComponentForFEA(SurfaceNumber=surfslider_3.SurfaceNumber, Mesh=meshsbrep)  # -> BCPoints, BCCones, ColoringForBCCones
move_3 = Move(Geometry=scale.Geometry, Motion=unit_z)  # -> Geometry, Transform
# PREDEF
brep = Brep(<brep referenced from the Rhino model>)
mdsk_9 = MDSK(Geometry=uniloads.LoadArrows, Color=uniloads.ArrowColoring, Start=boolean_toggle)
# MATERIAL
mdsk_10 = MDSK(Geometry=predefslider.Geometry, Color=predefslider.Colors, Start=boolean_toggle)
mdsk_11 = MDSK(Geometry=unibc.BCCones, Color=unibc.ColoringForBCCones, Start=boolean_toggle)
vr_text_8 = VRTEXT(
    Text=predefslider.Text,
    Size=predefslider.Size,
    Plane=predefslider.Plane,
    Color=predefslider.Colors,
    Start=boolean_toggle)
mdsk_12 = MDSK(Geometry=unibc_2.BCCones, Color=unibc_2.ColoringForBCCones, Start=boolean_toggle)
predef = PreDef(Sphere=brep, PrescribedDeformations=predefslider.PrescribedDeformation, Mesh=meshsbrep)  # -> PrescribedDeformations, Text, Plane, Colors, Colors_2
material = CreateMaterial(EModulus="210000", PRatio="0.3", YieldStress="255")
mdsk_13 = MDSK(Geometry=move_3.Geometry, Color=colour_rgb_2, Start=Toggle(False))
vr_text_9 = VRTEXT(Text=predef.Text, Size=predef.Plane, Plane=predef.Colors, Color=predef.Colors_2, Start=boolean_toggle)
# ANALYZE
topopt = TopOpt(
    Mesh=meshsbrep,
    BoundaryConditions=[unibc.BCPoints, unibc_2.BCPoints],
    PointLoads=uniloads.PointLoads,
    PreDeformations=predef.PrescribedDeformations,
    Material=material)  # -> Displacement, Strain, Stress, Nodes, Text, Size, Plane
vr_text_10 = VRTEXT(Text=topopt.Nodes, Size=topopt.Text, Plane=topopt.Size, Color=topopt.Plane, Start=boolean_toggle)
crv_15 = Curve(<curve referenced from the Rhino model>)
surface = Surface([<surface referenced from the Rhino model> x5])
crv_16 = Curve([<curve referenced from the Rhino model> x3])
colour_rgb_3 = ColourRGB(Alpha=255, Red="255", Green="255", Blue="255")
brep_2 = Brep(<brep referenced from the Rhino model>)
defslider = DeformationSlider(SliderVR=crv_15, Brep=join.Breps)  # -> Scale, Text, Size, Plane, Colors, Geometry
headlines = CreateHeadlines(Curves=crv_16, Mesh=meshsbrep)  # -> Text, Size, Plane, Colors
crv_17 = Curve(<curve referenced from the Rhino model>)
node_info = GetInformationOfNode(Sphere=brep_2, Mesh=meshsbrep)  # -> Text, Size, Plane, Colors, TextSphere, Size_2, PlaneSphere
mdsk_14 = MDSK(Geometry=surface, Color=colour_rgb_3, Start=Toggle(True))  # disabled
# VIEW STRESSES
mdsk_15 = MDSK(Geometry=defslider.Geometry, Color=defslider.Colors, Start=boolean_toggle)
stressslider = StressDirectionSlider(SliderVR=crv_17, Brep=join.Breps)  # -> StressDirection, Text, Size, Plane, Color, Geometry
vr_text_11 = VRTEXT(Text=defslider.Text, Size=defslider.Size, Plane=defslider.Plane, Color=defslider.Colors, Start=boolean_toggle)
vr_text_12 = VRTEXT(Text=headlines.Text, Size=headlines.Size, Plane=headlines.Plane, Color=headlines.Colors, Start=boolean_toggle)
vr_text_13 = VRTEXT(Text=node_info.Text, Size=node_info.Size, Plane=node_info.Plane, Color=node_info.Colors, Start=boolean_toggle)
vr_text_14 = VRTEXT(
    Text=node_info.TextSphere,
    Size=node_info.Size_2,
    Plane=node_info.PlaneSphere,
    Color=node_info.Colors,
    Start=boolean_toggle)
# VIEW DEFORMATIONS
viewdef = ViewDeformations(Mesh=meshsbrep, Displacement=topopt.Displacement, Scaling=defslider.Scale)  # -> BrepSolid, ColorSolid, BrepOuterEdges, ColorEdges, Text, Size, Plane, ColorT
mdsk_16 = MDSK(Geometry=stressslider.Geometry, Color=stressslider.Color, Start=boolean_toggle)
viewstress = ViewStresses(Mesh=meshsbrep, Stress=topopt.Stress, StressDirection=stressslider.StressDirection, Scaling=defslider.Scale)  # -> Solid, Color_solid, Legend, Color_legend, Text, Size, Plane, Color_T
vr_text_15 = VRTEXT(Text=stressslider.Text, Size=stressslider.Size, Plane=stressslider.Plane, Color=stressslider.Color, Start=boolean_toggle)
mdsk_17 = MDSK(Geometry=viewdef.BrepSolid, Color=viewdef.ColorSolid, Start=boolean_toggle)
mdsk_18 = MDSK(Geometry=viewdef.BrepOuterEdges, Color=viewdef.ColorEdges, Start=boolean_toggle)
vr_text_16 = VRTEXT(Text=viewdef.Text, Size=viewdef.Size, Plane=viewdef.Plane, Color=viewdef.ColorT, Start=boolean_toggle)
mdsk_19 = MDSK(Geometry=viewstress.Solid, Color=viewstress.Color_solid, Start=boolean_toggle)
mdsk_20 = MDSK(Geometry=viewstress.Legend, Color=viewstress.Color_legend, Start=boolean_toggle)
vr_text_17 = VRTEXT(Text=viewstress.Text, Size=viewstress.Size, Plane=viewstress.Plane, Color=viewstress.Color_T, Start=boolean_toggle)
