# Grasshopper definition VR_geometry_case4.gh (Grasshopper 1.0.7)
# plug-ins: MindeskText, SolidsVR, MDSKGrasshopper

point2 = Point(<point referenced from the Rhino model>)
point3 = Point(<point referenced from the Rhino model>)
# Cross Section 1
point1 = Point(<point referenced from the Rhino model>)
point4 = Point(<point referenced from the Rhino model>)
point2_2 = Point(<point referenced from the Rhino model>)
point3_2 = Point(<point referenced from the Rhino model>)
point1_2 = Point(<point referenced from the Rhino model>)
point4_2 = Point(<point referenced from the Rhino model>)
# POINTS FOR FIXING ORDER
pt = Point([point1, point2, point3, point4, point1_2, point2_2, point3_2, point4_2])

# ---- group: Curve1
control1 = Point(<point referenced from the Rhino model>)
control2 = Point(<point referenced from the Rhino model>)
pt_2 = Point([point1, control1, control2, point2])
nurbs = NurbsCurve(Vertices=pt_2, Degree=3, Periodic=False)  # -> Curve, Length, Domain

# ---- group: Curve1 / Curve3
control1_2 = Point(<point referenced from the Rhino model>)
control2_2 = Point(<point referenced from the Rhino model>)
pt_3 = Point([point3, control1_2, control2_2, point4])
nurbs_2 = NurbsCurve(Vertices=pt_3, Degree=3, Periodic=False)  # -> Curve, Length, Domain

# ---- group: Curve1 / Curve2
control1_3 = Point(<point referenced from the Rhino model>)
control2_3 = Point(<point referenced from the Rhino model>)
pt_4 = Point([point2, control1_3, control2_3, point3])
nurbs_3 = NurbsCurve(Vertices=pt_4, Degree=3, Periodic=False)  # -> Curve, Length, Domain

# ---- group: Curve1 / Curve4
control1_4 = Point(<point referenced from the Rhino model>)
control2_4 = Point(<point referenced from the Rhino model>)
pt_5 = Point([point4, control1_4, control2_4, point1])
nurbs_4 = NurbsCurve(Vertices=pt_5, Degree=3, Periodic=False)  # -> Curve, Length, Domain

# ---- group: Curve1
# Cross Section 2
control1_5 = Point(<point referenced from the Rhino model>)
control2_5 = Point(<point referenced from the Rhino model>)
pt_6 = Point([point1_2, control1_5, control2_5, point2_2])
nurbs_5 = NurbsCurve(Vertices=pt_6, Degree=3, Periodic=False)  # -> Curve, Length, Domain

# ---- group: Curve1 / Curve3
control1_6 = Point(<point referenced from the Rhino model>)
control2_6 = Point(<point referenced from the Rhino model>)
pt_7 = Point([point3_2, control1_6, control2_6, point4_2])
nurbs_6 = NurbsCurve(Vertices=pt_7, Degree=3, Periodic=False)  # -> Curve, Length, Domain

# ---- group: Curve1 / Curve2
control1_7 = Point(<point referenced from the Rhino model>)
control2_7 = Point(<point referenced from the Rhino model>)
pt_8 = Point([point2_2, control1_7, control2_7, point3_2])
nurbs_7 = NurbsCurve(Vertices=pt_8, Degree=3, Periodic=False)  # -> Curve, Length, Domain

# ---- group: Curve1 / Curve4
control1_8 = Point(<point referenced from the Rhino model>)
control2_8 = Point(<point referenced from the Rhino model>)
pt_9 = Point([point4_2, control1_8, control2_8, point1_2])
nurbs_8 = NurbsCurve(Vertices=pt_9, Degree=3, Periodic=False)  # -> Curve, Length, Domain

# ----
# RAIL
crv = Curve(<curve referenced from the Rhino model>)
crv_2 = Curve(<curve referenced from the Rhino model>)
crv_3 = Curve(<curve referenced from the Rhino model>)
crv_4 = Curve(<curve referenced from the Rhino model>)
crv_5 = Curve(<curve referenced from the Rhino model>)
crv_6 = Curve(<curve referenced from the Rhino model>)
crv_7 = Curve(<curve referenced from the Rhino model>)
crv_8 = Curve(<curve referenced from the Rhino model>)
crv_9 = Curve(<curve referenced from the Rhino model>)
edgesrf = EdgeSurface(CurveA=crv_2, CurveB=crv_3, CurveC=crv_4, CurveD=crv_5)
edgesrf_2 = EdgeSurface(CurveA=crv_7, CurveB=crv_6, CurveC=crv_8, CurveD=crv_9)
area = Area(Geometry=edgesrf_2)  # -> Area, Centroid
area_2 = Area(Geometry=edgesrf)  # -> Area, Centroid
swp1 = Sweep1(Rail=crv, Sections=[edgesrf, edgesrf_2], Miter=1)
curve = Curve([<curve referenced from the Rhino model> x3])
join = BrepJoin(Breps=flatten([swp1, edgesrf, edgesrf_2]))  # -> Breps, Closed
cap = CapHoles(Brep=swp1)
divisionslider = DivisionSlider(SliderVR=curve, Brep=join.Breps)  # -> UCount, VCount, WCount, Text, Size, Plane, Colors, Geometry
curve_2 = Curve(<curve referenced from the Rhino model>)
volumepercentageslider = VolumePercentageSlider(SliderVR=curve_2, Brep=join.Breps)  # -> VolumePercentage, Text, Size, Plane, Color, Geometry
panel = Panel("0")
meshsbrep = MeshSBrep(
    Brep=join.Breps,
    Point=pt,
    UCount=divisionslider.UCount,
    VCount=divisionslider.VCount,
    WCount=divisionslider.WCount,
    VolumeToRemove=volumepercentageslider.VolumePercentage)  # -> Mesh, Curve, Surface, Curve_2, Surfaces
deconstruct_meshcbrep = DeconstructMesh(Mesh=meshsbrep.Mesh)  # -> ElementVertices, Connectivity, Edges, Surfaces, Points, Nodes, Elements
# MESH
meshsbrep_2 = MeshSBrep(
    Brep=join.Breps,
    Point=pt,
    UCount=divisionslider.UCount,
    VCount=divisionslider.VCount,
    WCount=divisionslider.WCount,
    VolumeToRemove=0)  # -> Mesh, Curve, Surface, Curve_2, Surfaces
panel_2 = Panel(volumepercentageslider.VolumePercentage)
crv_10 = Curve(<curve referenced from the Rhino model>)
crv_11 = Curve(<curve referenced from the Rhino model>)
crv_12 = Curve(<curve referenced from the Rhino model>)
curve_3 = Curve(<curve referenced from the Rhino model>)
crv_13 = Curve(<curve referenced from the Rhino model>)
surfslider = SurfaceSlider(SliderVR=crv_10, Brep=join.Breps)  # -> SurfaceNumber, Text, Size, Plane, Colors, Geometry
boolean_toggle = BooleanToggle(True)
mdsk = MDSK(Geometry=join.Breps, Color=RGB(255, 255, 255), Start=boolean_toggle)
mdsk_2 = MDSK(Geometry=divisionslider.Geometry, Color=divisionslider.Colors, Start=boolean_toggle)
vr_text = VRTEXT(
    Text=divisionslider.Text,
    Size=divisionslider.Size,
    Plane=divisionslider.Plane,
    Color=divisionslider.Colors,
    Start=boolean_toggle)
mdsk_3 = MDSK(Geometry=volumepercentageslider.Geometry, Color=volumepercentageslider.Color, Start=boolean_toggle)
vr_text_2 = VRTEXT(
    Text=volumepercentageslider.Text,
    Size=volumepercentageslider.Size,
    Plane=volumepercentageslider.Plane,
    Color=volumepercentageslider.Color,
    Start=boolean_toggle)
surfslider_2 = SurfaceSlider(SliderVR=crv_12, Brep=join.Breps)  # -> SurfaceNumber, Text, Size, Plane, Colors, Geometry
loadslider = LoadSlider(SliderVR=crv_11, Brep=join.Breps)  # -> Load, Text, Size, Plane, Colors, Geometry
predefslider = PreDefSlider(SliderVR=crv_13, Brep=join.Breps)  # -> PrescribedDeformation, Text, Size, Plane, Colors, Geometry
surfslider_3 = SurfaceSlider(SliderVR=curve_3, Brep=join.Breps)  # -> SurfaceNumber, Text, Size, Plane, Colors, Geometry
mdsk_4 = MDSK(Geometry=surfslider.Geometry, Color=surfslider.Colors, Start=boolean_toggle)
vr_text_3 = VRTEXT(Text=surfslider.Text, Size=surfslider.Size, Plane=surfslider.Plane, Color=surfslider.Colors, Start=boolean_toggle)
mdsk_5 = MDSK(Geometry=loadslider.Geometry, Color=loadslider.Colors, Start=boolean_toggle)
mdsk_6 = MDSK(Geometry=surfslider_2.Geometry, Color=surfslider_2.Colors, Start=boolean_toggle)
vr_text_4 = VRTEXT(Text=loadslider.Text, Size=loadslider.Size, Plane=loadslider.Plane, Color=loadslider.Colors, Start=boolean_toggle)
vr_text_5 = VRTEXT(
    Text=surfslider_2.Text,
    Size=surfslider_2.Size,
    Plane=surfslider_2.Plane,
    Color=surfslider_2.Colors,
    Start=boolean_toggle)
mdsk_7 = MDSK(Geometry=predefslider.Geometry, Color=predefslider.Colors, Start=boolean_toggle)
vr_text_6 = VRTEXT(
    Text=predefslider.Text,
    Size=predefslider.Size,
    Plane=predefslider.Plane,
    Color=predefslider.Colors,
    Start=boolean_toggle)
brep = Brep(<brep referenced from the Rhino model>)
brep_2 = Brep(<brep referenced from the Rhino model>)
mdsk_8 = MDSK(Geometry=surfslider_3.Geometry, Color=surfslider_3.Colors, Start=boolean_toggle)
vr_text_7 = VRTEXT(
    Text=surfslider_3.Text,
    Size=surfslider_3.Size,
    Plane=surfslider_3.Plane,
    Color=surfslider_3.Colors,
    Start=boolean_toggle)
get_information_of_node = GetInformationOfNode(Sphere=brep, Mesh=meshsbrep.Mesh)  # -> Text, Size, Plane, Colors, TextSphere, Size_2, PlaneSphere
predef = PreDef(Sphere=brep_2, PrescribedDeformations=predefslider.PrescribedDeformation, Mesh=meshsbrep.Mesh)  # -> PrescribedDeformations, Text, Plane, Colors
unibc = UniformBCComponentForFEA(SurfaceNumber=surfslider_2.SurfaceNumber, Mesh=meshsbrep.Mesh)  # -> BCPoints, BCCones, ColoringForBCCones
uniloads = UniformLoadComponentForFEA(SurfaceNumber=surfslider_3.SurfaceNumber, LoadVector=loadslider.Load, Mesh=meshsbrep.Mesh)  # -> PointLoads, LoadArrows, ArrowColoring
unibc_2 = UniformBCComponentForFEA(SurfaceNumber=surfslider.SurfaceNumber, Mesh=meshsbrep.Mesh)  # -> BCPoints, BCCones, ColoringForBCCones
vr_text_8 = VRTEXT(
    Text=get_information_of_node.Text,
    Size=get_information_of_node.Size,
    Plane=get_information_of_node.Plane,
    Color=get_information_of_node.Colors,
    Start=boolean_toggle)
material = CreateMaterial(EModulus="210000", PRatio="0.3", YieldStress="255")
vr_text_9 = VRTEXT(
    Text=get_information_of_node.TextSphere,
    Size=get_information_of_node.Size_2,
    Plane=get_information_of_node.PlaneSphere,
    Color=get_information_of_node.Colors,
    Start=boolean_toggle)
vr_text_10 = VRTEXT(Text=predef.Text, Size=get_information_of_node.Size, Plane=predef.Plane, Color=predef.Colors, Start=boolean_toggle)
mdsk_9 = MDSK(Geometry=uniloads.LoadArrows, Color=uniloads.ArrowColoring, Start=boolean_toggle)
mdsk_10 = MDSK(Geometry=unibc.BCCones, Color=unibc.ColoringForBCCones, Start=boolean_toggle)
mdsk_11 = MDSK(Geometry=unibc_2.BCCones, Color=unibc_2.ColoringForBCCones, Start=boolean_toggle)
topopt = TopOpt(
    Mesh=meshsbrep.Mesh,
    BoundaryConditions=[unibc_2.BCPoints, unibc.BCPoints],
    PointLoads=uniloads.PointLoads,
    PreDeformations=predef.PrescribedDeformations,
    Material=material)  # -> Displacement, Strain, Stress, Nodes, Text, Size, Plane, Colors, Nodes_2
vr_text_11 = VRTEXT(Text=topopt.Text, Size=topopt.Size, Plane=topopt.Plane, Color=topopt.Colors, Start=boolean_toggle)
crv_14 = Curve(<curve referenced from the Rhino model>)
stressslider = StressDirectionSlider(SliderVR=crv_14, Brep=join.Breps)  # -> StressDirection, Text, Size, Plane, Color, Geometry
crv_15 = Curve(<curve referenced from the Rhino model>)
defslider = DeformationSlider(SliderVR=crv_15, Brep=join.Breps)  # -> Scale, Text, Size, Plane, Colors, Geometry
viewdeformations = ViewDeformations(Mesh=meshsbrep.Mesh, Displacement=topopt.Displacement, Scaling=defslider.Scale)  # -> BrepSolid, ColorSolid, BrepOuterEdges, ColorEdges, Text, Size, Plane, Colors
mdsk_12 = MDSK(Geometry=stressslider.Geometry, Color=stressslider.Color, Start=boolean_toggle)
vr_text_12 = VRTEXT(Text=stressslider.Text, Size=stressslider.Size, Plane=stressslider.Plane, Color=stressslider.Color, Start=boolean_toggle)
viewstresses = ViewStresses(Mesh=meshsbrep.Mesh, Stress=topopt.Stress, StressDirection=stressslider.StressDirection, Scaling=defslider.Scale)  # -> BrepSolid, Colors, StressLegend, Colors_2, Text, Size, Plane, Colors_3
mdsk_13 = MDSK(Geometry=defslider.Geometry, Color=defslider.Colors, Start=boolean_toggle)
vr_text_13 = VRTEXT(Text=defslider.Text, Size=defslider.Size, Plane=defslider.Plane, Color=defslider.Colors, Start=boolean_toggle)
vr_text_14 = VRTEXT(
    Text=viewdeformations.Text,
    Size=viewdeformations.Size,
    Plane=viewdeformations.Plane,
    Color=viewdeformations.Colors,
    Start=boolean_toggle)
mdsk_14 = MDSK(Geometry=viewdeformations.BrepSolid, Color=viewdeformations.ColorSolid, Start=boolean_toggle)
mdsk_15 = MDSK(Geometry=viewdeformations.BrepOuterEdges, Color=viewdeformations.ColorEdges, Start=boolean_toggle)
vr_text_15 = VRTEXT(
    Text=viewstresses.Text,
    Size=viewstresses.Size,
    Plane=viewstresses.Plane,
    Color=viewstresses.Colors_3,
    Start=boolean_toggle)
mdsk_16 = MDSK(Geometry=viewstresses.BrepSolid, Color=viewstresses.Colors, Start=boolean_toggle)
mdsk_17 = MDSK(Geometry=viewstresses.StressLegend, Color=viewstresses.Colors_2, Start=boolean_toggle)
