# Grasshopper definition compare.gh (Grasshopper 1.0.7)
# plug-ins: SolidsVR

number_slider = Slider(0, range=0..5)
number_slider_2 = Slider(2, range=0..5)
pt = ConstructPoint(XCoordinate=0, YCoordinate="1000", ZCoordinate="1000")
pt_2 = ConstructPoint(XCoordinate=0, YCoordinate=0, ZCoordinate=0)
pt_3 = ConstructPoint(XCoordinate=0, YCoordinate="1000", ZCoordinate=0)
pt_4 = ConstructPoint(XCoordinate=0, YCoordinate=0, ZCoordinate="1000")
pt_5 = ConstructPoint(XCoordinate="1000", YCoordinate=0, ZCoordinate=0)
pt_6 = ConstructPoint(XCoordinate="1000", YCoordinate="1000", ZCoordinate=0)
pt_7 = ConstructPoint(XCoordinate="1000", YCoordinate="1000", ZCoordinate="1000")
pt_8 = ConstructPoint(XCoordinate="1000", YCoordinate=0, ZCoordinate="1000")
number_slider_3 = Slider(0, range=0..100)
number_slider_4 = Slider(5, range=0..10)
Z = UnitZ(Factor="-10")
pt_9 = Point([pt_2, pt_3, pt, pt_4, pt_5, pt_6, pt_7, pt_8])
vec = VectorXYZ(XComponent=number_slider_3, YComponent=number_slider_3, ZComponent=number_slider_3)  # -> Vector, Length
p2b = PointsToBrep(Points=pt_9)
debrep = DeconstructBrep(Brep=p2b)  # -> Faces, Edges, Vertices
item = ListItem(List=debrep.Faces, Index=number_slider, Wrap=True)
item_2 = ListItem(List=debrep.Faces, Index=number_slider_2, Wrap=True)
number_slider_5 = Slider(4, range=0..20)
predef = PreDef(Points="0,0,0", PrescribedDeformations=vec.Vector)
meshcbrep = MeshCBrep(Brep=p2b, Point=pt_9, UCount=number_slider_5, VCount=number_slider_5, WCount=number_slider_5)
uniloads = UniformLoadComponentForFEA(SurfaceNumber=number_slider_2, LoadVector=Z, Mesh=meshcbrep)  # -> PointLoads, LoadArrows, ArrowColoring
unibc = UniformBCComponentForFEA(Surface=number_slider, UCount=meshcbrep)  # -> BCPoints, BCCones, ColoringForBCCones
panel = Panel(unibc.BCPoints)
panel_2 = Panel(uniloads.PointLoads)
material = CreateMaterial(EModulus="210000", PRatio="0.3")
femeshtbrep = FiniteElementOfMeshedTBrep(
    Mesh=meshcbrep,
    BoundaryConditions=unibc.BCPoints,
    PointLoads=uniloads.PointLoads,
    PreDeformations=predef,
    Brep=p2b,
    Material=material)  # -> Disp, Strain, Stress, N, Text, Size, Plane, Color_T, Nodes
viewdef = ViewDeformations(Mesh=meshcbrep, Displacement=femeshtbrep.Disp, Scaling=Slider(21, range=0..100))  # -> BrepSolid, ColorSolid, BrepOuterEdges, ColorEdges, Text, Size, Plane, ColorT
item_3 = ListItem(List=femeshtbrep.Stress, Index="6", Wrap=True)
panel_3 = Panel(item_3)
panel_4 = Panel(femeshtbrep.Stress)
