# Grasshopper definition saveFriflow_gh.gh (Grasshopper 1.0.7)
# plug-ins: MindeskText, SolidsVR, MDSKGrasshopper

height = Slider(2, range=0..10)
crv = Curve(<curve referenced from the Rhino model>)
crv_2 = Curve(<curve referenced from the Rhino model>)
crv_3 = Curve(<curve referenced from the Rhino model>)
end = EndPoints(Curve=crv)  # -> Start, End
cp = ControlPoints(Curve=crv)  # -> Points, Weights, Knots
end_2 = EndPoints(Curve=crv_2)  # -> Start, End
Y = UnitY(Factor=height)
cp_2 = ControlPoints(Curve=crv_2)  # -> Points, Weights, Knots
end_3 = EndPoints(Curve=crv_3)  # -> Start, End
cp_3 = ControlPoints(Curve=crv_3)  # -> Points, Weights, Knots
neg = Negative(Value=height)
Y_2 = UnitY(Factor=height)
neg_2 = Negative(Value=Y)
Y_3 = UnitY(Factor=height)
neg_3 = Negative(Value=height)
Z = UnitZ(Factor=neg)
move = Move(Geometry=end.Start, Motion=Y)  # -> Geometry, Transform
move_2 = Move(Geometry=end.End, Motion=neg_2)  # -> Geometry, Transform
neg_4 = Negative(Value=Y_2)
neg_5 = Negative(Value=height)
Z_2 = UnitZ(Factor=neg_3)
neg_6 = Negative(Value=Y_3)
move_3 = Move(Geometry=end_2.Start, Motion=Y_2)  # -> Geometry, Transform
move_4 = Move(Geometry=end_2.End, Motion=neg_4)  # -> Geometry, Transform
move_5 = Move(Geometry=cp.Points, Motion=Z)  # -> Geometry, Transform
Z_3 = UnitZ(Factor=neg_5)
move_6 = Move(Geometry=end_3.Start, Motion=Y_3)  # -> Geometry, Transform
move_7 = Move(Geometry=end_3.End, Motion=neg_6)  # -> Geometry, Transform
move_8 = Move(Geometry=cp_2.Points, Motion=Z_2)  # -> Geometry, Transform
item = ListItem(List=simplify(flatten(move_5.Geometry)), Index=0, Wrap=True)  # -> Item, Item1, Item2, Item3
move_9 = Move(Geometry=cp_3.Points, Motion=Z_3)  # -> Geometry, Transform
item_2 = ListItem(List=simplify(flatten(move_8.Geometry)), Index=0, Wrap=True)  # -> Item, Item1, Item2, Item3
item_3 = ListItem(List=simplify(flatten(move_9.Geometry)), Index=0, Wrap=True)  # -> Item, Item1, Item2, Item3
pt = Point(flatten([move.Geometry, item.Item1, item.Item2, item.Item3, move_2.Geometry]))
pt_2 = Point(flatten([move_3.Geometry, item_2.Item1, item_2.Item2, item_2.Item3, move_4.Geometry]))
nurbs = NurbsCurve(Vertices=pt, Degree=3, Periodic=False)  # -> Curve, Length, Domain
pt_3 = Point(flatten([move_6.Geometry, item_3.Item1, item_3.Item2, item_3.Item3, move_7.Geometry]))
nurbs_2 = NurbsCurve(Vertices=pt_2, Degree=3, Periodic=False)  # -> Curve, Length, Domain
nurbs_3 = NurbsCurve(Vertices=pt_3, Degree=3, Periodic=False)  # -> Curve, Length, Domain
loft = Loft(
    Curves=[crv, crv_2, crv_3],
    Options={Adjust=False, Closed=False, LoftEnds=0, LoftSimp=0, LoftType=0, Rebuild=10, Refit=0.01})
debrep = DeconstructBrep(Brep=loft)  # -> Faces, Edges, Vertices
ln = Line(StartPoint=move.Geometry, EndPoint=end.Start)
ln_2 = Line(StartPoint=move_6.Geometry, EndPoint=end_3.Start)
loft_2 = Loft(
    Curves=[nurbs.Curve, nurbs_2.Curve, nurbs_3.Curve],
    Options={Adjust=False, Closed=False, LoftEnds=0, LoftSimp=0, LoftType=0, Rebuild=10, Refit=0.01})
ln_3 = Line(StartPoint=move_2.Geometry, EndPoint=end.End)
item_4 = ListItem(List=debrep.Edges, Index=0, Wrap=True)  # -> Item, Item1, Item2, Item3
crv_4 = Curve(item_4.Item)
debrep_2 = DeconstructBrep(Brep=loft_2)  # -> Faces, Edges, Vertices
ln_4 = Line(StartPoint=move_7.Geometry, EndPoint=end_3.End)
crv_5 = Curve(item_4.Item2)
item_5 = ListItem(List=debrep_2.Edges, Index=0, Wrap=True)  # -> Item, Item1, Item2, Item3
crv_6 = Curve(item_5.Item)
edgesrf = EdgeSurface(CurveA=ln, CurveB=crv_4, CurveC=ln_2, CurveD=crv_6)
crv_7 = Curve(item_5.Item2)
edgesrf_2 = EdgeSurface(CurveA=ln_3, CurveB=crv_7, CurveC=ln_4, CurveD=crv_5)
pt_4 = Point([end.Start, end_3.Start, move_6.Geometry, move.Geometry, end.End, end_3.End, move_7.Geometry, move_2.Geometry])
crv_8 = Curve(item_5.Item3)
line = Line(ln_3)
line_2 = Line(ln)
crv_9 = Curve(item_4.Item3)
line_3 = Line(ln_4)
crv_10 = Curve(item_4.Item1)
edgesrf_3 = EdgeSurface(CurveA=line_2, CurveB=crv_9, CurveC=line, CurveD=crv_8)
line_4 = Line(ln_2)
crv_11 = Curve(item_5.Item1)
edgesrf_4 = EdgeSurface(CurveA=line_4, CurveB=crv_10, CurveC=line_3, CurveD=crv_11)
join = BrepJoin(Breps=flatten([edgesrf, edgesrf_2, edgesrf_3, edgesrf_4, loft_2, loft]))  # -> Breps, Closed
sph = Sphere(Base=PlaneXY(0, 0, 0), Radius=1)
meshsbrep = MeshSBrep(
    Brep=join.Breps,
    Point=pt_4,
    UCount=Slider(30, range=0..60),
    VCount=Slider(1, range=0..10),
    WCount=Slider(30, range=0..60),
    VolumeToRemove=Slider(0, range=0..30))
move_10 = Move(Geometry=sph, Motion="999,999,999")  # -> Geometry, Transform
deconstruct_meshcbrep = DeconstructMesh(Mesh=meshsbrep)  # -> ElementVertices, Connectivity, Edges, Surfaces, Points, Nodes, Elements
predef = PreDef(Sphere=move_10.Geometry, PrescribedDeformations="0,0,0", Mesh=meshsbrep)  # -> PrescribedDeformations, Text, Plane, Colors, Colors_2
uniloads = UniformLoadComponentForFEA(SurfaceNumber=Slider(0, range=0..5), LoadVector="0,0,-1", Mesh=meshsbrep)  # -> PointLoads, LoadArrows, ArrowColoring
unibc = UniformBCComponentForFEA(SurfaceNumber=Slider(4, range=0..5), Mesh=meshsbrep)  # -> BCPoints, BCCones, ColoringForBCCones
material = CreateMaterial(EModulus="210000", PRatio="0.3", YieldStress="355")
unibc_2 = UniformBCComponentForFEA(SurfaceNumber=Slider(5, range=0..5), Mesh=meshsbrep)  # -> BCPoints, BCCones, ColoringForBCCones
item_6 = ListItem(List=deconstruct_meshcbrep.Points, Index=0, Wrap=True)
topopt = TopOpt(
    Mesh=meshsbrep,
    BoundaryConditions=[unibc.BCPoints, unibc_2.BCPoints],
    PointLoads=uniloads.PointLoads,
    PreDeformations=predef.PrescribedDeformations,
    Material=material)  # -> Displacement, Strain, Stress, Text, Size, Plane, ColorT
number_slider = Slider(0, range=0..200)
viewstresses = ViewStresses(Mesh=meshsbrep, Stress=topopt.Stress, StressDirection=Slider(6, range=0..6), Scaling=number_slider)  # -> BrepSolid, Colors, StressLegend, Colors_2, Text, Size, Plane, Colors_3
viewdef = ViewDeformations(Mesh=meshsbrep, Displacement=topopt.Displacement, Scaling=number_slider)  # -> BrepSolid, ColorSolid, BrepOuterEdges, ColorEdges, Text, Size, Plane, ColorT
boolean_toggle = BooleanToggle(True)
mdsk = MDSK(Geometry=viewstresses.BrepSolid, Color=viewstresses.Colors, Start=boolean_toggle)
vr_text = VRTEXT(
    Text=viewstresses.Text,
    Size=viewstresses.Size,
    Plane=viewstresses.Plane,
    Color=viewstresses.Colors_3,
    Start=boolean_toggle)
mdsk_2 = MDSK(Geometry=viewstresses.StressLegend, Color=viewstresses.Colors_2, Start=boolean_toggle)
